# Grasshopper definition 1 structure analysis.gh (Grasshopper 1.0.7)
# plug-ins: Kiwi3d, MetaHopper, Heteroptera, K2Engineering, PlanktonGh, Human, Karamba3D, Kangaroo2 Components, Pufferfish, Pterodactyl, OpenNest, Stripper, Weaverbird

# ---- group: plywood 18
panel = Panel("plywood18")  # disabled
panel_2 = Panel("Plywood")  # disabled
panel_3 = Panel("914.8")  # disabled
panel_4 = Panel("0.3")  # disabled
panel_5 = Panel("835.2")  # disabled
panel_6 = Panel("20.6")  # disabled
panel_7 = Panel("62")  # disabled
panel_8 = Panel("6.8")  # disabled
panel_9 = Panel("3.92")  # disabled
panel_10 = Panel("3.58")  # disabled
panel_11 = Panel("0.95")  # disabled
panel_12 = Panel("-2.72")  # disabled
panel_13 = Panel("-2.48")  # disabled
matprops = MaterialPropertiesKaramba3D(
    FamilyOfMaterial=panel_2,
    Name=panel,
    YoungsModulusKNCm2Dir1=panel_3,
    YoungsModulusKNCm2Dir2=panel_5,
    InPlaneShearModulus_kN_cm2=panel_6,
    InPlaneLateralContractionCoefficient=panel_4,
    TransverseShearModulusKNCm2Dir1=panel_7,
    TransverseShearModulusKNCm2Dir2=panel_7,
    SpecificWeight_kN_m3=panel_8,
    CoefficientOfThermalExpansion1CDir1=1.2e-05,
    CoefficientOfThermalExpansion1CDir2=1.2e-05,
    TensileStrengthKNCm2Dir1=panel_9,
    TensileStrengthKNCm2Dir2=panel_10,
    CompressiveStrengthKNCm2Dir1=panel_12,
    CompressiveStrengthKNCm2Dir2=panel_13,
    ShearStrengthKNCm2Dir12=panel_11,
    TsaiWuIntCoeff=0,
    StrengthHypothesis="MISES",
    mode="Orthotropic")  # disabled

# ----
input = DataInput(
    Destination="Z:\Desktop\MPDA\s2\s2_3ways\s2_3ways\0 form finding.ghdata",
    RelativePath="Z:\Desktop\MPDA\s2\s2_3ways\s2_3ways\0 form finding.ghdata|file:\\\Z:\Desktop\MPDA\s2\s2_3ways\s2_3ways\0 form finding.ghdata",
    UpdateDelay=9223372036854775807)  # -> mesh, _3ways_lines, line_index_weavebird_mesh_edges
multiplication = Multiplication(A=Slider(6, range=0..10), B=Slider(0.0155, range=0..0.1))
line = Line(input._3ways_lines)
mesh = Mesh(input.mesh)
demesh = DeconstructMesh(Mesh=mesh)  # -> flatten(Vertices), Faces, Colours, Normals
join = JoinCurves(Curves=line, Preserve=False)
explode = Explode(Curve=join, Recursive=True)  # -> Segments, Vertices
patch = Patch(Points=demesh.Vertices, Spans=20, Flexibility=1, Trim=True)
intcrv = Interpolate(Vertices=explode.Vertices, Degree=3, Periodic=False, KnotStyle=1)  # -> reparameterize(simplify(Curve)), Length, Domain
crv_polyline = Curve(join)
crv_cp = CurveClosestPoint(Point=explode.Vertices, Curve=intcrv.Curve)  # -> Point, Parameter, Distance
panel_14 = Panel("""{0;0}
{0;1}
{1;0}
{1;1}
{2;4}
{2:10}""")
curve_intersection_value = TreeBranch(Tree=simplify(crv_cp.Parameter), Path=panel_14, MaintainPaths=True)
curve_lower = TreeBranch(Tree=intcrv.Curve, Path=panel_14, MaintainPaths=True)
eval = EvaluateCurve(Curve=reparameterize(graft(curve_lower)), Parameter=curve_intersection_value)  # -> Point, Tangent, Angle

# ---- group: Karamba
matprops_2 = MaterialPropertiesKaramba3D(
    FamilyOfMaterial="Plywood",
    Name="plywood15",
    YoungsModulusKNCm2Dir1="922.3",
    YoungsModulusKNCm2Dir2="827.7",
    InPlaneShearModulus_kN_cm2="20.7",
    InPlaneLateralContractionCoefficient="0.3",
    TransverseShearModulusKNCm2Dir1="62",
    TransverseShearModulusKNCm2Dir2="62",
    SpecificWeight_kN_m3="6.8",
    CoefficientOfThermalExpansion1CDir1=1.2e-05,
    CoefficientOfThermalExpansion1CDir2=1.2e-05,
    TensileStrengthKNCm2Dir1="3.95",
    TensileStrengthKNCm2Dir2="3.55",
    CompressiveStrengthKNCm2Dir1="-2.74",
    CompressiveStrengthKNCm2Dir2="-2.46",
    ShearStrengthKNCm2Dir12="0.95",
    TsaiWuIntCoeff=0,
    StrengthHypothesis="MISES",
    mode="Orthotropic")

# ----
pshift = ShiftPaths(Data=intcrv.Curve, Offset=-1)

the_surface = Surface(patch)  # disabled
srf_cp = SurfaceClosestPoint(Point=crv_cp.Point, Surface=the_surface)  # -> Point, UVPoint, Distance; disabled
evalsrf = EvaluateSurface(Surface=the_surface, Point=srf_cp.UVPoint)  # -> Point, Normal, UDirection, VDirection, Frame; disabled
vec = Vector(simplify(evalsrf.Normal))  # disabled
section_axis = SectionAxis(CurveParameter=crv_cp.Parameter, SectionAxis=vec)  # disabled

amp = Amplitude(Vector=evalsrf.Normal, Amplitude=multiplication)
move = Move(Geometry=explode.Vertices, Motion=amp)  # -> Geometry, Transform
intcrv_2 = Interpolate(Vertices=move.Geometry, Degree=3, Periodic=False, KnotStyle=1)  # -> simplify(Curve), Length, Domain
curve_upper = TreeBranch(Tree=intcrv_2.Curve, Path=panel_14, MaintainPaths=True)
branch = TreeBranch(Tree=vec, Path=panel_14, MaintainPaths=True)

list = ValueList({"LIN_ELAST_ISOTROPIC": 1}, selected="LIN_ELAST_ISOTROPIC")
toggle = BooleanToggle(True)
section_axis_2 = SectionAxis(CurveParameter=curve_intersection_value, SectionAxis=branch)
prestress_properties = PrestressPropertiesBeam(L=False, AB1=toggle, AB2=False, AT=toggle, N=0, M1=0, M2=0, T=0)
height = Number(0.015)
width = Number(0.13)
toggle_2 = BooleanToggle(False)
box = BoxSection(Height=height, Width=width, Thickness=0)  # -> Section, Area
mat = Material(Name="Plywood15", Type=list, YoungsModulus="9223000", AlphaT=0, Nue=0, Density="0.68", Strength="39500")
crvref = CurveRefinement(PDeg=1, ElementRefU="1", IsKnotApproxElementSize=False, IsKnotSubdivision=True)
beam = BeamElement(
    C=reparameterize(curve_upper),
    M=mat,
    S=box.Section,
    R=crvref,
    AB=section_axis_2,
    P=prestress_properties,
    HS=toggle_2,
    HE=toggle_2,
    HB=toggle_2)  # -> flatten(StructuralBeamElement)

eval_2 = EvaluateCurve(Curve=reparameterize(graft(curve_upper)), Parameter=curve_intersection_value)  # -> Point, Tangent, Angle
cctpt = ConnectingPoint(Point1=eval.Point, Point2=eval_2.Point)  # -> simplify(ConnectingPoint)
panel_15 = Panel(cctpt)
panel_16 = Panel(branch)

# ---- group: Plywood material
list_2 = ValueList({"LIN_ELAST_ISOTROPIC": 1}, selected="LIN_ELAST_ISOTROPIC")  # disabled
panel_17 = Panel("9223000")  # disabled
panel_18 = Panel("Plywood15")  # disabled
panel_19 = Panel("0.68")  # disabled
panel_20 = Panel("39500")  # disabled
mat_2 = Material(Name=panel_18, Type=list_2, YoungsModulus=panel_17, AlphaT=0, Nue=0, Density=panel_19, Strength=panel_20)  # disabled

# ----
toggle_3 = BooleanToggle(True)  # disabled
prestress_properties_2 = PrestressPropertiesBeam(L=False, AB1=toggle_3, AB2=False, AT=toggle_3, N=0, M1=0, M2=0, T=0)  # disabled
height_2 = Number(0.015)  # disabled
width_2 = Number(0.13)  # disabled
panel_21 = Panel("1")  # disabled
toggle_4 = BooleanToggle(False)  # disabled
box_2 = BoxSection(Height=height_2, Width=width_2, Thickness=0)  # -> Section, Area; disabled
crvref_2 = CurveRefinement(PDeg=1, ElementRefU=panel_21, IsKnotApproxElementSize=False, IsKnotSubdivision=True)  # disabled
beam_2 = BeamElement(
    C=reparameterize(intcrv.Curve),
    M=mat_2,
    S=box_2.Section,
    R=crvref_2,
    AB=section_axis,
    P=prestress_properties_2,
    HS=toggle_4,
    HE=toggle_4,
    HB=toggle_4)  # disabled

list_3 = ValueList({"Displacements": 1, "Stresses": 2, "SupportForces": 3}, selected=["Displacements", "Stresses", "SupportForces"])  # disabled
ldc = LoadDisplCurve(TimeStepList=[0, 10], ValueList=[0, 1])  # disabled
panel_22 = Panel("s2sa_test33")  # disabled
panel_23 = Panel("10")  # disabled
nonlina = NonLinearAnalysis(
    Name=panel_22,
    Iterations=panel_23,
    EquilibriumAccurancy=0.001,
    OutputSetting=list_3,
    GlobalLDCurve=ldc,
    AdaptiveForceControl=0,
    OutputFrequency=1)  # disabled

list_4 = ValueList({"Displacements": 1, "Stresses": 2, "SupportForces": 3}, selected=["Displacements", "Stresses", "SupportForces"])  # disabled
panel_24 = Panel("s2sa_test2")  # disabled
lina = LinearAnalysis(Name=panel_24, OutputSetting=list_4)  # disabled

# ---- group: Karamba / Loads (Karamba3D)
loads = LoadsKaramba3D(Vector=Vector(0, 0, -1), LCase="0", mode="Gravity")  # -> flatten(Load)

# ---- group: Material
list_5 = ValueList({"LIN_ELAST_ISOTROPIC": 1}, selected="LIN_ELAST_ISOTROPIC")  # disabled
panel_25 = Panel("11600000")  # disabled
panel_26 = Panel("Kerto S")  # disabled
panel_27 = Panel("0.48")  # disabled
panel_28 = Panel("35000")  # disabled
mat_3 = Material(Name=panel_26, Type=list_5, YoungsModulus=panel_25, AlphaT=0, Nue=0, Density=panel_27, Strength=panel_28)  # disabled

list_6 = ValueList({"LIN_ELAST_ISOTROPIC": 1}, selected="LIN_ELAST_ISOTROPIC")  # disabled
panel_29 = Panel("11600000")  # disabled
panel_30 = Panel("Kerto S")  # disabled
panel_31 = Panel("0.48")  # disabled
panel_32 = Panel("35000")  # disabled
mat_4 = Material(Name=panel_30, Type=list_6, YoungsModulus=panel_29, AlphaT=0, Nue=0, Density=panel_31, Strength=panel_32)  # disabled

# ----
panel_33 = Panel("pd_analysis")  # disabled
path = FilePath("\\Mac\Home\Desktop\MPDA\s2\screenshot\")  # disabled
capture = Capture(Path=path, Filename=panel_33)  # disabled

data = Data(Tree({0;0}: ["527.0734", "1054.1467", "801.3689", "622.3606", "609.0243", "552.4527"], {0;1}: ["4.3056", "0.9466", "1.3388", "3.3418", "1.7809", "4.4322"]))  # disabled
path_2 = FilePath("\\Mac\Home\Desktop\MPDA\s2\screenshot\")  # disabled

list_7 = ValueList({"LIN_ELAST_ISOTROPIC": 1}, selected="LIN_ELAST_ISOTROPIC")
mat_5 = Material(Name="Plywood15", Type=list_7, YoungsModulus="9223000", AlphaT=0, Nue=0, Density="0.68", Strength="39500")

panel_34 = Panel("plywood15")  # disabled
panel_35 = Panel("Plywood")  # disabled
panel_36 = Panel("922.3")  # disabled
panel_37 = Panel("0.3")  # disabled
panel_38 = Panel("827.7")  # disabled
panel_39 = Panel("20.7")  # disabled
panel_40 = Panel("62")  # disabled
panel_41 = Panel("6.8")  # disabled
panel_42 = Panel("3.95")  # disabled
panel_43 = Panel("3.55")  # disabled
panel_44 = Panel("0.95")  # disabled
panel_45 = Panel("-2.74")  # disabled
panel_46 = Panel("-2.46")  # disabled
matprops_3 = MaterialPropertiesKaramba3D(
    FamilyOfMaterial=panel_35,
    Name=panel_34,
    YoungsModulusKNCm2Dir1=panel_36,
    YoungsModulusKNCm2Dir2=panel_38,
    InPlaneShearModulus_kN_cm2=panel_39,
    InPlaneLateralContractionCoefficient=panel_37,
    TransverseShearModulusKNCm2Dir1=panel_40,
    TransverseShearModulusKNCm2Dir2=panel_40,
    SpecificWeight_kN_m3=panel_41,
    CoefficientOfThermalExpansion1CDir1=1.2e-05,
    CoefficientOfThermalExpansion1CDir2=1.2e-05,
    TensileStrengthKNCm2Dir1=panel_42,
    TensileStrengthKNCm2Dir2=panel_43,
    CompressiveStrengthKNCm2Dir1=panel_45,
    CompressiveStrengthKNCm2Dir2=panel_46,
    ShearStrengthKNCm2Dir12=panel_44,
    TsaiWuIntCoeff=0,
    StrengthHypothesis="MISES",
    mode="Orthotropic")  # disabled

list_8 = ValueList({"Displacements": 1, "Stresses": 2, "SupportForces": 3}, selected=["Displacements", "Stresses", "SupportForces"])  # disabled
panel_47 = Panel("foundation_beam_kiwi")  # disabled
lina_2 = LinearAnalysis(Name=panel_47, OutputSetting=list_8)  # disabled

# ---- group: Karamba
bang = ExplodeTree(Data=crv_polyline)  # -> Branch0, Branch1, Branch2
toggle_5 = GroupToggle(ToggleActive=True, ToggleVisible=False)  # disabled
mesh_2 = Mesh(mesh)

# ----
number_slider = Slider(5, range=0..18)
number_slider_2 = Slider(13, range=0..18)
item = ListItem(List=bang.Branch1, Index=[number_slider, number_slider_2], Wrap=True)
cull_i = CullIndex(List=bang.Branch1, Indices=[number_slider, number_slider_2], Wrap=True)

number_slider_3 = Slider(13, range=0..18)
number_slider_4 = Slider(5, range=0..18)
item_2 = ListItem(List=bang.Branch0, Index=[number_slider_4, number_slider_3], Wrap=True)
cull_i_2 = CullIndex(List=bang.Branch0, Indices=[number_slider_4, number_slider_3], Wrap=True)

# ---- group: Karamba
crv = Curve(bang.Branch2)
crv_2 = Curve(bang.Branch1)
crv_3 = Curve(bang.Branch0)

# ----
number_slider_5 = Slider(3, range=0..18)
number_slider_6 = Slider(15, range=0..18)
item_3 = ListItem(List=crv, Index=[number_slider_5, number_slider_6], Wrap=True)
cull_i_3 = CullIndex(List=bang.Branch2, Indices=[number_slider_5, number_slider_6], Wrap=True)

panel_48 = Panel("""0
1""")
cull = CullPattern(List=crv_3, CullPattern=invert(panel_48))
cull_2 = CullPattern(List=crv_3, CullPattern=panel_48)

panel_49 = Panel("""0
1""")
cull_3 = CullPattern(List=crv_2, CullPattern=invert(panel_49))
cull_4 = CullPattern(List=crv_2, CullPattern=panel_49)

# ---- group: Karamba
panel_50 = Panel("""0
1""")
cull_5 = CullPattern(List=crv, CullPattern=invert(panel_50))
cull_6 = CullPattern(List=crv, CullPattern=panel_50)

# ----
entwine = Entwine(Branch00=item_2, Branch01=item, Branch02=cull_6, FlattenInputs=True)

# ---- group: Karamba
entwine_2 = Entwine(Branch00=cull_i_2, Branch01=cull_i, Branch02=cull_i_3, FlattenInputs=True)
explode_2 = Explode(Curve=entwine_2, Recursive=True)  # -> Segments, Vertices
trim = TrimTree(Tree=explode_2.Segments, Depth=1)
multiplication_2 = Multiplication(A=Slider(0.015, range=0..0.1), B="100")
multiplication_3 = Multiplication(A=Slider(0.13, range=0..1), B="100")
cross_section = CrossSectionKaramba3D(
    FamilyNameOfCrossSection="DefaultCroSec",
    Material=matprops_2,
    Height_cm=multiplication_2,
    UpperFlangeWidth_cm=multiplication_3,
    LowerFlangeWidth_cm=multiplication_3,
    mode="Trapezoid")  # -> flatten(CrossSection)
panel_51 = Panel("""dir1a
dir2a
dir3a""")

number_slider_7 = Slider(13, range=0..40)
explode_3 = Explode(Curve=entwine, Recursive=True)  # -> Segments, Vertices
multiplication_4 = Multiplication(A=multiplication_2, B="2")
trim_2 = TrimTree(Tree=explode_3.Segments, Depth=1)
cross_section_2 = CrossSectionKaramba3D(
    FamilyNameOfCrossSection="DefaultCroSec",
    Material=matprops_2,
    Height_cm=multiplication_4,
    UpperFlangeWidth_cm=multiplication_3,
    LowerFlangeWidth_cm=multiplication_3,
    mode="Trapezoid")  # -> flatten(CrossSection)
midpt = CurveMiddle(Curve=trim_2)
meshcp = MeshClosestPoint(Point=midpt, Mesh=mesh_2)  # -> Point, Index, Parameter
panel_52 = Panel("""dir1b
dir2b
dir3b""")
meval = MeshEval(Mesh=mesh_2, Parameter=meshcp.Parameter)  # -> Point, Normal, Colour
linetobeam = LineToBeamKaramba3D(
    Line=trim_2,
    Identifier=graft(panel_52),
    CrossSection=cross_section_2,
    New=True,
    Remove=True,
    LimitDistance_m=0.005,
    ZOrientation=meval.Normal,
    Bending=True,
    SetBucklingLength=True,
    ToPolylineMaxAngle=0.03,
    ToPolylineTolerance=0.01,
    ToPolylineMinEdgeLength=0.25)  # -> Element, Points, Info

# ----
midpt_2 = CurveMiddle(Curve=trim)

# ---- group: Karamba (continued)
meshcp_2 = MeshClosestPoint(Point=midpt_2, Mesh=mesh_2)  # -> Point, Index, Parameter
meval_2 = MeshEval(Mesh=mesh_2, Parameter=meshcp_2.Parameter)  # -> Point, Normal, Colour
linetobeam_2 = LineToBeamKaramba3D(
    Line=trim,
    Identifier=graft(panel_51),
    CrossSection=cross_section,
    New=True,
    Remove=True,
    LimitDistance_m=0.005,
    ZOrientation=meval_2.Normal,
    Bending=True,
    SetBucklingLength=True,
    ToPolylineMaxAngle=0.03,
    ToPolylineTolerance=0.01,
    ToPolylineMinEdgeLength=0.25)  # -> Element, Points, Info

# ----
crv_smooth = Curve(pshift)  # disabled
toggle_6 = GroupToggle(ToggleActive=True, ToggleVisible=False)  # disabled
mesh_3 = Mesh(mesh)  # disabled
panel_53 = Panel("18")  # disabled
number_slider_8 = Slider(30, range=0..30)  # disabled
swatch = ColourSwatch(SwatchColor=RGB(245, 54, 54))  # disabled

bang_2 = ExplodeTree(Data=simplify(crv_smooth))  # -> Branch0, Branch1, Branch2; disabled
crv_4 = Curve(reparameterize(bang_2.Branch1))  # disabled
crv_5 = Curve(reparameterize(bang_2.Branch0))  # disabled
crv_6 = Curve(reparameterize(bang_2.Branch2))  # disabled
merge = Merge(Data1=crv_5, Data2=crv_4, Data3=crv_6)  # disabled

# ---- group: snow load
facen = FaceNormals(Mesh=mesh_3)  # -> Centers, Normals
devec = DeconstructVector(Vector=unitize(facen.Normals))  # -> XComponent, YComponent, ZComponent
abs = Absolute(Value=devec.XComponent)
abs_2 = Absolute(Value=devec.YComponent)
abs_3 = Absolute(Value=devec.ZComponent)
addition = Addition(A=abs, B=abs_2)
larger = LargerThan(FirstNumber=abs_3, SecondNumber=addition)  # -> LargerThan, OrEqualTo
cullf = CullFaces(Mesh=mesh_3, Pattern=invert(larger.LargerThan))
number_slider_9 = Slider(1.9, range=0..10)  # disabled
pmesh = PlanktonMesh(cullf)
mvarea = MeshVertexArea(PlanktonMesh=pmesh)  # -> Vertices, VertexNormals
Z = UnitZ(Factor=number_slider_9)  # disabled
msnow = MeshSnowLoad(Snow=Z, VertexNormals=mvarea.VertexNormals, Option=False)  # disabled
list_9 = ValueList({"DEAD": 1, "SNOW": 2, "PRES": 3, "PRES_FL": 4, "MOMENT": 5}, selected="DEAD")  # disabled
panel_54 = Panel("0.001")  # disabled
multiplication_5 = Multiplication(A=msnow, B=panel_54)  # disabled
Z_2 = UnitZ(Factor=-1)
snowload = PointLoad(Point=mvarea.Vertices, Loadtype=list_9, Direction=Z_2, Value=multiplication_5, LoadCase=1)  # disabled

# ---- group: Wind load
pmesh_2 = PlanktonMesh(mesh_3)  # disabled
mvarea_2 = MeshVertexArea(PlanktonMesh=pmesh_2)  # -> Vertices, VertexNormals; disabled
number_slider_10 = Slider(0, range=0..2)  # disabled
number_slider_11 = Slider(0.53, range=0..2)  # disabled
X = UnitX(Factor=1)  # disabled
Z_3 = UnitZ(Factor=1)  # disabled
pi = Pi(Factor=number_slider_10)  # disabled
vrot = Rotate(Vector=X, Axis=Z_3, Angle=pi)  # disabled
toggle_7 = BooleanToggle(True)  # disabled
amp_2 = Amplitude(Vector=vrot, Amplitude=expr("x* 0.5", number_slider_11))  # disabled
mwind = MeshWindLoad(Wind=amp_2, VertexNormals=mvarea_2.VertexNormals, Option=toggle_7)  # disabled
list_10 = ValueList({"DEAD": 1, "SNOW": 2, "PRES": 3, "PRES_FL": 4, "MOMENT": 5}, selected="PRES")  # disabled
panel_55 = Panel("0.001")  # disabled
multiplication_6 = Multiplication(A=mwind, B=panel_55)  # disabled
windload = PointLoad(Point=mvarea_2.Vertices, Loadtype=list_10, Direction=mvarea_2.VertexNormals, Value=multiplication_6, LoadCase=1)  # disabled

# ---- group: support
end = EndPoints(Curve=crv_smooth)  # -> Start, End; disabled
pt = Point(flatten([end.Start, end.End]))  # disabled
pdecon = Deconstruct(Point=pt)  # -> XComponent, YComponent, ZComponent; disabled
panel_56 = Panel("0.02")  # disabled
smaller = SmallerThan(FirstNumber=pdecon.ZComponent, SecondNumber=panel_56)  # -> SmallerThan, OrEqualTo; disabled
dispatch = Dispatch(List=pt, DispatchPattern=smaller.SmallerThan)  # -> ListA, ListB; disabled
pt_2 = Point(dispatch.ListA)  # disabled
duppt = RemoveDuplicatePts(Points=pt_2, Tolerance=0.01)
suppt = SupportPoint(Point=duppt, DispX=True, DispY=True, DispZ=True, Rotation=False, Torsion=False, TryStrongSupport=True)  # disabled

# ---- group: coupling
python = GhPythonScript(cvA=flatten(crv_5), cvB=flatten(crv_4))  # -> out, ptLst, cv1, cv2; inputs cvA: list of Curve, cvB: list of Curve; disabled
# ---------- python: Python ----------
__author__ = "zenorm"
__version__ = "2022.04.09"

import rhinoscriptsyntax as rs
import Rhino.Geometry as rg

cv1 = []
cv2 = []
ptLst = []
for i in cvA:
    for j in cvB:
        intersect = rs.CurveCurveIntersection(i,j,-1)
        if intersect != None:
            print intersect[0][5]
            if (intersect[0][0] == 1) & (intersect[0][5] != 1.0) & (intersect[0][5] != 0.0) & (intersect[0][7] != 0.0) & (intersect[0][7] != 1.0):
                pt = intersect[0][1]
                ptLst.append(pt)
                cv1.append(i)
                cv2.append(j)
# ---------- end python ----------
python_2 = GhPythonScript(cvA=flatten(crv_5), cvB=flatten(crv_6))  # -> out, ptLst, cv1, cv2; inputs cvA: list of Curve, cvB: list of Curve; disabled
# ---------- python_2: Python ----------
__author__ = "zenorm"
__version__ = "2022.04.09"

import rhinoscriptsyntax as rs
import Rhino.Geometry as rg

cv1 = []
cv2 = []
ptLst = []
for i in cvA:
    for j in cvB:
        intersect = rs.CurveCurveIntersection(i,j,-1)
        if intersect != None:
            if (intersect[0][0] == 1) & (intersect[0][5] != 1.0) & (intersect[0][5] != 0.0) & (intersect[0][7] != 0.0) & (intersect[0][7] != 1.0):
                pt = intersect[0][1]
                ptLst.append(pt)
                cv1.append(i)
                cv2.append(j)
# ---------- end python_2 ----------
python_3 = GhPythonScript(cvA=flatten(crv_4), cvB=flatten(crv_6))  # -> out, ptLst, cv1, cv2; inputs cvA: list of Curve, cvB: list of Curve; disabled; same code as python_2
srf_cp_2 = SurfaceClosestPoint(Point=python.ptLst, Surface=the_surface)  # -> Point, UVPoint, Distance; disabled
srf_cp_3 = SurfaceClosestPoint(Point=python_2.ptLst, Surface=the_surface)  # -> Point, UVPoint, Distance; disabled
srf_cp_4 = SurfaceClosestPoint(Point=python_3.ptLst, Surface=the_surface)  # -> Point, UVPoint, Distance; disabled
evalsrf_2 = EvaluateSurface(Surface=the_surface, Point=srf_cp_2.UVPoint)  # -> Point, simplify(Normal), UDirection, VDirection, Frame; disabled
evalsrf_3 = EvaluateSurface(Surface=the_surface, Point=srf_cp_3.UVPoint)  # -> Point, simplify(Normal), UDirection, VDirection, Frame; disabled
evalsrf_4 = EvaluateSurface(Surface=the_surface, Point=srf_cp_4.UVPoint)  # -> Point, simplify(Normal), UDirection, VDirection, Frame; disabled
cpta = CouplingPointAxis(
    Point=graft(python_3.ptLst),
    Curve1=graft(python_3.cv1),
    Curve2=graft(python_3.cv2),
    Axis=graft(evalsrf_4.Normal),
    CheckProximity=True)  # disabled
cpta_2 = CouplingPointAxis(
    Point=graft(python_2.ptLst),
    Curve1=graft(python_2.cv1),
    Curve2=graft(python_2.cv2),
    Axis=graft(evalsrf_3.Normal),
    CheckProximity=True)  # disabled
cpta_3 = CouplingPointAxis(
    Point=graft(python.ptLst),
    Curve1=graft(python.cv1),
    Curve2=graft(python.cv2),
    Axis=graft(evalsrf_2.Normal),
    CheckProximity=True)  # disabled
relay = Relay([cpta_3, cpta_2, cpta])  # disabled

# ---- group: self load
list_11 = ValueList({"DEAD": 1, "SNOW": 2, "PRES": 3, "PRES_FL": 4, "MOMENT": 5}, selected="DEAD")  # disabled
panel_57 = Panel("""Gravity
680kg/m3 * 0.1m * 0.019m * 10N / 1000 = 6.8Kn/m3 * 0.0019m2
= 0.01292 """)  # disabled
panel_58 = Panel("0.013")  # disabled
crvload = CurveLoad(Crv=merge, Loadtype=list_11, Direction=Vector(0, 0, -1), Value=panel_58, LoadCase=1)  # -> flatten(CurveLoad); disabled

# ----
loads_2 = Merge(Data1=flatten(windload), Data2=crvload, Data3=flatten(snowload))  # disabled
number_slider_12 = Slider(0.71, range=0..1)  # disabled
number_slider_13 = Slider(1, range=0..1)  # disabled
visopt = VisualizeOptions(
    ScaleCrossSections=1,
    ScaleSupports=1,
    ScaleLoads=number_slider_13,
    ScaleCouplingPoints=1,
    ScaleConnectingPoints=number_slider_12,
    ScaleRefinedControlPoints=1,
    ColourBeam=RGB(211, 211, 211),
    ColourCable=RGB(255, 255, 255),
    ColourSupports=RGB(232, 65, 119),
    ColourLoads=RGB(232, 65, 119),
    ColourConnects=RGB(255, 255, 255),
    ColourRefinedPatches=RGB(139, 0, 0),
    ColourSliding=RGB(135, 16, 55))  # disabled
amodel = AnalysisModel(
    Analysis=nonlina,
    StructuralElements=flatten(beam_2),
    Supports=flatten([suppt, relay]),
    Loads=loads_2,
    Visualizer=visopt,
    IntersectionTolerance=0.01,
    IsCarat=True,
    IsKratos=False,
    PenaltyFac=10000000,
    ShowCouplingIDs=False,
    ShowEdgeIDs=False,
    ShowGeo=True,
    ShowPatchIDs=True,
    ShowPrePro=True,
    ShowRef=False,
    mUsedVersion="BETA 0.6.0")  # disabled

button = Button()  # disabled
number_slider_14 = Slider(1, range=1..50)  # disabled
number_slider_15 = Slider(10, range=0..10)  # disabled
run_analysis = IGASolver(AnalysisModel=amodel, Run=button, antiFreeze=False, showWindow=True)  # -> ResultModel, ErrorReport; disabled
list_12 = ValueList({"N": 1, "M1": 2, "M2": 3, "Mt": 4, "V1": 5, "V2": 6, "N stress": 7, "Shear stress 1": 8, "Shear stress 2": 9, "v Mises stress": 10, "Utilization (v Mises)": 11, "Cross Section": 12}, selected="Utilization (v Mises)")  # disabled
panel_59 = Panel(run_analysis.ErrorReport)  # disabled
defmod = DeformedModel(Model=run_analysis.ResultModel, LoadCase=number_slider_15, ScaleFactor=number_slider_14, FlyingNodeLimit=100000)  # -> Model, Geo, DeformedStructuralElements; disabled
number_slider_16 = Slider(0.847, range=0..1)  # disabled
crv_7 = Curve(defmod.Geo)  # disabled
_1dresview = _1DElementResultView(Model=defmod.Model, Type=list_12, ScaleFactor=number_slider_16, ShowColourPlot=True)  # -> Results, ResultList, Mesh, LegendC, LegendT; disabled
legend = Legend(Colour=_1dresview.LegendC, Tags=_1dresview.LegendT, LegendType=1)  # disabled

number_slider_17 = Slider(20, range=0..100)  # disabled
number_slider_18 = Slider(0.05, range=0..0.1)  # disabled
crv_8 = Curve(flatten(crv_smooth))  # disabled
series = Series(Start=0, Step=number_slider_18, Count=number_slider_17)  # disabled
crv_9 = Curve(defmod.Geo)  # disabled
eval_3 = EvaluateCurve(Curve=reparameterize(graft(crv_8)), Parameter=series)  # -> Point, Tangent, Angle; disabled
eval_4 = EvaluateCurve(Curve=reparameterize(graft(crv_9)), Parameter=series)  # -> Point, Tangent, Angle; disabled
dist = Distance(PointA=eval_3.Point, PointB=eval_4.Point)  # disabled
num = Number(dist)  # disabled
bnd = Bounds(Numbers=num)  # disabled
extremums = MinMax(Number=num)  # -> Minimum, Maximum; disabled
dedomain = DeconstructDomain(Domain=bnd)  # -> Start, End; disabled

item_4 = ListItem(List=eval_3.Point, Index=panel_53, Wrap=True)  # disabled
item_5 = ListItem(List=eval_4.Point, Index=panel_53, Wrap=True)  # disabled
index = ItemIndex(List=num, Item=dedomain.End)  # disabled
ln = Line(StartPoint=item_4, EndPoint=item_5)  # disabled
panel_60 = Panel(num)  # disabled
previewlw = CustomPreviewLineweights(Geometry=ln, Shader=swatch, Thickness=number_slider_8, Absolute=False)  # disabled

supportforces = SupportForces(Model=run_analysis.ResultModel, Type=1, ScaleFactor=1)  # -> Force, Location, Weight
clean = CleanTree(RemoveNulls=True, RemoveInvalid=True, RemoveEmpty=False, Tree=supportforces.Location)  # -> flatten(Tree)
clean_2 = CleanTree(RemoveNulls=True, RemoveInvalid=True, RemoveEmpty=False, Tree=supportforces.Force)  # -> flatten(Tree)
neg = Negative(Value=clean_2)

# ----
# foundation beam analysis kiwi
pdecon_2 = Deconstruct(Point=flatten(clean))  # -> XComponent, YComponent, ZComponent
pt_3 = ConstructPoint(XCoordinate=pdecon_2.XComponent, YCoordinate=pdecon_2.YComponent, ZCoordinate=0)
duppt_2 = RemoveDuplicatePts(Points=pt_3, Tolerance=0.01)
network = ProximityNetwork(Points=duppt_2, Distance=Slider(1.08, range=0..2))  # -> PointPointTopology, ConnectionPointTopology, Lines
join_2 = JoinCurves(Curves=network.Lines, Preserve=False)  # -> simplify(graft(Curves))

offset = OffsetCurve(Curve=join_2, Distance=Slider(0.3, range=0..1), Corners=1)  # -> simplify(Curve)
explode_4 = Explode(Curve=join_2, Recursive=True)  # -> Segments, Vertices
loft = Loft(
    Curves=[offset, join_2],
    Options={Adjust=False, Closed=False, LoftEnds=0, LoftSimp=0, LoftType=0, Rebuild=10, Refit=0.01})
midpt_3 = CurveMiddle(Curve=explode_4.Segments)
crv_cp_2 = CurveClosestPoint(Point=midpt_3, Curve=join_2)  # -> Point, Parameter, Distance
eval_5 = EvaluateCurve(Curve=offset, Parameter=crv_cp_2.Parameter)  # -> Point, Tangent, Angle

# ----
# foundation beam analysis karamba
smesh = SimpleMesh(Brep=loft)
subdivide = SubdivideMesh(Mesh=smesh, Level=1, Type=1)
wbnaked = WeaverbirdsNakedBoundary(MeshClosedPolylines=subdivide)
splitatcorners = SplitAtCorners(Poly=wbnaked, Angle=1)  # -> Corners, Parts
item_6 = ListItem(List=splitatcorners.Parts, Index=[Slider(1, range=0..1), Slider(3, range=0..10)], Wrap=True)
explode_5 = Explode(Curve=item_6, Recursive=True)  # -> Segments, Vertices
cull_7 = CullPattern(List=explode_5.Vertices, CullPattern=[False, True])

# ---- group: support force
old_support_location = ClosestPoint(Point=explode_4.Vertices, Cloud=duppt_2)  # -> ClosestPoint, CPIndex, Distance
index_2 = ItemIndex(List=duppt_2, Item=old_support_location.ClosestPoint)
support_force_unflatten = ListItem(List=neg, Index=index_2, Wrap=True)

# ----
vec_2 = Vector(support_force_unflatten)

number_slider_19 = Slider(3, range=0..5)  # disabled
cross_section_3 = CrossSectionKaramba3D(FamilyNameOfCrossSection="DefaultCroSec", Material=matprops_3, Height_cm=number_slider_19, mode="Shell - Const")  # disabled
panel_61 = Panel("foundation beam")  # disabled
pshift_2 = ShiftPaths(Data=cull_7, Offset=-1)  # disabled
meshtoshell = MeshToShellKaramba3D(Mesh=subdivide, Identifier=panel_61, CrossSection=cross_section_3, LimitDistance_m=0.005)  # -> Element, Points, Info; disabled
supp = SupportKaramba3D(PosInd=pshift_2, menu=[buttons(on, on, on, on, on, on)])  # disabled
loads_3 = LoadsKaramba3D(ForceVector=vec_2, Local=False, PosInd=old_support_location.ClosestPoint, LCase="0", mode="Point")  # disabled
assemble = AssembleModelKaramba3D(Elem=meshtoshell.Element, Support=supp, Load=loads_3, LimitDistance_m=0.005)  # -> Model, Info, Mass_kg, CenterOfGravity, LoadCaseNames; disabled
analyze = AnalyzeKaramba3D(Model=assemble.Model)  # -> CalculatedModel, MaximumDisplacement_cm, ResultingForceOfGravity_kN, ElasticEnergyChange_kNm; disabled
modelview = ModelViewKaramba3D(Model=analyze.CalculatedModel, ResultFactors=1, ResultCase=-1)  # -> Model, DeformedMesh, DeformedAxes, DeformedModel; disabled
shellview = ShellViewKaramba3D(Model=modelview.Model, IndexOfLayer=0)  # -> Model, MeshesOfRenderedShells, LegendColors, LegendTags; disabled
toggle_8 = GroupToggle(ToggleActive=True, ToggleVisible=False)  # disabled
# Karamba
legend_2 = Legend(Colour=flatten(shellview.LegendColors), Tags=flatten(shellview.LegendTags), LegendType=1)  # disabled

number_slider_20 = Slider(0.03, range=0..0.1)  # disabled
srfref = SurfaceRefinement(PDeg=3, QDeg=3, ElementRefU=5, ElementRefV=5, IsKnotApproxElementSize=False, IsKnotSubdivision=True)  # disabled
shell = ShellElement(Brep=loft, Material=mat_5, Thickness=number_slider_20, Refinement=srfref, HingeCoupling=False)  # -> flatten(ShellElement); disabled

toggle_9 = BooleanToggle(True)  # disabled
suppt_2 = SupportPoint(
    Point=[midpt_3, eval_5.Point],
    DispX=toggle_9,
    DispY=toggle_9,
    DispZ=toggle_9,
    Rotation=False,
    Torsion=False,
    TryStrongSupport=True)  # -> flatten(SupportPoint); disabled

vlen = VectorLength(Vector=vec_2)  # disabled
unit = UnitVector(Vector=vec_2)  # disabled
ptload = PointLoad(Point=old_support_location.ClosestPoint, Loadtype="DEAD", Direction=unit, Value=vlen, LoadCase=1)  # disabled

amodel_2 = AnalysisModel(
    Analysis=lina_2,
    StructuralElements=shell,
    Supports=suppt_2,
    Loads=ptload,
    IntersectionTolerance=0.01,
    IsCarat=True,
    IsKratos=False,
    PenaltyFac=10000000,
    ShowCouplingIDs=False,
    ShowEdgeIDs=False,
    ShowGeo=True,
    ShowPatchIDs=True,
    ShowPrePro=True,
    ShowRef=False,
    mUsedVersion="BETA 0.6.0")  # disabled
button_2 = Button()  # disabled
run_analysis_2 = IGASolver(AnalysisModel=amodel_2, Run=button_2, antiFreeze=False, showWindow=True)  # -> ResultModel, ErrorReport; disabled
list_13 = ValueList({"X Displacement": 1, "Y Displacement": 2, "Z Displacement": 3, "Displacement Length": 4, "P_N1": 5, "P_N2": 6, "N1": 7, "N2": 8, "N12": 9, "P_M1 (Shell)": 10, "P_M2 (Shell)": 11, "M1 (Shell)": 12, "M2 (Shell)": 13, "M12 (Shell)": 14, "von_Mises (Shell)": 15}, selected="von_Mises (Shell)")  # disabled
defmod_2 = DeformedModel(Model=run_analysis_2.ResultModel, ScaleFactor=1, FlyingNodeLimit=100000)  # -> Model, Geo, DeformedStructuralElements; disabled
_2drescolplot = _2DElementResultColourPlot(Model=defmod_2.Model, Type=list_13, VisMeshCoarse=True, VisMeshSmooth=False)  # -> Model, Mesh, ValueDomain, LegendC, LegendT; disabled
mesh_4 = Mesh(_2drescolplot.Mesh)  # disabled
legend_3 = Legend(Colour=_2drescolplot.LegendC, Tags=_2drescolplot.LegendT, LegendType=1)  # disabled
toggle_10 = GroupToggle(ToggleActive=True, ToggleVisible=False)  # disabled

# ---- group: Karamba (continued)
entwine_3 = Entwine(Branch00=linetobeam_2.Element, Branch01=linetobeam.Element, FlattenInputs=True)

direction = Slider(0, range=0..2)
mwind_2 = Relay()
pi_2 = Pi(Factor=direction)
X_2 = UnitX(Factor=1)
Z_4 = UnitZ(Factor=1)
facen_2 = FaceNormals(Mesh=mesh_2)  # -> Centers, Normals
nv = NakedVertices(Mesh=mesh_2)  # -> ClothedIndex, NakedIndex, ClothedPts, NakedPts
vrot_2 = Rotate(Vector=X_2, Axis=Z_4, Angle=pi_2)
devec_2 = DeconstructVector(Vector=unitize(facen_2.Normals))  # -> XComponent, YComponent, ZComponent
amp_3 = Amplitude(Vector=vrot_2, Amplitude=Slider(0.53, range=0..1))
pmesh_3 = PlanktonMesh(mesh_2)
mvarea_3 = MeshVertexArea(PlanktonMesh=pmesh_3)  # -> Vertices, VertexNormals
number_slider_21 = Slider(-1.9, range=-2..0)
pt_4 = Point(nv.NakedPts)
multiplication_7 = Multiplication(A=amp_3, B=Slider(0.5, range=0..1))
abs_4 = Absolute(Value=devec_2.ZComponent)
pdecon_3 = Deconstruct(Point=pt_4)  # -> XComponent, YComponent, ZComponent
mwind_3 = MeshWindLoad(Wind=multiplication_7, VertexNormals=mvarea_3.VertexNormals, Option=Toggle(True))
larger_2 = LargerThan(FirstNumber=pdecon_3.ZComponent, SecondNumber="0.05")  # -> LargerThan, OrEqualTo
cull_8 = CullPattern(List=pt_4, CullPattern=invert(larger_2.LargerThan))
multiplication_8 = Multiplication(A=mwind_3, B="0.001")
supp_2 = SupportKaramba3D(PosInd=cull_8, menu=[buttons(on, on, on, off, off, off)])  # -> flatten(Support)
multiplication_9 = Multiplication(A=multiplication_8, B=3)
vdisex = VectorDisplayEx(Point=mvarea_3.Vertices, Vector=multiplication_9, Colour=ColourSwatch(SwatchColor=RGB(8, 125, 138)), Width=2)

# ----
abs_5 = Absolute(Value=devec_2.XComponent)
abs_6 = Absolute(Value=devec_2.YComponent)
addition_2 = Addition(A=abs_5, B=abs_6)
multiplication_10 = Multiplication(A=number_slider_21, B=Slider(0.7, range=0..1))
Z_5 = UnitZ(Factor=multiplication_10)

# ---- group: Karamba (continued)
larger_3 = LargerThan(FirstNumber=abs_4, SecondNumber=addition_2)  # -> LargerThan, OrEqualTo
cullf_2 = CullFaces(Mesh=mesh_2, Pattern=invert(larger_3.LargerThan))
Z_6 = UnitZ(Factor=multiplication_10)  # -> expr("x *1.5", UnitVector)
loads_4 = LoadsKaramba3D(Vector=Z_5, Mesh=cullf_2, LCase="0", mode="MeshLoad -Const.", menu=[buttons(off, off, on), buttons(on, on)])  # -> flatten(Load)

# ---- group: Karamba / Loads (Karamba3D)
loads_5 = LoadsKaramba3D(ForceVector=multiplication_8, Local=False, PosInd=mvarea_3.Vertices, LCase="0", mode="Point")  # -> flatten(Load)

# ---- group: Karamba / Assemble Model (Karamba3D)
assemble_2 = AssembleModelKaramba3D(Elem=flatten(entwine_3), Support=flatten(supp_2), Load=flatten([loads, loads_4, loads_5]), LimitDistance_m=0.005)  # -> Model, Info, Mass_kg, CenterOfGravity, LoadCaseNames

# ---- group: Karamba (continued)
analyze_2 = AnalyzeKaramba3D(Model=assemble_2.Model)  # -> CalculatedModel, MaximumDisplacement_cm, ResultingForceOfGravity_kN, ElasticEnergyChange_kNm
num_2 = Number(flatten(assemble_2.Mass_kg))
panel_62 = Panel(num_2)
modelview_2 = ModelViewKaramba3D(Model=analyze_2.CalculatedModel, ResultFactors=1, ResultCase=-1)  # -> Model, DeformedMesh, DeformedAxes, DeformedModel
panel_63 = Panel(analyze_2.MaximumDisplacement_cm)

# ---- group: Karamba / Beam View (Karamba3D)
beamview = BeamViewKaramba3D(Model=modelview_2.Model)  # -> Model, MeshesOfRenderedBeams, DeformedBeamAxes, LegendColors, LegendTags

# ---- group: Karamba (continued)
legend_4 = Legend(Colour=beamview.LegendColors, Tags=beamview.LegendTags, LegendType=1)

# ----
mesh_5 = Mesh(beamview.MeshesOfRenderedBeams)

# ---- group: utilization dataviz pre
panel_64 = Panel("""0
-1""")  # disabled
cull_i_4 = CullIndex(List=beamview.LegendTags, Indices=panel_64, Wrap=True)  # disabled
panel_65 = Panel("%")  # disabled
split = TextSplit(Text=cull_i_4, Separators=panel_65)  # disabled
item_7 = ListItem(List=split, Index=0, Wrap=True)  # -> flatten(Item); disabled
bnd_2 = Bounds(Numbers=item_7)  # disabled
dam = DataDam(DataA=bnd_2, BufferDelay=10000000, BufferMode=0)  # disabled
panel_66 = Panel(bnd_2)  # disabled
rec = DataRecorder(dam, DataLimit=-10, RecordData=True)  # disabled

# ---- group: Text
panel_67 = Panel(analyze_2.MaximumDisplacement_cm)  # disabled
panel_68 = Panel(beamview.LegendTags)  # disabled
roundd = RoundToDecimalPlace(NumberX=panel_67, DecimalPlace=1, RoundType=0)  # -> Rounded, Difference; disabled
number_slider_22 = Slider(20, range=0..20)  # disabled
panel_69 = Panel("20")  # disabled
number_slider_23 = Slider(61, range=0..900)  # disabled
number_slider_24 = Slider(173, range=0..900)  # disabled
number_slider_25 = Slider(51, range=0..900)  # disabled
number_slider_26 = Slider(484, range=0..900)  # disabled
number_slider_27 = Slider(61, range=0..900)  # disabled
number_slider_28 = Slider(202, range=0..900)  # disabled
gradient = Gradient(
    LowerLimit=0,
    UpperLimit=panel_69,
    Parameter=panel_67,
    stops=[0: RGB(0, 128, 0), 0.5: RGB(255, 255, 0), 1: RGB(255, 0, 0)])  # disabled
panel_70 = Panel("Max displacement:")  # disabled
lng = ListLength(List=panel_68)  # disabled
panel_71 = Panel(" cm")  # disabled
number_slider_29 = Slider(20, range=0..100)  # disabled
series_2 = Series(Start=number_slider_26, Step=number_slider_22, Count=lng)  # disabled
concat = Concatenate(FragmentA=roundd.Rounded, FragmentB=panel_71)  # disabled
vec_3 = VectorXYZ(XComponent=number_slider_23, YComponent=number_slider_24, ZComponent=0)  # -> Vector, Length; disabled
vec_4 = VectorXYZ(XComponent=number_slider_25, YComponent=series_2, ZComponent=0)  # -> Vector, Length; disabled
vec_5 = VectorXYZ(XComponent=number_slider_27, YComponent=number_slider_28, ZComponent=0)  # -> Vector, Length; disabled
texttoscreen = RenderTextToScreen(Text=graft(panel_70), Location=graft(vec_3.Vector), Size=number_slider_29, Color=RGB(0, 0, 0), m_scWithvp=False)  # disabled
texttoscreen_2 = RenderTextToScreen(Text=graft(panel_68), Location=graft(vec_4.Vector), Size=12, Color=RGB(0, 0, 0), m_scWithvp=False)  # disabled
texttoscreen_3 = RenderTextToScreen(Text=graft(concat), Location=graft(vec_5.Vector), Size=number_slider_29, Color=gradient, m_scWithvp=False)  # disabled

# ---- group: Graph
entwine_4 = Entwine(Branch00=assemble_2.Mass_kg, Branch01=analyze_2.MaximumDisplacement_cm, FlattenInputs=True)  # disabled
number_slider_30 = Slider(6, range=0..10)  # disabled
panel_72 = Panel("1 to 4")  # disabled
panel_73 = Panel("""single layer
double layer (all)
alternate double layer (3 direction)
alternate double layer (1 direction)
double layer (only boudaries)
double layer (only 2)""")  # disabled
swatch_2 = ColourSwatch(SwatchColor=RGB(0, 0, 0))  # disabled
swatch_3 = ColourSwatch(SwatchColor=RGB(70, 176, 100))  # disabled
swatch_4 = ColourSwatch(SwatchColor=RGB(148, 122, 35))  # disabled
swatch_5 = ColourSwatch(SwatchColor=RGB(79, 146, 161))  # disabled
swatch_6 = ColourSwatch(SwatchColor=RGB(245, 76, 169))  # disabled
swatch_7 = ColourSwatch(SwatchColor=RGB(133, 91, 178))  # disabled
series_3 = Series(Start=0, Step=1, Count=7)  # disabled
random = Random(Range=panel_72, Number=number_slider_30, Seed=2)  # disabled
round = Round(Number=random)  # -> Nearest, Floor, Ceiling; disabled
point_data = PointData(Color=[swatch_2, swatch_3, swatch_4, swatch_5, swatch_6, swatch_7], Marker=round.Nearest)  # disabled
number_slider_31 = Slider(400, range=0..1000)  # disabled
panel_74 = Panel("Displacement (cm)")  # disabled
number_slider_32 = Slider(900, range=0..1000)  # disabled
bang_3 = ExplodeTree(Data=data)  # -> Branch0, Branch1; disabled
panel_75 = Panel("Mass (kg)")  # disabled
graph_data = GraphData(XValues=graft(bang_3.Branch0), YValues=graft(bang_3.Branch1), ValuesNames=panel_73, DataType=point_data)  # disabled
graph_legend = GraphLegend(Title="Legend", Position=9)  # disabled
panel_76 = Panel("Displacement VS Mass")  # disabled
graph_axis = GraphAxis(XAxisName=panel_75, YAxisName=panel_74)  # disabled
graph_sizes = GraphSizes(Width=number_slider_31, Height=number_slider_32)  # disabled
graph_elements = GraphElements(GraphData=graph_data, GraphLegend=graph_legend)  # disabled
graph_settings = GraphSettings(Title=panel_76, GraphSizes=graph_sizes, Color=RGB(255, 255, 255), GraphAxis=graph_axis)  # disabled
button_3 = Button()  # disabled
path_3 = FilePath("\\Mac\Home\Desktop\MPDA\s2\screenshot\")  # disabled
graph = Graph(ShowGraph=button_3, GraphElements=graph_elements, GraphSettings=graph_settings, Path=path_3)  # disabled
toggle_11 = GroupToggle(ToggleActive=True, ToggleVisible=False)  # disabled

# ----
panel_77 = Panel(entwine_4)  # disabled
dam_2 = DataDam(DataA=entwine_4, BufferDelay=10000000, BufferMode=0)  # disabled

# ---- group: Graph (continued)
rec_2 = DataRecorder(dam_2, DataLimit=-10, RecordData=True)  # disabled

# ---- group: utilization dataviz
data_2 = Data([Domain(-47.2, 36.5), Domain(-13.3, 10.5), Domain(-16.8, 14.7), Domain(-41.5, 31), Domain(-20.7, 18.3), Domain(-48.3, 37.7)])  # disabled
number_slider_33 = Slider(6, range=0..10)  # disabled
toggle_12 = GroupToggle(ToggleActive=True, ToggleVisible=False)  # disabled
number_slider_34 = Slider(6, range=0..10)  # disabled
rectangle = Rectangle(Plane=PlaneXY(0, 0, 0), XSize=data_2, YSize=Domain(-2, 2), Radius=0)  # -> Rectangle, Length; disabled
series_4 = Series(Start=0, Step=number_slider_33, Count=number_slider_34)  # disabled
number_slider_35 = Slider(2, range=0..10)  # disabled
number_slider_36 = Slider(2, range=0..10)  # disabled
Y = UnitY(Factor=series_4)  # disabled
move_2 = Move(Geometry=rectangle.Rectangle, Motion=Y)  # -> Geometry, Transform; disabled
number_slider_37 = Slider(34, range=0..100)  # disabled
panel_78 = Panel("-100")  # disabled
pt_5 = ConstructPoint(XCoordinate=expr("x+30", panel_78), YCoordinate=series_4, ZCoordinate=0)  # disabled
panel_79 = Panel("100")  # disabled
pt_6 = ConstructPoint(XCoordinate=expr("x-50", panel_79), YCoordinate=series_4, ZCoordinate=0)  # disabled
number_slider_38 = Slider(100, range=0..100)  # disabled
mesh_uv = MeshSurface(Surface=move_2.Geometry, UCount=number_slider_37, VCount=1, Overhang=True, Equalize=False)  # disabled
pt_7 = Point(Point(0, -30, 0))  # disabled
demesh_2 = DeconstructMesh(Mesh=mesh_uv)  # -> Vertices, Faces, Colours, Normals; disabled
pdecon_4 = Deconstruct(Point=demesh_2.Vertices)  # -> XComponent, YComponent, ZComponent; disabled
gradient_2 = Gradient(
    LowerLimit=panel_79,
    UpperLimit=panel_78,
    Parameter=pdecon_4.XComponent,
    stops=[0: RGB(234, 38, 0), 0.25: RGB(234, 126, 0), 0.5: RGB(255, 255, 255), 0.75: RGB(173, 203, 249), 1: RGB(75, 107, 169)])  # disabled
line_2 = LineSDL(Start=pt_7, Direction=Y, Length=number_slider_38)  # disabled
conmesh = ConstructMesh(Vertices=demesh_2.Vertices, Faces=demesh_2.Faces, Colours=gradient_2)  # disabled
text = Text(Location=pt_6, Text=data_2, Size=number_slider_35)  # disabled
text_2 = Text(Location=pt_5, Text=panel_73, Size=number_slider_36)  # disabled

# ----
panel_80 = Panel(rec_2)  # disabled
