# Grasshopper definition 2022_06_02_3waygeodesic_BeamDetails.gh (Grasshopper 1.0.7)
# plug-ins: Weaverbird, Kangaroo2 Components, Heteroptera, Human, Pufferfish

input = DataInput(
    Destination="E:\MPDA\Sem02\S2\GH Files\2022_06_01_3wayGeodesics_Formfinding_Data.ghdata",
    RelativePath="E:\MPDA\Sem02\S2\GH Files\2022_06_01_3wayGeodesics_Formfinding_Data.ghdata|2022_06_01_3wayGeodesics_Formfinding_Data.ghdata",
    UpdateDelay=50000)  # -> UntrimmedMesh, Surface, TrimmedMesh, MeshTrimmedLines, Thickness, Width

join = JoinCurves(Curves=input.MeshTrimmedLines, Preserve=False)  # disabled
bang = ExplodeTree(Data=input.MeshTrimmedLines)  # -> Branch0, Branch1, Branch2; disabled
number_slider = Slider(2, range=0..10)  # disabled
end = EndPoints(Curve=join)  # -> Start, End; disabled
crv = Curve(bang.Branch0)  # disabled
crv_2 = Curve(bang.Branch1)  # disabled
crv_3 = Curve(bang.Branch2)  # disabled
join_2 = JoinCurves(Curves=crv_3, Preserve=False)  # disabled
join_3 = JoinCurves(Curves=crv_2, Preserve=False)  # disabled
len = Length(Curve=join)  # disabled
len_2 = Length(Curve=join_2)  # disabled
len_3 = Length(Curve=join_3)  # disabled
explode = Explode(Curve=join, Recursive=True)  # -> Segments, Vertices; disabled
integer_division = IntegerDivision(A=len, B=number_slider)  # -> expr("x+1", Result); disabled
integer_division_2 = IntegerDivision(A=len_2, B=number_slider)  # -> expr("x+1", Result); disabled
integer_division_3 = IntegerDivision(A=len_3, B=number_slider)  # -> expr("x+1", Result); disabled
midpt = CurveMiddle(Curve=explode.Segments)  # disabled
divide = DivideCurve(Curve=join_2, Count=integer_division_2, Kinks=False)  # -> Points, Tangents, Parameters; disabled
divide_2 = DivideCurve(Curve=join_3, Count=integer_division_3, Kinks=False)  # -> Points, Tangents, Parameters; disabled
divide_3 = DivideCurve(Curve=join, Count=integer_division, Kinks=False)  # -> Points, Tangents, Parameters; disabled
cp = ClosestPoint(Point=divide_3.Points, Cloud=midpt)  # -> ClosestPoint, CPIndex, Distance; disabled
panel = Panel(divide_3.Points)  # disabled
panel_2 = Panel("""0
-1""")  # disabled
cull_i = CullIndex(List=cp.ClosestPoint, Indices=panel_2, Wrap=True)  # disabled
crv_cp = CurveClosestPoint(Point=cull_i, Curve=graft(join))  # -> Point, Parameter, Distance; disabled
graft = GraftTree(Tree=join, IncludeEmptyLists=True, IncludeNullItems=True)  # disabled
number_slider_2 = Slider(0.07, range=0..0.1)  # disabled
shatter = Shatter(Curve=graft, Parameters=crv_cp.Parameter)  # disabled
panel_3 = Panel(graft)  # disabled
panel_4 = Panel(crv_cp.Parameter)  # disabled
len_4 = Length(Curve=shatter)  # disabled
dots = DotDisplay(Point=[end.Start, end.End, crv_cp.Point], Colour=RGB(0, 0, 0), Size=number_slider_2)  # disabled
bnd = Bounds(Numbers=flatten(len_4))  # disabled
extremums = MinMax(Number=flatten(len_4))  # -> Minimum, Maximum; disabled
panel_5 = Panel(bnd)  # disabled
gradient = Gradient(
    LowerLimit=extremums.Minimum,
    UpperLimit=extremums.Maximum,
    Parameter=len_4,
    stops=[0: RGB(243, 57, 0), 0.1: RGB(236, 27, 60), 0.2: RGB(210, 0, 118), 0.3: RGB(103, 0, 120), 0.4: RGB(39, 72, 161), 0.5: RGB(1, 192, 229), 0.6: RGB(18, 178, 90), 0.7: RGB(79, 186, 8), 0.8: RGB(220, 237, 32), 0.9: RGB(247, 159, 20), 1: RGB(243, 57, 0)])  # disabled
index = ItemIndex(List=len_4, Item=extremums.Maximum)  # disabled
num = Number(flatten(len_4))  # disabled
panel_6 = Panel(len_4)  # disabled
bar_graph = BarGraph(num, BarColor=RGB(255, 0, 90))  # disabled
number_slider_3 = Slider(5, range=0..10)  # disabled
jitter = Jitter(List=gradient, Jitter=1, Seed=2)  # -> Values, Indices; disabled
previewlw = CustomPreviewLineweights(Geometry=shatter, Shader=jitter.Values, Thickness=number_slider_3, Absolute=False)  # disabled

# ---- group: area & entrance check
mesh = Mesh(input.UntrimmedMesh)
wbnaked = WeaverbirdsNakedBoundary(MeshClosedPolylines=mesh)
wbnaked_2 = WeaverbirdsNakedBoundary(MeshClosedPolylines=input.TrimmedMesh)
splitatcorners = SplitAtCorners(Poly=wbnaked, Angle=Slider(0.2, range=0..1))  # -> flatten(Corners), Parts
splitatcorners_2 = SplitAtCorners(Poly=wbnaked_2, Angle=Slider(0.5, range=0..1))  # -> flatten(Corners), Parts
demesh = DeconstructMesh(Mesh=mesh)  # -> Vertices, Faces, Colours, Normals
pdecon = Deconstruct(Point=flatten(splitatcorners.Corners))  # -> XComponent, YComponent, ZComponent
pdecon_2 = Deconstruct(Point=flatten(demesh.Vertices))  # -> XComponent, YComponent, ZComponent
project = Project(Geometry=input.TrimmedMesh, Plane=PlaneXY(0, 0, 0))  # -> Geometry, Transform
pdecon_3 = Deconstruct(Point=splitatcorners_2.Corners)  # -> XComponent, YComponent, ZComponent
extremums_2 = MinMax(Number=pdecon.ZComponent)  # -> Minimum, Maximum
extremums_3 = MinMax(Number=pdecon_2.ZComponent)  # -> Minimum, Maximum
extremums_4 = MinMax(Number=pdecon_3.ZComponent)  # -> Minimum, Maximum
area = Area(Geometry=project.Geometry)  # -> Area, Centroid
mesh_2 = Mesh(project.Geometry)
pavillion_area = Panel(area.Area)
full_mesh_entrance_height = Panel(extremums_2.Maximum)
top_height = Panel(extremums_3.Maximum)
entrance_height = Panel(extremums_4.Maximum)

# ----
join_4 = JoinCurves(Curves=input.MeshTrimmedLines, Preserve=False)
len_5 = Length(Curve=join_4)
explode_2 = Explode(Curve=join_4, Recursive=True)  # -> Segments, Vertices
intcrv = Interpolate(Vertices=explode_2.Vertices, Degree=3, Periodic=False, KnotStyle=1)  # -> Curve, Length, Domain
sort = SortList(Keys=len_5)  # -> Keys, ValuesA
pshift = ShiftPaths(Data=intcrv.Curve, Offset=-1)
panel_7 = Panel(sort.Keys)
crv_4 = Curve(reparameterize(pshift))
item = ListItem(List=join_4, Index=0, Wrap=True)  # -> flatten(Item)
number_slider_4 = Slider(19, range=0..100)
shift = ShiftList(List=item, Shift=1, Wrap=True)  # -> graft(List)
project_2 = Project(Geometry=shift, Plane=PlaneXY(0, 0, 0))  # -> Geometry, Transform
project_3 = Project(Geometry=crv_4, Plane=PlaneXY(0, 0, 0))  # -> Geometry, Transform
ext = ExtendCurve(Curve=project_2.Geometry, Type=0, Start=number_slider_4, End=number_slider_4)
ext_2 = ExtendCurve(Curve=project_3.Geometry, Type=0, Start=number_slider_4, End=number_slider_4)
ccx = CurveCurve(CurveA=ext_2, CurveB=ext)  # -> simplify(Points), ParamsA, ParamsB
pshift_2 = ShiftPaths(Data=ccx.Points, Offset=-1)  # -> simplify(Data)
alongcrv = SortAlongCurve(Points=pshift_2, Curve=ext)  # -> Points, Indices
item_2 = ListItem(List=crv_4, Index=alongcrv.Indices, Wrap=True)

bang_2 = ExplodeTree(Data=item_2)  # -> Branch0, Branch1, Branch2
crv_5 = Curve(bang_2.Branch0)
crv_6 = Curve(bang_2.Branch1)
crv_7 = Curve(bang_2.Branch2)

thickness = Number(input.Thickness)
width = Number(input.Width)

relay = Relay([crv_5, crv_6, crv_7])
patch = Patch(Curves=flatten(relay), Spans=Slider(40, range=0..100), Flexibility=Slider(1.47, range=0..2), Trim=True)
mesh_3 = Mesh(input.TrimmedMesh)

number_slider_5 = Slider(0.2, range=0..1.1)
panel_8 = Panel("""0
1""")
cull = CullPattern(List=crv_7, CullPattern=panel_8)
ext_3 = ExtendCurve(Curve=cull, Type=0, Start=number_slider_5, End=number_slider_5)
len_6 = Length(Curve=ext_3)
multiplication = Multiplication(A=len_6, B="3.5")
divide_4 = DivideCurve(Curve=ext_3, Count=multiplication, Kinks=False)  # -> Points, Tangents, Parameters
srf_cp = SurfaceClosestPoint(Point=divide_4.Points, Surface=reparameterize(patch))  # -> Point, UVPoint, flatten(Distance)
evalsrf = EvaluateSurface(Surface=reparameterize(patch), Point=srf_cp.UVPoint)  # -> Point, Normal, UDirection, VDirection, Frame
multiplication_2 = Multiplication(A=thickness, B="7")
amp = Amplitude(Vector=evalsrf.Normal, Amplitude=multiplication_2)
move = Move(Geometry=divide_4.Points, Motion=amp)  # -> Geometry, Transform
xprod = CrossProduct(VectorA=divide_4.Tangents, VectorB=evalsrf.Normal, Unitize=False)  # -> Vector, Length
pl = ConstructPlane(Origin=simplify(move.Geometry), XAxis=evalsrf.Normal, YAxis=xprod.Vector)

item_3 = ListItem(List=crv_5, Index=["5", "13"], Wrap=True)
len_7 = Length(Curve=item_3)
multiplication_3 = Multiplication(A=len_7, B="3.5")
divide_5 = DivideCurve(Curve=item_3, Count=multiplication_3, Kinks=False)  # -> Points, Tangents, Parameters
srf_cp_2 = SurfaceClosestPoint(Point=divide_5.Points, Surface=reparameterize(patch))  # -> Point, UVPoint, flatten(Distance)
evalsrf_2 = EvaluateSurface(Surface=reparameterize(patch), Point=srf_cp_2.UVPoint)  # -> Point, Normal, UDirection, VDirection, Frame
multiplication_4 = Multiplication(A=thickness, B="2")
amp_2 = Amplitude(Vector=evalsrf_2.Normal, Amplitude=multiplication_4)
move_2 = Move(Geometry=divide_5.Points, Motion=amp_2)  # -> Geometry, Transform
xprod_2 = CrossProduct(VectorA=divide_5.Tangents, VectorB=evalsrf_2.Normal, Unitize=False)  # -> Vector, Length
pl_2 = ConstructPlane(Origin=simplify(move_2.Geometry), XAxis=evalsrf_2.Normal, YAxis=xprod_2.Vector)

item_4 = ListItem(List=crv_6, Index=["5", "13"], Wrap=True)
len_8 = Length(Curve=item_4)
multiplication_5 = Multiplication(A=len_8, B="3.5")
divide_6 = DivideCurve(Curve=item_4, Count=multiplication_5, Kinks=False)  # -> Points, Tangents, Parameters
srf_cp_3 = SurfaceClosestPoint(Point=divide_6.Points, Surface=reparameterize(patch))  # -> Point, UVPoint, flatten(Distance)
evalsrf_3 = EvaluateSurface(Surface=reparameterize(patch), Point=srf_cp_3.UVPoint)  # -> Point, Normal, UDirection, VDirection, Frame
multiplication_6 = Multiplication(A=thickness, B="4")
amp_3 = Amplitude(Vector=evalsrf_3.Normal, Amplitude=multiplication_6)
move_3 = Move(Geometry=divide_6.Points, Motion=amp_3)  # -> Geometry, Transform
xprod_3 = CrossProduct(VectorA=divide_6.Tangents, VectorB=evalsrf_3.Normal, Unitize=False)  # -> Vector, Length
pl_3 = ConstructPlane(Origin=simplify(move_3.Geometry), XAxis=evalsrf_3.Normal, YAxis=xprod_3.Vector)

item_5 = ListItem(List=crv_7, Index=["3", "15"], Wrap=True)
len_9 = Length(Curve=item_5)
multiplication_7 = Multiplication(A=len_9, B="3.5")
divide_7 = DivideCurve(Curve=item_5, Count=multiplication_7, Kinks=False)  # -> Points, Tangents, Parameters
srf_cp_4 = SurfaceClosestPoint(Point=divide_7.Points, Surface=reparameterize(patch))  # -> Point, UVPoint, flatten(Distance)
evalsrf_4 = EvaluateSurface(Surface=reparameterize(patch), Point=srf_cp_4.UVPoint)  # -> Point, Normal, UDirection, VDirection, Frame
multiplication_8 = Multiplication(A=thickness, B="6")
amp_4 = Amplitude(Vector=evalsrf_4.Normal, Amplitude=multiplication_8)
move_4 = Move(Geometry=divide_7.Points, Motion=amp_4)  # -> Geometry, Transform
xprod_4 = CrossProduct(VectorA=divide_7.Tangents, VectorB=evalsrf_4.Normal, Unitize=False)  # -> Vector, Length
pl_4 = ConstructPlane(Origin=simplify(move_4.Geometry), XAxis=evalsrf_4.Normal, YAxis=xprod_4.Vector)

len_10 = Length(Curve=crv_5)
multiplication_9 = Multiplication(A=len_10, B="3.5")
divide_8 = DivideCurve(Curve=crv_5, Count=multiplication_9, Kinks=False)  # -> Points, Tangents, Parameters
srf_cp_5 = SurfaceClosestPoint(Point=divide_8.Points, Surface=reparameterize(patch))  # -> Point, UVPoint, flatten(Distance)
neg = Negative(Value="4")
evalsrf_5 = EvaluateSurface(Surface=reparameterize(patch), Point=srf_cp_5.UVPoint)  # -> Point, Normal, UDirection, VDirection, Frame
multiplication_10 = Multiplication(A=thickness, B=neg)
amp_5 = Amplitude(Vector=evalsrf_5.Normal, Amplitude=multiplication_10)
move_5 = Move(Geometry=divide_8.Points, Motion=amp_5)  # -> Geometry, Transform
xprod_5 = CrossProduct(VectorA=divide_8.Tangents, VectorB=evalsrf_5.Normal, Unitize=False)  # -> Vector, Length
pl_5 = ConstructPlane(Origin=simplify(move_5.Geometry), XAxis=evalsrf_5.Normal, YAxis=xprod_5.Vector)

len_11 = Length(Curve=crv_6)
multiplication_11 = Multiplication(A=len_11, B="3.5")
divide_9 = DivideCurve(Curve=crv_6, Count=multiplication_11, Kinks=False)  # -> Points, Tangents, Parameters
srf_cp_6 = SurfaceClosestPoint(Point=divide_9.Points, Surface=reparameterize(patch))  # -> Point, UVPoint, flatten(Distance)
neg_2 = Negative(Value="2")
evalsrf_6 = EvaluateSurface(Surface=reparameterize(patch), Point=srf_cp_6.UVPoint)  # -> Point, Normal, UDirection, VDirection, Frame
multiplication_12 = Multiplication(A=thickness, B=neg_2)
amp_6 = Amplitude(Vector=evalsrf_6.Normal, Amplitude=multiplication_12)
move_6 = Move(Geometry=divide_9.Points, Motion=amp_6)  # -> Geometry, Transform
xprod_6 = CrossProduct(VectorA=divide_9.Tangents, VectorB=evalsrf_6.Normal, Unitize=False)  # -> Vector, Length
pl_6 = ConstructPlane(Origin=simplify(move_6.Geometry), XAxis=evalsrf_6.Normal, YAxis=xprod_6.Vector)

len_12 = Length(Curve=crv_7)
multiplication_13 = Multiplication(A=len_12, B="3.5")
divide_10 = DivideCurve(Curve=crv_7, Count=multiplication_13, Kinks=False)  # -> Points, Tangents, Parameters
srf_cp_7 = SurfaceClosestPoint(Point=divide_10.Points, Surface=reparameterize(patch))  # -> Point, UVPoint, flatten(Distance)
neg_3 = Negative(Value="1")
evalsrf_7 = EvaluateSurface(Surface=reparameterize(patch), Point=srf_cp_7.UVPoint)  # -> Point, Normal, UDirection, VDirection, Frame
multiplication_14 = Multiplication(A=thickness, B="1")
amp_7 = Amplitude(Vector=evalsrf_7.Normal, Amplitude=multiplication_14)
move_7 = Move(Geometry=divide_10.Points, Motion=amp_7)  # -> Geometry, Transform
xprod_7 = CrossProduct(VectorA=divide_10.Tangents, VectorB=evalsrf_7.Normal, Unitize=False)  # -> Vector, Length
pl_7 = ConstructPlane(Origin=simplify(move_7.Geometry), XAxis=evalsrf_7.Normal, YAxis=xprod_7.Vector)

symdom = SymmetricalDomain(Length=Slider(0.008, range=0..0.1), Base=0)
symdom_2 = SymmetricalDomain(Length=Slider(0.05, range=0..0.1), Base=0)
rectangle = Rectangle(Plane=pl, XSize=symdom, YSize=symdom_2, Radius=0)  # -> Rectangle, Length
loft = Loft(
    Curves=rectangle.Rectangle,
    Options={Adjust=False, Closed=False, LoftEnds=0, LoftSimp=0, LoftType=0, Rebuild=10, Refit=0.01})

symdom_3 = SymmetricalDomain(Length=thickness, Base=0)
symdom_4 = SymmetricalDomain(Length=width, Base=0)
rectangle_2 = Rectangle(Plane=pl_5, XSize=symdom_3, YSize=symdom_4, Radius=0)  # -> Rectangle, Length
rectangle_3 = Rectangle(Plane=pl_6, XSize=symdom_3, YSize=symdom_4, Radius=0)  # -> Rectangle, Length
rectangle_4 = Rectangle(Plane=pl_7, XSize=symdom_3, YSize=symdom_4, Radius=0)  # -> Rectangle, Length
rectangle_5 = Rectangle(Plane=pl_2, XSize=symdom_3, YSize=symdom_4, Radius=0)  # -> Rectangle, Length
rectangle_6 = Rectangle(Plane=pl_3, XSize=symdom_3, YSize=symdom_4, Radius=0)  # -> Rectangle, Length
rectangle_7 = Rectangle(Plane=pl_4, XSize=symdom_3, YSize=symdom_4, Radius=0)  # -> Rectangle, Length
loft_2 = Loft(
    Curves=rectangle_2.Rectangle,
    Options={Adjust=False, Closed=False, LoftEnds=0, LoftSimp=0, LoftType=0, Rebuild=10, Refit=0.01})
loft_3 = Loft(
    Curves=rectangle_3.Rectangle,
    Options={Adjust=False, Closed=False, LoftEnds=0, LoftSimp=0, LoftType=0, Rebuild=10, Refit=0.01})
loft_4 = Loft(
    Curves=rectangle_4.Rectangle,
    Options={Adjust=False, Closed=False, LoftEnds=0, LoftSimp=0, LoftType=0, Rebuild=10, Refit=0.01})
loft_5 = Loft(
    Curves=rectangle_5.Rectangle,
    Options={Adjust=False, Closed=False, LoftEnds=0, LoftSimp=0, LoftType=0, Rebuild=10, Refit=0.01})
loft_6 = Loft(
    Curves=rectangle_6.Rectangle,
    Options={Adjust=False, Closed=False, LoftEnds=0, LoftSimp=0, LoftType=0, Rebuild=10, Refit=0.01})
loft_7 = Loft(
    Curves=rectangle_7.Rectangle,
    Options={Adjust=False, Closed=False, LoftEnds=0, LoftSimp=0, LoftType=0, Rebuild=10, Refit=0.01})
swatch = ColourSwatch(SwatchColor=RGB(224, 184, 141))
swatch_2 = ColourSwatch(SwatchColor=RGB(227, 204, 154))
swatch_3 = ColourSwatch(SwatchColor=RGB(227, 165, 136))
entwine = Entwine(
    Branch00=loft_2,
    Branch01=loft_3,
    Branch02=loft_4,
    Branch03=loft_5,
    Branch04=loft_6,
    Branch05=loft_7,
    Branch06=loft,
    FlattenInputs=True)
entwine_2 = Entwine(
    Branch00=swatch,
    Branch01=swatch_2,
    Branch02=swatch_3,
    Branch03=swatch,
    Branch04=swatch_2,
    Branch05=swatch_3,
    Branch06=ColourSwatch(SwatchColor=RGB(135, 93, 73)),
    FlattenInputs=True)
preview = CustomPreview(Geometry=entwine, Material=entwine_2)
Y = UnitY(Factor=1)
intcrv_2 = Interpolate(Vertices=move_5.Geometry, Degree=3, Periodic=False, KnotStyle=1)  # -> Curve, Length, Domain
intcrv_3 = Interpolate(Vertices=move_6.Geometry, Degree=3, Periodic=False, KnotStyle=1)  # -> Curve, Length, Domain
intcrv_4 = Interpolate(Vertices=move_7.Geometry, Degree=3, Periodic=False, KnotStyle=1)  # -> Curve, Length, Domain
intcrv_5 = Interpolate(Vertices=move_2.Geometry, Degree=3, Periodic=False, KnotStyle=1)  # -> Curve, Length, Domain
intcrv_6 = Interpolate(Vertices=move_3.Geometry, Degree=3, Periodic=False, KnotStyle=1)  # -> Curve, Length, Domain
intcrv_7 = Interpolate(Vertices=move_4.Geometry, Degree=3, Periodic=False, KnotStyle=1)  # -> Curve, Length, Domain
entwine_3 = Entwine(Branch00=intcrv_2.Curve, Branch01=intcrv_3.Curve, Branch02=intcrv_4.Curve, FlattenInputs=True)
entwine_4 = Entwine(Branch00=intcrv_5.Curve, Branch01=intcrv_6.Curve, Branch02=intcrv_7.Curve, FlattenInputs=True)

# ---- group: Unrolling Layer 02
crv_8 = Curve(item_3)
crv_9 = Curve(item_5)
crv_10 = Curve(item_4)
ccx_2 = CurveCurve(CurveA=graft(crv_8), CurveB=crv_6)  # -> Points, ParamsA, ParamsB
ccx_3 = CurveCurve(CurveA=graft(crv_10), CurveB=crv_7)  # -> Points, ParamsA, ParamsB
ccx_4 = CurveCurve(CurveA=graft(crv_9), CurveB=crv_5)  # -> Points, ParamsA, ParamsB
pshift_3 = ShiftPaths(Data=ccx_2.ParamsA, Offset=-1)
pshift_4 = ShiftPaths(Data=ccx_3.ParamsA, Offset=-1)
pshift_5 = ShiftPaths(Data=ccx_4.ParamsA, Offset=-1)
abs = Absolute(Value=pshift_3)
abs_2 = Absolute(Value=pshift_4)
abs_3 = Absolute(Value=pshift_5)
merge = Merge(Data1=abs, Data2=abs_2, Data3=abs_3)  # -> simplify(Result)

# ---- group: Unrolling Layer 01
fama = Curve(crv_5)
famb = Curve(crv_6)
famc = Curve(crv_7)
ccx_5 = CurveCurve(CurveA=graft(fama), CurveB=famb)  # -> Points, ParamsA, ParamsB
ccx_6 = CurveCurve(CurveA=graft(famb), CurveB=famc)  # -> Points, ParamsA, ParamsB
ccx_7 = CurveCurve(CurveA=graft(famc), CurveB=fama)  # -> Points, ParamsA, ParamsB
pshift_6 = ShiftPaths(Data=ccx_5.ParamsA, Offset=-1)
pshift_7 = ShiftPaths(Data=ccx_6.ParamsA, Offset=-1)
pshift_8 = ShiftPaths(Data=ccx_7.ParamsA, Offset=-1)
abs_4 = Absolute(Value=pshift_6)
abs_5 = Absolute(Value=pshift_7)
abs_6 = Absolute(Value=pshift_8)
merge_2 = Merge(Data1=abs_4, Data2=abs_5, Data3=abs_6)  # -> simplify(Result)

len_13 = Length(Curve=item_2)
tstat = TreeStatistics(Tree=len_13)  # -> Paths, Length, Count
series = Series(Start=0, Step=Slider(0.18, range=0..1), Count=tstat.Length)
series_2 = Series(Start=0, Step=Slider(13, range=0..100), Count=tstat.Count)
pt = ConstructPoint(XCoordinate=series, YCoordinate=graft(series_2), ZCoordinate=0)

# ---- group: Unrolling Layer 03
crv_11 = Curve(cull)
crv_12 = Curve(crv_6)
ccx_8 = CurveCurve(CurveA=graft(crv_11), CurveB=crv_12)  # -> Points, ParamsA, ParamsB
pshift_9 = ShiftPaths(Data=ccx_8.ParamsA, Offset=-1)

# ---- group: Unrolling Layer 01 / crvsIntersection
entwine_5 = Entwine(Branch00=flatten(ccx_5.Points), Branch01=flatten(ccx_6.Points), Branch02=flatten(ccx_7.Points), FlattenInputs=True)

# ----
number_slider_6 = Slider(2.5, range=0..10)

# ---- group: Unrolling Layer 03
debrep = DeconstructBrep(Brep=loft)  # -> Faces, Edges, Vertices
item_6 = ListItem(List=debrep.Faces, Index=Slider(2, range=0..3), Wrap=True)
md_slider = MDSlider(SliderMode=0, slider_value=Point(0.5, 0.5, 0.5), x_domain=Domain(0, 1), y_domain=Domain(0, 1), z_domain=Domain(0, 1))
iso = IsoCurve(Surface=reparameterize(item_6), UVPoint=md_slider)  # -> UIsocurve, VIsocurve
len_14 = Length(Curve=iso.UIsocurve)
number_slider_7 = Slider(0.06, range=0..1)

tstat_2 = TreeStatistics(Tree=len_14)  # -> Paths, Length, Count
series_3 = Series(Start=Slider(0, range=0..10), Step=Slider(0, range=0..1), Count=tstat_2.Length)
series_4 = Series(Start=Slider(4.8, range=0..20), Step=Slider(0.2, range=0..20), Count=tstat_2.Count)
pt_2 = ConstructPoint(XCoordinate=series_4, YCoordinate=flatten(series_3), ZCoordinate=0)

line = LineSDL(Start=graft(pt_2), Direction=Y, Length=len_14)  # -> simplify(graft(Line))
ext_4 = ExtendCurve(Curve=line, Type="2", Start=number_slider_7, End=number_slider_7)
shatter_2 = Shatter(Curve=reparameterize(ext_4), Parameters=pshift_9)  # -> simplify(Segments)
eval = EvaluateCurve(Curve=line, Parameter=pshift_9)  # -> Point, Tangent, Angle
end_2 = EndPoints(Curve=shatter_2)  # -> Start, End

# ----
pt_3 = Point(eval.Point)
crv_13 = Curve(ext_4)

crv_14 = Curve(crv_13)
divlength = DivideLength(Curve=crv_14, Length=number_slider_6)  # -> Points, Tangents, Parameters
shatter_3 = Shatter(Curve=crv_14, Parameters=divlength.Parameters)
end_3 = EndPoints(Curve=simplify(shatter_3))  # -> Start, End

# ---- group: Unrolling Layer 02
entwine_6 = Entwine(Branch00=loft_5, Branch01=loft_6, Branch02=loft_7, FlattenInputs=True)
debrep_2 = DeconstructBrep(Brep=entwine_6)  # -> Faces, Edges, Vertices
item_7 = ListItem(List=debrep_2.Faces, Index=Slider(2, range=0..3), Wrap=True)
md_slider_2 = MDSlider(SliderMode=0, slider_value=Point(0.5, 0.5, 0.5), x_domain=Domain(0, 1), y_domain=Domain(0, 1), z_domain=Domain(0, 1))
iso_2 = IsoCurve(Surface=reparameterize(item_7), UVPoint=md_slider_2)  # -> UIsocurve, VIsocurve
pshift_10 = ShiftPaths(Data=simplify(iso_2.UIsocurve), Offset=-1)
len_15 = Length(Curve=pshift_10)
number_slider_8 = Slider(0.06, range=0..1)

tstat_3 = TreeStatistics(Tree=len_15)  # -> Paths, Length, Count
series_5 = Series(Start=Slider(4, range=0..10), Step=Slider(0.18, range=0..1), Count=tstat_3.Length)
series_6 = Series(Start=0, Step=Slider(13, range=0..100), Count=tstat_3.Count)
pt_4 = ConstructPoint(XCoordinate=series_5, YCoordinate=graft(series_6), ZCoordinate=0)

line_2 = LineSDL(Start=pt_4, Direction=Y, Length=len_15)  # -> simplify(graft(Line))
ext_5 = ExtendCurve(Curve=line_2, Type="2", Start=number_slider_8, End=number_slider_8)
eval_2 = EvaluateCurve(Curve=line_2, Parameter=merge)  # -> Point, Tangent, Angle
shatter_4 = Shatter(Curve=ext_5, Parameters=merge)
end_4 = EndPoints(Curve=shatter_4)  # -> Start, End

# ----
cull_i_2 = CullIndex(List=end_4.Start, Indices="0", Wrap=True)
pt_5 = Point(cull_i_2)
crv_15 = Curve(ext_5)

crv_16 = Curve(crv_15)
divlength_2 = DivideLength(Curve=crv_16, Length=number_slider_6)  # -> Points, Tangents, Parameters
shatter_5 = Shatter(Curve=crv_16, Parameters=divlength_2.Parameters)
end_5 = EndPoints(Curve=simplify(shatter_5))  # -> Start, End

# ---- group: Unrolling Layer 01
entwine_7 = Entwine(Branch00=loft_2, Branch01=loft_3, Branch02=loft_4, FlattenInputs=True)
debrep_3 = DeconstructBrep(Brep=entwine_7)  # -> Faces, Edges, Vertices
item_8 = ListItem(List=debrep_3.Faces, Index=0, Wrap=True)
md_slider_3 = MDSlider(SliderMode=0, slider_value=Point(0.5, 0.5, 0.5), x_domain=Domain(0, 1), y_domain=Domain(0, 1), z_domain=Domain(0, 1))
iso_3 = IsoCurve(Surface=reparameterize(item_8), UVPoint=md_slider_3)  # -> UIsocurve, VIsocurve
pshift_11 = ShiftPaths(Data=simplify(iso_3.UIsocurve), Offset=-1)
crv_cp_2 = CurveClosestPoint(Point=entwine_5, Curve=graft(pshift_11))  # -> Point, Parameter, Distance
len_16 = Length(Curve=pshift_11)
smaller = SmallerThan(FirstNumber=crv_cp_2.Distance, SecondNumber=Slider(0.09, range=0..1))  # -> SmallerThan, OrEqualTo
cull_2 = CullPattern(List=crv_cp_2.Parameter, CullPattern=smaller.SmallerThan)
eval_3 = EvaluateCurve(Curve=graft(pshift_11), Parameter=cull_2)  # -> Point, Tangent, Angle
line_3 = LineSDL(Start=pt, Direction=Y, Length=len_16)  # -> simplify(graft(Line))
dot = DotDisplay(Point=eval_3.Point)
eval_4 = EvaluateCurve(Curve=line_3, Parameter=merge_2)  # -> graft(Point), Tangent, Angle

number_slider_9 = Slider(0.06, range=0..1)
ext_6 = ExtendCurve(Curve=line_3, Type="2", Start=number_slider_9, End=number_slider_9)

shatter_6 = Shatter(Curve=ext_6, Parameters=merge_2)
end_6 = EndPoints(Curve=shatter_6)  # -> Start, End

# ----
cull_i_3 = CullIndex(List=end_6.Start, Indices="0", Wrap=True)
pt_6 = Point(cull_i_3)
crv_17 = Curve(ext_6)

crv_18 = Curve(crv_17)
len_17 = Length(Curve=crv_18)
equalst = EqualityWithinTolerance(FirstNumber=len_17, SecondNumber=Slider(2.6, range=0..10), Tolerance=Slider(1, range=0..1))  # -> Equality, Inequality
dispatch = Dispatch(List=crv_18, DispatchPattern=equalst.Equality)  # -> ListA, ListB
divlength_3 = DivideLength(Curve=dispatch.ListB, Length=number_slider_6)  # -> Points, Tangents, Parameters
divide_11 = DivideCurve(Curve=dispatch.ListA, Count="2", Kinks=False)  # -> Points, Tangents, Parameters
shatter_7 = Shatter(Curve=dispatch.ListB, Parameters=divlength_3.Parameters)
shatter_8 = Shatter(Curve=dispatch.ListA, Parameters=divide_11.Parameters)
end_7 = EndPoints(Curve=simplify(shatter_7))  # -> Start, End
end_8 = EndPoints(Curve=simplify(shatter_8))  # -> Start, End

entwine_8 = Entwine(Branch00=shatter_7, Branch01=shatter_8, FlattenInputs=True)
offcrv = OffsetCurve(
    Curve=[entwine_8, shatter_5, shatter_3],
    Plane=PlaneXY(0, 0, 0),
    Distance=Slider(0.13, range=0..1),
    BothSides=0,
    Kinks=0,
    CapType=1)
clean = CleanTree(RemoveNulls=True, RemoveInvalid=True, RemoveEmpty=invert(simplify(False)), Tree=offcrv)
explode_3 = Explode(Curve=clean, Recursive=True)  # -> Segments, Vertices
pline = PolyLine(Vertices=explode_3.Vertices, Closed=False)
