# Grasshopper definition 2022_06_02_3waygeodesic_FormFinding.gh (Grasshopper 1.0.7)
# plug-ins: NGon, Weaverbird, Kangaroo2 Components, Human, MeshEdit Components, MetaHopper, Pufferfish, Heteroptera

# ---- group: Base Form
polygon = Polygon(Plane=PlaneXY(0, 0, 0), Radius=Slider(9, range=0..10), Segments=6, FilletRadius=0)  # -> Polygon, Length
fromp = FromPolylines(Curves=polygon.Polygon, Min_Triangulation=True)
number_slider = Slider(11, range=0..14)
clear = Clear(Mesh=fromp)
wbtriangles = WeaverbirdsSplitTrianglesSubdivision(MeshCurves=clear, Level=number_slider)
wbedges = WeaverbirdsMeshEdges(MeshOrPolylines=wbtriangles)

explode = Explode(Curve=polygon.Polygon, Recursive=True)  # -> Segments, Vertices
reparamcrv = ReparameterizeCurve(Curve=explode.Segments)  # -> Reparameterized, Original
division = Division(A=Slider(8, range=0..11), B=number_slider)
dispatch = Dispatch(List=reparamcrv.Reparameterized, DispatchPattern=[True, False])  # -> ListA, ListB
eval = EvaluateCurve(Curve=dispatch.ListA, Parameter=division)  # -> Point, Tangent, Angle
subtraction = Subtraction(A="1", B=division)
eval_2 = EvaluateCurve(Curve=dispatch.ListB, Parameter=subtraction)  # -> Point, Tangent, Angle
weave = Weave(Pattern=[0, 1], Stream0=eval.Point, Stream1=eval_2.Point, NullGaps=False)
pline = PolyLine(Vertices=weave, Closed=True)

Z = UnitZ(Factor=1)
multiplication = Multiplication(A=Z, B=2)
extr = Extrude(Base=pline, Direction=multiplication)
cap = CapHoles(Brep=extr)
trim = TrimWithBrep(Curve=wbedges, Brep=cap)  # -> Inside, Outside
crv = Curve(flatten(trim.Inside))
end = EndPoints(Curve=crv)  # -> Start, End
duppt = RemoveDuplicatePts(Points=[end.Start, end.End], Tolerance=0.01)
del = DelaunayMesh(Points=duppt, Plane=PlaneXY(0, 0, 0))

# ----
mesh = Mesh(del)
area = MeshArea(Mesh=mesh)  # -> Area, Centroid

# ---- group: FormFinding 01
X = UnitX(Factor=1)
neg = Negative(Value=X)
line = LineSDL(Start=area.Centroid, Direction=[X, neg], Length=Slider(7, range=0..10))
join = JoinCurves(Curves=line, Preserve=False)
demesh = DeconstructMesh(Mesh=mesh)  # -> Vertices, Faces, Colours, Normals
offset = PolylineOffset(Curve=join, Distance=Slider(0.08, range=0..0.1), Divisions=0)  # -> C, H
incurve = PointInCurve(Point=demesh.Vertices, Curve=offset.C)  # -> Relationship, Point
equals = Equality(FirstNumber=incurve.Relationship, SecondNumber=2)  # -> Equality, Inequality
cull = CullPattern(List=demesh.Vertices, CullPattern=equals.Equality)

nv = NakedVertices(Mesh=mesh)  # -> ClothedIndex, NakedIndex, ClothedPts, NakedPts
geodésicas_imposición_angulos_opuestos_i = Slider(0.666, range=0..15)  # "Geodésicas: imposición angulos opuestos iguales"
vn = VertexNeighbours(Mesh=mesh, VertexNumber=nv.ClothedIndex)  # -> Vertex, Neighbours, Normal
ln = Line(StartPoint=simplify(graft(vn.Vertex)), EndPoint=simplify(vn.Neighbours))
item = ListItem(List=ln, Index=0, Wrap=True)  # -> Item, Item1, Item2, Item3, Item4, Item5
_10º = PowerOf10(Value=geodésicas_imposición_angulos_opuestos_i)
ea = EqualAngle(LineA=[item.Item, item.Item3], LineB=[item.Item1, item.Item4], Strength=_10º)  # disabled
ea_2 = EqualAngle(LineA=[item.Item1, item.Item4], LineB=[item.Item2, item.Item5], Strength=_10º)  # disabled
ea_3 = EqualAngle(LineA=[item.Item2, item.Item5], LineB=[item.Item3, item.Item], Strength=_10º)  # disabled

merge = Merge(Data1=Slider(4.5, range=1..10), Data2=Slider(4.5, range=1..10), Data3=Slider(7.9, range=1..10))

# ---- group: FormFinding 01 / 3 way direction uncut
medges = MeshEdges(Mesh=mesh)  # -> NakedEdges, InteriorEdges, NonManifoldEdges
X_2 = UnitX(Factor=1)
angle = Angle(VectorA=medges.InteriorEdges, VectorB=X_2)  # -> Angle, Reflex
pi = Pi(Factor=0.5)
subtraction_2 = Subtraction(A=angle.Angle, B=pi)
pi_2 = Pi(Factor=Slider(0.19, range=0..2))
abs = Absolute(Value=subtraction_2)
smaller = SmallerThan(FirstNumber=abs, SecondNumber=pi_2)  # -> SmallerThan, OrEqualTo
dispatch_2 = Dispatch(List=medges.InteriorEdges, DispatchPattern=smaller.SmallerThan)  # -> ListA, ListB
pt = Point(Point(1.5, 1, 0))
geo = Geometry(dispatch_2.ListA)
vec = Vector(pt)
angle_2 = Angle(VectorA=geo, VectorB=vec)  # -> Angle, Reflex
pi_3 = Pi(Factor=0.5)
subtraction_3 = Subtraction(A=angle_2.Angle, B=pi_3)
pi_4 = Pi(Factor=Slider(0.2, range=0..2))
abs_2 = Absolute(Value=subtraction_3)
larger = LargerThan(FirstNumber=abs_2, SecondNumber=pi_4)  # -> LargerThan, OrEqualTo
dispatch_3 = Dispatch(List=geo, DispatchPattern=larger.LargerThan)  # -> ListA, ListB
line_2 = Line(dispatch_3.ListA)
line_3 = Line(dispatch_3.ListB)
line_4 = Line(dispatch_2.ListB)
entwine = Entwine(Branch00=line_2, Branch01=line_3, Branch02=line_4, FlattenInputs=True)

# ----
height = Slider(0.015, range=0..0.03)
width = Slider(0.13, range=0..0.2)

# ---- group: FormFinding 01 / int_pure mesh
wbnaked = WeaverbirdsNakedBoundary(MeshClosedPolylines=mesh)
demesh_2 = DeconstructMesh(Mesh=mesh)  # -> Vertices, Faces, Colours, Normals

# ---- group: FormFinding 01
splitatcorners = SplitAtCorners(Poly=wbnaked, Angle=1)  # -> Corners, Parts
item_2 = ListItem(List=splitatcorners.Corners, Index=Slider(5, range=0..5), Wrap=True)
seam2crvcorn = SeamToCurveCorner(Curve=wbnaked, Guide=item_2)  # -> Adjusted, Point, R
crv_2 = Curve([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])

# ---- group: FormFinding 01 / int_pure mesh (continued)
splitatcorners_2 = SplitAtCorners(Poly=seam2crvcorn.Adjusted, Angle=1)  # -> Corners, Parts
dispatch_4 = Dispatch(List=splitatcorners_2.Parts, DispatchPattern=[True, False])  # -> ListA, ListB
crv_3 = Curve(dispatch_4.ListB)
midpt = CurveMiddle(Curve=crv_3)
vec2pt = Vector2Pt(PointA=area.Centroid, PointB=midpt, Unitize=False)  # -> Vector, Length
amp = Amplitude(Vector=vec2pt.Vector, Amplitude=Slider(10, range=0.5..10))
move = Move(Geometry=area.Centroid, Motion=amp)  # -> Geometry, Transform
polygon_2 = Polygon(Plane=move.Geometry, Radius=merge, Segments=6, FilletRadius=0)  # -> Polygon, Length
incurves = PointInCurves(Point=demesh_2.Vertices, Curves=polygon_2.Polygon)  # -> Relationship, Index, Point
equals_2 = Equality(FirstNumber=incurves.Relationship, SecondNumber=2)  # -> Equality, Inequality
cullv = CullVertices(Mesh=mesh, Pattern=equals_2.Equality, Shrink=True)

# ---- group: FormFinding 01 / support Pt
offset_2 = OffsetCurve(Curve=seam2crvcorn.Adjusted, Distance="-0.3", Corners=1)
incurve_2 = PointInCurve(Point=nv.NakedPts, Curve=offset_2)  # -> Relationship, Point
equals_3 = Equality(FirstNumber=incurve_2.Relationship, SecondNumber="0")  # -> Equality, Inequality
cull_2 = CullPattern(List=nv.NakedPts, CullPattern=equals_3.Equality)
crv_4 = Curve(dispatch_4.ListA)
offset_3 = PolylineOffset(Curve=crv_4, Distance="0.05", Divisions=0)  # -> C, H
incurve_3 = PointInCurve(Point=cull_2, Curve=graft(offset_3.C))  # -> Relationship, Point
equals_4 = Equality(FirstNumber=incurve_3.Relationship, SecondNumber="2")  # -> Equality, Inequality
cull_3 = CullPattern(List=cull_2, CullPattern=equals_4.Equality)
pt_2 = Point(flatten(cull_3))

# ---- group: FormFinding 01 / net grid
mesh_2 = Mesh(cullv)
medges_2 = MeshEdges(Mesh=mesh_2)  # -> NakedEdges, InteriorEdges, NonManifoldEdges
end_2 = EndPoints(Curve=graft(medges_2.NakedEdges))  # -> Start, End
relay = Relay([end_2.Start, end_2.End])
incurves_2 = PointInCurves(Point=relay, Curves=offset_3.C)  # -> Relationship, Index, Point
ma = MassAddition(Input=incurves_2.Relationship)  # -> Result, PartialResults
equals_5 = Equality(FirstNumber=ma.Result, SecondNumber=4)  # -> flatten(Equality), flatten(Inequality)
cull_4 = CullPattern(List=medges_2.NakedEdges, CullPattern=equals_5.Inequality)
merge_2 = Merge(Data1=cull_4, Data2=medges_2.InteriorEdges)
wbweave = WeaverbirdsMeshFromLinesWeaveBack(Lines=merge_2, MaximumValence=4)

# ---- group: FormFinding 01 / 3 way direction final shape
wbedges_2 = WeaverbirdsMeshEdges(MeshOrPolylines=wbweave)
X_3 = UnitX(Factor=1)
angle_3 = Angle(VectorA=wbedges_2, VectorB=X_3)  # -> Angle, Reflex
pi_5 = Pi(Factor=0.5)
subtraction_4 = Subtraction(A=angle_3.Angle, B=pi_5)
pi_6 = Pi(Factor=Slider(0.19, range=0..2))
abs_3 = Absolute(Value=subtraction_4)
smaller_2 = SmallerThan(FirstNumber=abs_3, SecondNumber=pi_6)  # -> SmallerThan, OrEqualTo
dispatch_5 = Dispatch(List=wbedges_2, DispatchPattern=smaller_2.SmallerThan)  # -> ListA, ListB
pt_3 = Point(Point(1.5, 1, 0))
vec_2 = Vector(pt_3)
geo_2 = Geometry(dispatch_5.ListA)
angle_4 = Angle(VectorA=geo_2, VectorB=vec_2)  # -> Angle, Reflex
pi_7 = Pi(Factor=0.5)
subtraction_5 = Subtraction(A=angle_4.Angle, B=pi_7)
pi_8 = Pi(Factor=Slider(0.2, range=0..2))
abs_4 = Absolute(Value=subtraction_5)
larger_2 = LargerThan(FirstNumber=abs_4, SecondNumber=pi_8)  # -> LargerThan, OrEqualTo
dispatch_6 = Dispatch(List=geo_2, DispatchPattern=larger_2.LargerThan)  # -> ListA, ListB
line_5 = Line(dispatch_6.ListA)
line_6 = Line(dispatch_6.ListB)
line_7 = Line(dispatch_5.ListB)
entwine_2 = Entwine(Branch00=line_5, Branch01=line_6, Branch02=line_7, FlattenInputs=True)

# ---- group: FormFinding 01
number_slider_2 = Slider(-1, range=-10..10)
number_slider_3 = Slider(-2.72, range=-5..10)
number_slider_4 = Slider(0.08, range=-5..10)
crv_5 = Curve(crv_4)
midpt_2 = CurveMiddle(Curve=crv_4)
ext = ExtendCurve(Curve=crv_5, Type=0, Start=number_slider_2, End=number_slider_2)
vec2pt_2 = Vector2Pt(PointA=area.Centroid, PointB=midpt_2, Unitize=True)  # -> Vector, Length

end_3 = EndPoints(Curve=ext)  # -> Start, End
merge_3 = Merge(Data1=graft(end_3.Start), Data2=graft(end_3.End))
amp_2 = Amplitude(Vector=vec2pt_2.Vector, Amplitude=number_slider_3)
move_2 = Move(Geometry=merge_3, Motion=graft(amp_2))  # -> Geometry, Transform

midpt_3 = CurveMiddle(Curve=ext)  # -> graft(Midpoint)
amp_3 = Amplitude(Vector=vec2pt_2.Vector, Amplitude=number_slider_4)
move_3 = Move(Geometry=midpt_3, Motion=graft(amp_3))  # -> Geometry, Transform

item_3 = ListItem(List=move_2.Geometry, Index=0, Wrap=True)  # -> Item, Item1
ins = InsertItems(List=move_2.Geometry, Item=move_3.Geometry, Indices=1, Wrap=False)
intcrv = Interpolate(Vertices=ins, Degree=3, Periodic=False, KnotStyle=1)  # -> simplify(flatten(Curve)), Length, Domain
arc = Arc3Pt(PointA=item_3.Item, PointB=move_3.Geometry, PointC=item_3.Item1)  # -> simplify(flatten(Arc)), Plane, Radius

number_slider_5 = Slider(12.7, range=1..100)
join_2 = JoinCurves(Curves=entwine, Preserve=False)
crv_6 = Curve(splitatcorners_2.Parts)
xz = XZPlane(Origin=Point(0, 0, 0))
Z_2 = UnitZ(Factor=Slider(0, range=0..2))
pt_4 = Point([nv.ClothedPts, nv.NakedPts])
rod = Rod(Polyline=crv_6, LengthFactor=1, AngleFactor=1, AxialStrength=Slider(0.62, range=0..5), BendStrength=number_slider_5)
rod_2 = Rod(Polyline=join_2, LengthFactor=1, AngleFactor=1, AxialStrength=Slider(55, range=0..100), BendStrength=number_slider_5)
oncurve = OnCurve(Points=cull_3, Curve=graft(arc.Arc), Strength=Slider(150, range=1..200))
anchorxyz = AnchorXYZ(Point=pt_2, X=False, Y=False, Z=Toggle(True), Strength=10000)
onplane = OnPlane(Points=cull, Plane=xz, Strength=Slider(20, range=0..100))
smooth = Smooth(M=mesh, Strength=1)
pressure = Pressure(M=mesh, Strength=Slider(0.45, range=0..1.5))
show = Show(G=wbweave)
show_2 = Show(G=entwine_2)
load = Load(Point=pt_4, ForceVector=Z_2, Weighting=1)
show_3 = Show(G=mesh)
show_4 = Show(G=entwine)
relay_2 = Relay([ea, ea_3, ea_2])

previewlw = CustomPreviewLineweights(Geometry=arc.Arc, Shader=ColourSwatch(SwatchColor=RGB(196, 14, 14)), Thickness=Slider(10, range=0..10), Absolute=False)
entwine_3 = Entwine(
    Branch00=show_4,
    Branch01=show_3,
    Branch02=[rod_2, load, anchorxyz, oncurve, rod, pressure, smooth, onplane],
    Branch03=relay_2,
    Branch04=show_2,
    Branch05=show,
    FlattenInputs=True)
zombiesolver = ZombieSolver(GoalObjects=entwine_3, Threshold=1e-10, Tolerance=0.0001, MaxIterations=50000)  # -> I, V, O

# ----
dam = DataDam(DataA=zombiesolver.O, BufferDelay=10000000, BufferMode=0)
unflatten = UnflattenTree(Tree=dam, Guide=entwine_3)

# ---- group: FormFinding 02
mesh_3 = TreeBranch(Tree=unflatten, Path="{0;1}", MaintainPaths=True)

_3way_nets = TreeBranch(Tree=unflatten, Path="{0;0}", MaintainPaths=True)

crv_7 = Curve(_3way_nets)
unflatten_2 = UnflattenTree(Tree=crv_7, Guide=entwine)
mesh_4 = Mesh(mesh_3)

geodésicas_imposición_angulos_opuestos_i_2 = Slider(3.709, range=0..15)  # "Geodésicas: imposición angulos opuestos iguales"
vn_2 = VertexNeighbours(Mesh=mesh_4, VertexNumber=nv.ClothedIndex)  # -> Vertex, Neighbours, Normal
ln_2 = Line(StartPoint=simplify(graft(vn_2.Vertex)), EndPoint=simplify(vn_2.Neighbours))
item_4 = ListItem(List=ln_2, Index=0, Wrap=True)  # -> Item, Item1, Item2, Item3, Item4, Item5
_10º_2 = PowerOf10(Value=geodésicas_imposición_angulos_opuestos_i_2)

join_3 = JoinCurves(Curves=unflatten_2, Preserve=False)
explode_2 = Explode(Curve=join_3, Recursive=True)  # -> Segments, Vertices
number_slider_6 = Slider(19.32, range=0..20)
lng = ListLength(List=explode_2.Segments)
cull_i = CullIndex(List=explode_2.Segments, Indices=expr("x-1", lng), Wrap=True)
shift = ShiftList(List=explode_2.Segments, Shift=1, Wrap=False)

wbnaked_2 = WeaverbirdsNakedBoundary(MeshClosedPolylines=mesh_4)
splitatcorners_3 = SplitAtCorners(Poly=wbnaked_2, Angle=1)  # -> Corners, Parts
explode_3 = Explode(Curve=splitatcorners_3.Parts, Recursive=True)  # -> Segments, Vertices
shift_2 = ShiftList(List=explode_3.Segments, Shift=1, Wrap=True)

number_slider_7 = Slider(1, range=0..10)
crv_8 = Curve(arc.Arc)

culled_networks = TreeBranch(Tree=unflatten, Path="{0;4}", MaintainPaths=True)

culled_mesh = TreeBranch(Tree=unflatten, Path="{0;5}", MaintainPaths=True)

branch = TreeBranch(Tree=unflatten, Path="{0;5}", MaintainPaths=True)
number_slider_8 = Slider(60, range=0..100)
number_slider_9 = Slider(1.049, range=0..20)
number_slider_10 = Slider(173, range=0..300)
number_slider_11 = Slider(0.06, range=0.06..20)
number_slider_12 = Slider(10000, range=0..10000)
xy = XYPlane(Origin=Point(0, 0, 0))

nv_2 = NakedVertices(Mesh=mesh_4)  # -> ClothedIndex, NakedIndex, ClothedPts, NakedPts
demesh_3 = DeconstructMesh(Mesh=mesh_4)  # -> Vertices, Faces, Colours, Normals
index = ItemIndex(List=nv.NakedPts, Item=pt_2)
patch = Patch(Points=demesh_3.Vertices, Spans=number_slider_8, Flexibility=1, Trim=True)
item_5 = ListItem(List=nv_2.NakedPts, Index=index, Wrap=True)
number_slider_13 = Slider(1000, range=0..1000)
srf = Surface(patch)
mesh_5 = Mesh(srf)
relay_3 = Relay([nv_2.NakedPts, nv_2.ClothedPts])

# ---- group: FormFinding 02 / area & entrance check
wbnaked_3 = WeaverbirdsNakedBoundary(MeshClosedPolylines=branch)
splitatcorners_4 = SplitAtCorners(Poly=wbnaked_3, Angle=Slider(0.6, range=0..1))  # -> flatten(Corners), Parts
demesh_4 = DeconstructMesh(Mesh=branch)  # -> Vertices, Faces, Colours, Normals
pdecon = Deconstruct(Point=flatten(demesh_4.Vertices))  # -> XComponent, YComponent, ZComponent
project = Project(Geometry=branch, Plane=PlaneXY(0, 0, 0))  # -> Geometry, Transform
pdecon_2 = Deconstruct(Point=splitatcorners_4.Corners)  # -> XComponent, YComponent, ZComponent
extremums = MinMax(Number=pdecon_2.ZComponent)  # -> Minimum, Maximum
extremums_2 = MinMax(Number=pdecon.ZComponent)  # -> Minimum, Maximum
area_2 = Area(Geometry=project.Geometry)  # -> Area, Centroid
pavillion_area = Panel(area_2.Area)
entrance_height = Panel(extremums.Maximum)
top_height = Panel(extremums_2.Maximum)

# ---- group: FormFinding 02
number_slider_14 = Slider(4, range=0..100)
index_2 = ItemIndex(List=demesh.Vertices, Item=cull)
xz_2 = XZPlane(Origin=Point(0, 0, 0))
item_6 = ListItem(List=demesh_3.Vertices, Index=index_2, Wrap=True)

mesh_uv = MeshSurface(Surface=srf, UCount=number_slider_10, VCount=number_slider_10, Overhang=True, Equalize=False)
mesh_6 = Mesh(project.Geometry)
onplane_2 = OnPlane(Points=item_5, Plane=xy, Strength=Slider(5000, range=0..10000))

length_line = LengthLine(Line=flatten([explode_2.Segments, explode_3.Segments]), Strength=number_slider_11)
angle_5 = Angle(LineA=cull_i, LineB=shift, Strength=number_slider_6)
angle_6 = Angle(LineA=explode_3.Segments, LineB=shift_2, Strength=number_slider_9)
ea_4 = EqualAngle(LineA=[item_4.Item, item_4.Item3], LineB=[item_4.Item1, item_4.Item4], Strength=_10º_2)
ea_5 = EqualAngle(LineA=[item_4.Item1, item_4.Item4], LineB=[item_4.Item2, item_4.Item5], Strength=_10º_2)
ea_6 = EqualAngle(LineA=[item_4.Item2, item_4.Item5], LineB=[item_4.Item3, item_4.Item], Strength=_10º_2)
anchorxyz_2 = AnchorXYZ(Point=item_5, X=False, Y=False, Z=True, Strength=number_slider_12)  # disabled
onplane_3 = OnPlane(Points=item_6, Plane=xz_2, Strength=number_slider_14)
oncurve_2 = OnCurve(Points=item_5, Curve=crv_8, Strength=number_slider_7)  # disabled
onmesh = OnMesh(Points=relay_3, Mesh=mesh_uv, Strength=number_slider_13)
mesh_7 = Show(G=mesh_4)
_3way_nets_2 = Show(G=unflatten_2)
show_5 = Show(G=ln_2)
show_6 = Show(G=culled_networks)
show_7 = Show(G=culled_mesh)
clean = CleanTree(RemoveNulls=True, RemoveInvalid=True, RemoveEmpty=False, Tree=angle_5)

entwine_4 = Entwine(
    Branch00=mesh_7,
    Branch01=_3way_nets_2,
    Branch02=[onmesh, anchorxyz_2, oncurve_2],
    Branch03=[length_line, clean, angle_6, onplane_3, onplane_2],
    Branch04=[ea_4, ea_5, ea_6],
    Branch05=show_6,
    Branch06=show_7,
    Branch07=show_5,
    FlattenInputs=True)
zombiesolver_2 = ZombieSolver(GoalObjects=entwine_4, Threshold=1e-10, Tolerance=0.0001, MaxIterations="2500")  # -> I, V, O
unflatten_3 = UnflattenTree(Tree=zombiesolver_2.O, Guide=entwine_4)

# ----
dam_2 = DataDam(DataA=unflatten_3, BufferDelay=10000000, BufferMode=0)
bang = ExplodeTree(Data=dam_2)  # -> Branch0, Branch1, Branch2, Branch3, Branch4, Branch5, Branch6, Branch7
unflatten_4 = UnflattenTree(Tree=bang.Branch5, Guide=entwine_2)
mesh_final = Mesh(flatten(bang.Branch6))
line_8 = Line(unflatten_4)

# ---- group: angle visualization
unflatten_5 = UnflattenTree(Tree=bang.Branch7, Guide=ln_2)  # disabled
number_slider_15 = Slider(0.3, range=0..1)  # disabled
toggle = GroupToggle(ToggleActive=True, ToggleVisible=False)  # disabled
subcrv = SubCurve(BaseCurve=reparameterize(unflatten_5), Domain=number_slider_15)  # disabled
shift_3 = ShiftList(List=subcrv, Shift=1, Wrap=True)  # disabled
angle_7 = Angle(VectorA=subcrv, VectorB=shift_3)  # -> Angle, Reflex; disabled
item_7 = ListItem(List=angle_7.Angle, Index=0, Wrap=True)  # -> Item, Item1, Item2, Item3, Item4, Item5; disabled
subtraction_6 = Subtraction(A=item_7.Item, B=item_7.Item3)  # disabled
subtraction_7 = Subtraction(A=item_7.Item1, B=item_7.Item4)  # disabled
subtraction_8 = Subtraction(A=item_7.Item2, B=item_7.Item5)  # disabled
merge_4 = Merge(Data1=subtraction_6, Data2=subtraction_7, Data3=subtraction_8)  # disabled
merge_5 = Merge(Data1=simplify(graft(subcrv)), Data2=simplify(graft(shift_3)))  # disabled
abs_5 = Absolute(Value=merge_4)  # disabled
ma_2 = MassAddition(Input=abs_5)  # -> Result, PartialResults; disabled
bnd = Bounds(Numbers=flatten(abs_5))  # disabled
avr = Average(Input=flatten(ma_2.Result))  # disabled
dedomain = DeconstructDomain(Domain=bnd)  # -> Start, End; disabled
average_of_absolute_angle_difference = Panel(avr)  # disabled
gradient = Gradient(
    LowerLimit=dedomain.Start,
    UpperLimit=dedomain.End,
    Parameter=abs_5,
    stops=[0: RGB(243, 57, 0), 0.1: RGB(236, 27, 60), 0.2: RGB(210, 0, 118), 0.3: RGB(103, 0, 120), 0.4: RGB(39, 72, 161), 0.5: RGB(1, 192, 229), 0.6: RGB(18, 178, 90), 0.7: RGB(79, 186, 8), 0.8: RGB(220, 237, 32), 0.9: RGB(247, 159, 20), 1: RGB(243, 57, 0)])  # disabled
loft = Loft(Curves=merge_5, Options={Adjust=False, Closed=False, LoftEnds=0, LoftSimp=0, LoftType=0, Rebuild=10, Refit=0.01})  # disabled
pshift = ShiftPaths(Data=loft, Offset=-1)  # disabled
jitter = Jitter(List=gradient, Jitter=1, Seed=89)  # -> Values, Indices; disabled
item_8 = ListItem(List=pshift, Index=0, Wrap=True)  # -> Item, Item1, Item2, Item3, Item4, Item5; disabled
item_9 = ListItem(List=jitter.Values, Index=0, Wrap=True)  # -> Item, Item1, Item2, Item3, Item4, Item5; disabled
previewmat = CustomPreviewMaterials(Geometry=[item_8.Item, item_8.Item3], DiffuseColor=[item_9.Item, item_9.Item3])  # disabled
previewmat_2 = CustomPreviewMaterials(Geometry=[item_8.Item1, item_8.Item4], DiffuseColor=[item_9.Item1, item_9.Item4])  # disabled
previewmat_3 = CustomPreviewMaterials(Geometry=[item_8.Item2, item_8.Item5], DiffuseColor=[item_9.Item2, item_9.Item5])  # disabled

# ----
output = DataOutput(
    UntrimmedMesh=bang.Branch0,
    Surface=srf,
    TrimmedMesh=mesh_final,
    MeshTrimmedLines=line_8,
    Thickness=height,
    Width=width,
    Destination="E:\MPDA\Sem02\S2\GH Files\2022_06_01_3wayGeodesics_Formfinding_Data.ghdata",
    RelativePath="E:\MPDA\Sem02\S2\GH Files\2022_06_01_3wayGeodesics_Formfinding_Data.ghdata|2022_06_01_3wayGeodesics_Formfinding_Data.ghdata")
