# Grasshopper definition 2022_06_02_3waygeodesic_StructuralAnalysis.gh (Grasshopper 1.0.7)
# plug-ins: Bowerbird2, Human, Kiwi3d, MetaHopper, Heteroptera, K2Engineering, plankton, Karamba3D, Kangaroo2 Components, Pufferfish

input = DataInput(
    Destination="E:\MPDA\Sem02\S2\GH Files\2022_06_01_3wayGeodesics_Formfinding_Data.ghdata",
    RelativePath="E:\MPDA\Sem02\S2\GH Files\2022_06_01_3wayGeodesics_Formfinding_Data.ghdata|2022_06_01_3wayGeodesics_Formfinding_Data.ghdata",
    UpdateDelay=50000)  # -> UntrimmedMesh, Surface, TrimmedMesh, MeshTrimmedLines, Thickness, Width

join = JoinCurves(Curves=input.MeshTrimmedLines, Preserve=False)
len = Length(Curve=join)
explode = Explode(Curve=join, Recursive=True)  # -> Segments, Vertices
intcrv = Interpolate(Vertices=explode.Vertices, Degree=3, Periodic=False, KnotStyle=1)  # -> Curve, Length, Domain
sort = SortList(Keys=len)  # -> Keys, ValuesA
pshift = ShiftPaths(Data=intcrv.Curve, Offset=-1)
panel = Panel(sort.Keys)
crv = Curve(reparameterize(pshift))
item = ListItem(List=join, Index=0, Wrap=True)  # -> flatten(Item)
number_slider = Slider(19, range=0..100)
shift = ShiftList(List=item, Shift=1, Wrap=True)  # -> graft(List)
project = Project(Geometry=shift, Plane=PlaneXY(0, 0, 0))  # -> Geometry, Transform
project_2 = Project(Geometry=crv, Plane=PlaneXY(0, 0, 0))  # -> Geometry, Transform
ext = ExtendCurve(Curve=project.Geometry, Type=0, Start=number_slider, End=number_slider)
ext_2 = ExtendCurve(Curve=project_2.Geometry, Type=0, Start=number_slider, End=number_slider)
ccx = CurveCurve(CurveA=ext_2, CurveB=ext)  # -> simplify(Points), ParamsA, ParamsB
pshift_2 = ShiftPaths(Data=ccx.Points, Offset=-1)  # -> simplify(Data)
alongcrv = SortAlongCurve(Points=pshift_2, Curve=ext)  # -> Points, Indices
item_2 = ListItem(List=crv, Index=alongcrv.Indices, Wrap=True)

# ---- group: material for geometry
sigma = Slider(40, range=0..100)
safety_factor = Slider(0.7, range=0..1)
expression = Expression(E=Slider(9148, range=0..100000), s=sigma, f=safety_factor, Expression="E/(2*s*f)")
kn = Expression(t=input.Thickness, F=expression, Expression="t*F")
kg = Expression(t=input.Width, F=expression, Expression="t*F")
one_over_x = OneOverX(Value=kg)
one_over_x_2 = OneOverX(Value=kn)
panel_2 = Panel(one_over_x)
panel_3 = Panel(one_over_x_2)

# ----
range = Range(Domain=Domain(0, 1), Steps="50")
shift_2 = ShiftList(List=range, Shift=1, Wrap=invert(True))
short = ShortestList(ListA=range, ListB=shift_2, TrimMode=2)  # -> ListA, ListB
merge = Merge(Data1=simplify(graft(short.ListA)), Data2=simplify(graft(short.ListB)))
avr = Average(Input=merge)  # -> flatten(ArithmeticMean)

list = ValueList({"Displacements": 1, "Stresses": 2, "SupportForces": 3}, selected=["Displacements", "Stresses", "SupportForces"])
ldc = LoadDisplCurve(TimeStepList=[0, 10], ValueList=[0, 1])
nonlina = NonLinearAnalysis(
    Name="s2sa_test33",
    Iterations="10",
    EquilibriumAccurancy=0.001,
    OutputSetting=list,
    GlobalLDCurve=ldc,
    AdaptiveForceControl=0,
    OutputFrequency=1)

# ---- group: Plywood material
list_2 = ValueList({"LIN_ELAST_ISOTROPIC": 1}, selected="LIN_ELAST_ISOTROPIC")
mat = Material(Name="Plywood", Type=list_2, YoungsModulus="10050000", AlphaT=0, Nue=0, Density="0.68", Strength="40000")

# ----
list_3 = ValueList({"Displacements": 1, "Stresses": 2, "SupportForces": 3}, selected=["Displacements", "Stresses", "SupportForces"])
lina = LinearAnalysis(Name="s2sa_test2", OutputSetting=list_3)

# ---- group: Material
list_4 = ValueList({"LIN_ELAST_ISOTROPIC": 1}, selected="LIN_ELAST_ISOTROPIC")
mat_2 = Material(Name="Kerto S", Type=list_4, YoungsModulus="11600000", AlphaT=0, Nue=0, Density="0.48", Strength="35000")

list_5 = ValueList({"LIN_ELAST_ISOTROPIC": 1}, selected="LIN_ELAST_ISOTROPIC")
mat_3 = Material(Name="Kerto S", Type=list_5, YoungsModulus="11600000", AlphaT=0, Nue=0, Density="0.48", Strength="35000")

# ----
path = FilePath("\\Mac\Home\Desktop\MPDA\s2\screenshot\")
capture = Capture(Path=path, Filename="pd_analysis", Reset=False)

# ---- group: Plywood material
list_6 = ValueList({"LIN_ELAST_ISOTROPIC": 1}, selected="LIN_ELAST_ISOTROPIC")  # disabled
panel_4 = Panel("10050000")  # disabled
panel_5 = Panel("Plywood")  # disabled
panel_6 = Panel("0.68")  # disabled
panel_7 = Panel("40000")  # disabled
mat_4 = Material(Name=panel_5, Type=list_6, YoungsModulus=panel_4, AlphaT=0, Nue=0, Density=panel_6, Strength=panel_7)  # disabled

# ---- group: Karamba
matprops = MaterialPropertiesKaramba3D(
    FamilyOfMaterial="Plywood",
    Name="plywood18",
    YoungsModulusKNCm2Dir1="914.8",
    YoungsModulusKNCm2Dir2="835.2",
    InPlaneShearModulus_kN_cm2="20.6",
    InPlaneLateralContractionCoefficient="0.3",
    TransverseShearModulusKNCm2Dir1="62",
    TransverseShearModulusKNCm2Dir2="62",
    SpecificWeight_kN_m3="6.8",
    CoefficientOfThermalExpansion1CDir1=1.2e-05,
    CoefficientOfThermalExpansion1CDir2=1.2e-05,
    TensileStrengthKNCm2Dir1="3.92",
    TensileStrengthKNCm2Dir2="3.58",
    CompressiveStrengthKNCm2Dir1="-2.72",
    CompressiveStrengthKNCm2Dir2="-2.48",
    ShearStrengthKNCm2Dir12="0.95",
    TsaiWuIntCoeff=0,
    StrengthHypothesis="MISES",
    mode="Orthotropic")

matprops_2 = MaterialPropertiesKaramba3D(
    FamilyOfMaterial="Plywood",
    Name="plywood15",
    YoungsModulusKNCm2Dir1="922.3",
    YoungsModulusKNCm2Dir2="827.7",
    InPlaneShearModulus_kN_cm2="20.7",
    InPlaneLateralContractionCoefficient="0.3",
    TransverseShearModulusKNCm2Dir1="62",
    TransverseShearModulusKNCm2Dir2="62",
    SpecificWeight_kN_m3="6.8",
    CoefficientOfThermalExpansion1CDir1=1.2e-05,
    CoefficientOfThermalExpansion1CDir2=1.2e-05,
    TensileStrengthKNCm2Dir1="3.95",
    TensileStrengthKNCm2Dir2="3.55",
    CompressiveStrengthKNCm2Dir1="-2.74",
    CompressiveStrengthKNCm2Dir2="-2.46",
    ShearStrengthKNCm2Dir12="0.95",
    TsaiWuIntCoeff=0,
    StrengthHypothesis="MISES",
    mode="Orthotropic")

# ----
list_7 = ValueList({"Displacements": 1, "Stresses": 2, "SupportForces": 3}, selected=["Displacements", "Stresses", "SupportForces"])  # disabled
ldc_2 = LoadDisplCurve(TimeStepList=[0, 10], ValueList=[0, 1])  # disabled
panel_8 = Panel("s2sa_test33")  # disabled
panel_9 = Panel("10")  # disabled
nonlina_2 = NonLinearAnalysis(
    Name=panel_8,
    Iterations=panel_9,
    EquilibriumAccurancy=0.001,
    OutputSetting=list_7,
    GlobalLDCurve=ldc_2,
    AdaptiveForceControl=0,
    OutputFrequency=1)  # disabled

list_8 = ValueList({"Displacements": 1, "Stresses": 2, "SupportForces": 3}, selected=["Displacements", "Stresses", "SupportForces"])  # disabled
panel_10 = Panel("s2sa_test2")  # disabled
lina_2 = LinearAnalysis(Name=panel_10, OutputSetting=list_8)  # disabled

# ---- group: Karamba / Loads (Karamba3D)
loads = LoadsKaramba3D(Vector=Vector(0, 0, -1), LCase="0", mode="Gravity")  # -> flatten(Load)

# ----
explode_2 = Explode(Curve=item_2, Recursive=True)  # -> Segments, Vertices
intcrv_2 = Interpolate(Vertices=explode_2.Vertices, Degree=3, Periodic=False, KnotStyle=1)  # -> Curve, Length, Domain
pshift_3 = ShiftPaths(Data=item_2, Offset=-1)
srf = Surface(input.Surface)
crvonsrf = BBConstructCurveOnSurface(Surface=srf, Curve=pshift_3, Space=0)  # -> reparameterize(simplify(graft(CurveOnSurface))), Approximation
panel_12 = Panel(pshift_3)
shatter = Shatter(Curve=reparameterize(pshift_3), Parameters=avr)
number_slider_2 = Slider(2.2, range=0..10)

τg = BBGeodesicTorsionCurveOnSurface(CurveOnSurface=crvonsrf.CurveOnSurface, Parameter=avr)  # -> Point, Torsion
κg = BBGeodesicCurvatureCurveOnSurface(CurveOnSurface=crvonsrf.CurveOnSurface, Parameter=avr)  # -> Point, Curvature, OsculatingCircle
κn = BBNormalCurvatureCurveOnSurface(CurveOnSurface=crvonsrf.CurveOnSurface, Parameter=avr)  # -> Point, Curvature, OsculatingCircle
bnd = Bounds(Numbers=flatten(κn.Curvature))
bnd_2 = Bounds(Numbers=flatten(κg.Curvature))
bnd_3 = Bounds(Numbers=flatten(τg.Torsion))
dedomain = DeconstructDomain(Domain=bnd)  # -> Start, End
dedomain_2 = DeconstructDomain(Domain=bnd_3)  # -> Start, End
dedomain_3 = DeconstructDomain(Domain=bnd_2)  # -> Start, End
gradient = Gradient(
    LowerLimit=dedomain.Start,
    UpperLimit=one_over_x_2,
    Parameter=κn.Curvature,
    stops=[0: RGB(224, 224, 224), 1: RGB(0, 100, 0)])
gradient_2 = Gradient(
    LowerLimit=dedomain_3.Start,
    UpperLimit=one_over_x,
    Parameter=κg.Curvature,
    stops=[0: RGB(255, 255, 128), 0.298: RGB(0, 128, 128), 1: RGB(38, 7, 163)])
gradient_3 = Gradient(LowerLimit=0, UpperLimit=dedomain_2.End, Parameter=τg.Torsion, stops=[0: RGB(224, 224, 224), 1: RGB(0, 0, 0)])

crv_2 = Curve(reparameterize(graft(pshift_3)))
torsion = Torsion(Curve=crv_2, Parameter=avr)  # -> Point, Torsion
curvature = Curvature(Curve=crv_2, Parameter=avr)  # -> P, K, C
angle = Angle(VectorA=κn.Curvature, VectorB=curvature.K)  # -> Angle, Reflex
bnd_4 = Bounds(Numbers=flatten(angle.Angle))
dedomain_4 = DeconstructDomain(Domain=bnd_4)  # -> Start, End
gradient_4 = Gradient(
    LowerLimit=dedomain_4.Start,
    UpperLimit=dedomain_4.End,
    Parameter=angle.Angle,
    stops=[0: RGB(224, 224, 224), 0.456: RGB(0, 192, 192)])

panel_13 = Panel(torsion.Torsion)
panel_14 = Panel(bnd_3)
panel_15 = Panel(dedomain_3.End)
panel_16 = Panel(bnd)
neg = Negative(Value=curvature.K)
neg_2 = Negative(Value=κn.Curvature)

bnd_5 = Bounds(Numbers=flatten(torsion.Torsion))
dedomain_5 = DeconstructDomain(Domain=bnd_5)  # -> Start, End
panel_17 = Panel(bnd_5)

neg_3 = Negative(Value=dedomain_5.End)

gradient_5 = Gradient(
    LowerLimit=neg_3,
    UpperLimit=dedomain_5.End,
    Parameter=torsion.Torsion,
    stops=[0: RGB(234, 38, 0), 0.25: RGB(234, 126, 0), 0.5: RGB(254, 244, 84), 0.75: RGB(173, 203, 249), 1: RGB(75, 107, 169)])

vdisex = VectorDisplayEx(Point=curvature.P, Vector=neg_2, Colour=ColourSwatch(SwatchColor=RGB(196, 255, 249)), Width=2)
vdisex_2 = VectorDisplayEx(Point=curvature.P, Vector=neg, Colour=ColourSwatch(SwatchColor=RGB(52, 84, 112)), Width=2)
previewlw = CustomPreviewLineweights(Geometry=shatter, Shader=gradient, Thickness=number_slider_2, Absolute=False)
previewlw_2 = CustomPreviewLineweights(Geometry=shatter, Shader=gradient_2, Thickness=number_slider_2, Absolute=False)
previewlw_3 = CustomPreviewLineweights(Geometry=shatter, Shader=gradient_3, Thickness=number_slider_2, Absolute=False)
previewlw_4 = CustomPreviewLineweights(Geometry=shatter, Shader=gradient_4, Thickness=number_slider_2, Absolute=False)
previewlw_5 = CustomPreviewLineweights(Geometry=shatter, Shader=gradient_5, Thickness=number_slider_2, Absolute=False)

crv_smooth = Curve(pshift_3)
crv_polyline = Curve(item_2)
toggle = GroupToggle(ToggleActive=True, ToggleVisible=False)  # disabled
mesh = Mesh(input.TrimmedMesh)

crv_polyline_2 = Curve(crv_polyline)
crv_smooth_2 = Curve(crv_smooth)
explode_3 = Explode(Curve=crv_polyline_2, Recursive=True)  # -> Segments, Vertices
graft = GraftTree(Tree=crv_smooth_2, IncludeEmptyLists=True, IncludeNullItems=True)
crv_cp = CurveClosestPoint(Point=explode_3.Vertices, Curve=reparameterize(graft))  # -> Point, Parameter, Distance
the_surface = Surface(input.Surface)
srf_cp = SurfaceClosestPoint(Point=crv_cp.Point, Surface=the_surface)  # -> Point, UVPoint, Distance
evalsrf = EvaluateSurface(Surface=the_surface, Point=srf_cp.UVPoint)  # -> Point, Normal, UDirection, VDirection, Frame
vec = Vector(simplify(evalsrf.Normal))
section_axis = SectionAxis(CurveParameter=crv_cp.Parameter, SectionAxis=vec)

bang = ExplodeTree(Data=simplify(crv_smooth_2))  # -> Branch0, Branch1, Branch2
crv_3 = Curve(reparameterize(bang.Branch1))
crv_4 = Curve(reparameterize(bang.Branch0))
crv_5 = Curve(reparameterize(bang.Branch2))
merge_2 = Merge(Data1=crv_4, Data2=crv_3, Data3=crv_5)
graft_2 = GraftTree(Tree=merge_2, IncludeEmptyLists=True, IncludeNullItems=True)

# ---- group: Wind load
pmesh = PlanktonMesh(mesh)
pi = Pi(Factor=Slider(0, range=0..2))
X = UnitX(Factor=1)
Z = UnitZ(Factor=1)
mvarea = MeshVertexArea(PlanktonMesh=pmesh)  # -> Vertices, VertexNormals
vrot = Rotate(Vector=X, Axis=Z, Angle=pi)
amp = Amplitude(Vector=vrot, Amplitude=Slider(0.53, range=0..2))
mwind = MeshWindLoad(Wind=amp, VertexNormals=mvarea.VertexNormals, Option=Toggle(True))
list_9 = ValueList({"DEAD": 1, "SNOW": 2, "PRES": 3, "PRES_FL": 4, "MOMENT": 5}, selected="PRES")
multiplication = Multiplication(A=mwind, B="0.001")
windload = PointLoad(Point=mvarea.Vertices, Loadtype=list_9, Direction=mvarea.VertexNormals, Value=multiplication, LoadCase=1)

# ---- group: support
end = EndPoints(Curve=crv_smooth_2)  # -> Start, End
pt = Point(flatten([end.Start, end.End]))
pdecon = Deconstruct(Point=pt)  # -> XComponent, YComponent, ZComponent
smaller = SmallerThan(FirstNumber=pdecon.ZComponent, SecondNumber="0.02")  # -> SmallerThan, OrEqualTo
dispatch = Dispatch(List=pt, DispatchPattern=smaller.SmallerThan)  # -> ListA, ListB
pt_2 = Point(dispatch.ListA)
suppt = SupportPoint(Point=pt_2, DispX=True, DispY=True, DispZ=True, Rotation=False, Torsion=False, TryStrongSupport=True)

# ----
toggle_2 = BooleanToggle(True)
prestress_properties = PrestressPropertiesBeam(L=False, AB1=toggle_2, AB2=False, AT=toggle_2, N=0, M1=0, M2=0, T=0)
height = Number(input.Thickness)
width = Number(0.1)
toggle_3 = BooleanToggle(False)
box = BoxSection(Height=height, Width=width, Thickness=0)  # -> Section, Area
crvref = CurveRefinement(PDeg=1, ElementRefU="1", IsKnotApproxElementSize=False, IsKnotSubdivision=True)
beam = BeamElement(
    C=reparameterize(graft_2),
    M=mat,
    S=box.Section,
    R=crvref,
    AB=section_axis,
    P=prestress_properties,
    HS=toggle_3,
    HE=toggle_3,
    HB=toggle_3)

# ---- group: coupling
python = GhPythonScript(cvA=flatten(crv_4), cvB=flatten(crv_3))  # -> out, ptLst, cv1, cv2; inputs cvA: list of Curve, cvB: list of Curve
# ---------- python: Python ----------
__author__ = "zenorm"
__version__ = "2022.04.09"

import rhinoscriptsyntax as rs
import Rhino.Geometry as rg

cv1 = []
cv2 = []
ptLst = []
for i in cvA:
    for j in cvB:
        intersect = rs.CurveCurveIntersection(i,j,-1)
        if intersect != None:
            print intersect[0][5]
            if (intersect[0][0] == 1) & (intersect[0][5] != 1.0) & (intersect[0][5] != 0.0) & (intersect[0][7] != 0.0) & (intersect[0][7] != 1.0):
                pt = intersect[0][1]
                ptLst.append(pt)
                cv1.append(i)
                cv2.append(j)
# ---------- end python ----------
python_2 = GhPythonScript(cvA=flatten(crv_4), cvB=flatten(crv_5))  # -> out, ptLst, cv1, cv2; inputs cvA: list of Curve, cvB: list of Curve
# ---------- python_2: Python ----------
__author__ = "zenorm"
__version__ = "2022.04.09"

import rhinoscriptsyntax as rs
import Rhino.Geometry as rg

cv1 = []
cv2 = []
ptLst = []
for i in cvA:
    for j in cvB:
        intersect = rs.CurveCurveIntersection(i,j,-1)
        if intersect != None:
            if (intersect[0][0] == 1) & (intersect[0][5] != 1.0) & (intersect[0][5] != 0.0) & (intersect[0][7] != 0.0) & (intersect[0][7] != 1.0):
                pt = intersect[0][1]
                ptLst.append(pt)
                cv1.append(i)
                cv2.append(j)
# ---------- end python_2 ----------
python_3 = GhPythonScript(cvA=flatten(crv_3), cvB=flatten(crv_5))  # -> out, ptLst, cv1, cv2; inputs cvA: list of Curve, cvB: list of Curve; same code as python_2
srf_cp_2 = SurfaceClosestPoint(Point=python.ptLst, Surface=the_surface)  # -> Point, UVPoint, Distance
srf_cp_3 = SurfaceClosestPoint(Point=python_2.ptLst, Surface=the_surface)  # -> Point, UVPoint, Distance
srf_cp_4 = SurfaceClosestPoint(Point=python_3.ptLst, Surface=the_surface)  # -> Point, UVPoint, Distance
evalsrf_2 = EvaluateSurface(Surface=the_surface, Point=srf_cp_2.UVPoint)  # -> Point, simplify(Normal), UDirection, VDirection, Frame
evalsrf_3 = EvaluateSurface(Surface=the_surface, Point=srf_cp_3.UVPoint)  # -> Point, simplify(Normal), UDirection, VDirection, Frame
evalsrf_4 = EvaluateSurface(Surface=the_surface, Point=srf_cp_4.UVPoint)  # -> Point, simplify(Normal), UDirection, VDirection, Frame
cpta = CouplingPointAxis(
    Point=graft(python_3.ptLst),
    Curve1=graft(python_3.cv1),
    Curve2=graft(python_3.cv2),
    Axis=graft(evalsrf_4.Normal),
    CheckProximity=True)
cpta_2 = CouplingPointAxis(
    Point=graft(python_2.ptLst),
    Curve1=graft(python_2.cv1),
    Curve2=graft(python_2.cv2),
    Axis=graft(evalsrf_3.Normal),
    CheckProximity=True)
cpta_3 = CouplingPointAxis(
    Point=graft(python.ptLst),
    Curve1=graft(python.cv1),
    Curve2=graft(python.cv2),
    Axis=graft(evalsrf_2.Normal),
    CheckProximity=True)
relay = Relay([cpta_3, cpta_2, cpta])

# ---- group: snow load
Z_2 = UnitZ(Factor=Slider(1.9, range=0..10))
msnow = MeshSnowLoad(Snow=Z_2, VertexNormals=mvarea.VertexNormals, Option=False)
list_10 = ValueList({"DEAD": 1, "SNOW": 2, "PRES": 3, "PRES_FL": 4, "MOMENT": 5}, selected="DEAD")
multiplication_2 = Multiplication(A=msnow, B="0.001")
snowload = PointLoad(Point=mvarea.Vertices, Loadtype=list_10, Direction=mvarea.VertexNormals, Value=multiplication_2, LoadCase=1)

# ---- group: self load
panel_18 = Panel("""Gravity
680kg/m3 * 0.1m * 0.019m * 10N / 1000 = 6.8Kn/m3 * 0.0019m2
= 0.01292 """)
list_11 = ValueList({"DEAD": 1, "SNOW": 2, "PRES": 3, "PRES_FL": 4, "MOMENT": 5}, selected="DEAD")
crvload = CurveLoad(Crv=merge_2, Loadtype=list_11, Direction=Vector(0, 0, -1), Value="0.013", LoadCase=1)  # -> flatten(CurveLoad)

# ----
loads_2 = Merge(Data1=flatten(windload), Data2=crvload, Data3=flatten(snowload))
visopt = VisualizeOptions(
    ScaleCrossSections=1,
    ScaleSupports=1,
    ScaleLoads=Slider(0.1, range=0..0.1),
    ScaleCouplingPoints=1,
    ScaleConnectingPoints=Slider(0.71, range=0..1),
    ScaleRefinedControlPoints=1,
    ColourBeam=RGB(211, 211, 211),
    ColourCable=RGB(255, 255, 255),
    ColourSupports=RGB(232, 65, 119),
    ColourLoads=RGB(232, 65, 119),
    ColourConnects=RGB(255, 255, 255),
    ColourRefinedPatches=RGB(139, 0, 0),
    ColourSliding=RGB(135, 16, 55))
amodel = AnalysisModel(
    Analysis=nonlina,
    StructuralElements=flatten(beam),
    Supports=suppt,
    Loads=loads_2,
    Visualizer=visopt,
    IntersectionTolerance=0.01,
    IsCarat=True,
    IsKratos=False,
    PenaltyFac=10000000,
    ShowCouplingIDs=False,
    ShowEdgeIDs=False,
    ShowGeo=True,
    ShowPatchIDs=True,
    ShowPrePro=True,
    ShowRef=False,
    mUsedVersion="BETA 0.6.0")

run_analysis = IGASolver(AnalysisModel=amodel, Run=Button(), antiFreeze=False, showWindow=True)  # -> ResultModel, ErrorReport
panel_19 = Panel(run_analysis.ErrorReport)
defmod = DeformedModel(
    Model=run_analysis.ResultModel,
    LoadCase=Slider(0, range=0..10),
    ScaleFactor=Slider(1, range=1..50),
    FlyingNodeLimit=100000)  # -> Model, Geo, DeformedStructuralElements
amodel_2 = AnalysisModel(
    StructuralElements=defmod.DeformedStructuralElements,
    IntersectionTolerance=0.01,
    IsCarat=True,
    IsKratos=False,
    PenaltyFac=10000000,
    ShowCouplingIDs=False,
    ShowEdgeIDs=False,
    ShowGeo=True,
    ShowPatchIDs=True,
    ShowPrePro=True,
    ShowRef=False,
    mUsedVersion="BETA 0.6.0")
list_12 = ValueList({"N": 1, "M1": 2, "M2": 3, "Mt": 4, "V1": 5, "V2": 6, "N stress": 7, "Shear stress 1": 8, "Shear stress 2": 9, "v Mises stress": 10, "Utilization (v Mises)": 11, "Cross Section": 12}, selected="Utilization (v Mises)")
crv_6 = Curve(defmod.Geo)
_1dresview = _1DElementResultView(Model=defmod.Model, Type=list_12, ScaleFactor=Slider(0.847, range=0..1), ShowColourPlot=True)  # -> Results, ResultList, Mesh, LegendC, LegendT
legend = Legend(Colour=_1dresview.LegendC, Tags=_1dresview.LegendT, LegendType=1)

series = Series(Start=0, Step=Slider(0.05, range=0..0.1), Count=Slider(20, range=0..100))
crv_7 = Curve(flatten(crv_smooth_2))
crv_8 = Curve(defmod.Geo)
eval = EvaluateCurve(Curve=reparameterize(graft(crv_7)), Parameter=series)  # -> Point, Tangent, Angle
eval_2 = EvaluateCurve(Curve=reparameterize(graft(crv_8)), Parameter=series)  # -> Point, Tangent, Angle
dist = Distance(PointA=eval.Point, PointB=eval_2.Point)
num = Number(dist)
bnd_6 = Bounds(Numbers=num)
extremums = MinMax(Number=num)  # -> Minimum, Maximum
dedomain_6 = DeconstructDomain(Domain=bnd_6)  # -> Start, End

item_3 = ListItem(List=eval.Point, Index="18", Wrap=True)
item_4 = ListItem(List=eval_2.Point, Index="18", Wrap=True)
index = ItemIndex(List=num, Item=dedomain_6.End)
ln = Line(StartPoint=item_3, EndPoint=item_4)
panel_20 = Panel(num)
previewlw_6 = CustomPreviewLineweights(Geometry=ln, Shader=ColourSwatch(SwatchColor=RGB(245, 54, 54)), Thickness=Slider(30, range=0..30), Absolute=False)

crv_9 = Curve(crv_polyline)

crv_smooth_3 = Curve(crv_smooth)  # disabled
crv_polyline_3 = Curve(crv_polyline)  # disabled
the_surface_2 = Surface(input.Surface)  # disabled
toggle_4 = GroupToggle(ToggleActive=True, ToggleVisible=False)  # disabled
explode_4 = Explode(Curve=crv_polyline_3, Recursive=True)  # -> Segments, Vertices; disabled
graft_3 = GraftTree(Tree=crv_smooth_3, IncludeEmptyLists=True, IncludeNullItems=True)  # disabled
crv_cp_2 = CurveClosestPoint(Point=explode_4.Vertices, Curve=reparameterize(graft_3))  # -> Point, Parameter, Distance; disabled
srf_cp_5 = SurfaceClosestPoint(Point=crv_cp_2.Point, Surface=the_surface_2)  # -> Point, UVPoint, Distance; disabled
bang_2 = ExplodeTree(Data=simplify(crv_smooth_3))  # -> Branch0, Branch1, Branch2; disabled
evalsrf_5 = EvaluateSurface(Surface=the_surface_2, Point=srf_cp_5.UVPoint)  # -> Point, Normal, UDirection, VDirection, Frame; disabled
crv_10 = Curve(reparameterize(bang_2.Branch1))  # disabled
crv_11 = Curve(reparameterize(bang_2.Branch0))  # disabled
crv_12 = Curve(reparameterize(bang_2.Branch2))  # disabled
toggle_5 = BooleanToggle(True)  # disabled
width_2 = Number(0.15)  # disabled
height_2 = Number(input.Thickness)  # disabled
vec_2 = Vector(simplify(evalsrf_5.Normal))  # disabled
panel_21 = Panel("1")  # disabled
prestress_properties_2 = PrestressPropertiesBeam(L=False, AB1=toggle_5, AB2=False, AT=toggle_5, N=0, M1=0, M2=0, T=0)  # disabled
merge_3 = Merge(Data1=crv_11, Data2=crv_10, Data3=crv_12)  # disabled
section_axis_2 = SectionAxis(CurveParameter=crv_cp_2.Parameter, SectionAxis=vec_2)  # disabled
box_2 = BoxSection(Height=height_2, Width=width_2, Thickness=0)  # -> Section, Area; disabled
crvref_2 = CurveRefinement(PDeg=1, ElementRefU=panel_21, IsKnotApproxElementSize=False, IsKnotSubdivision=True)  # disabled
graft_4 = GraftTree(Tree=merge_3, IncludeEmptyLists=True, IncludeNullItems=True)  # disabled
number_slider_3 = Slider(0.71, range=0..1)  # disabled
number_slider_4 = Slider(0.1, range=0..0.1)  # disabled
toggle_6 = BooleanToggle(False)  # disabled
beam_2 = BeamElement(
    C=reparameterize(graft_4),
    M=mat_4,
    S=box_2.Section,
    R=crvref_2,
    AB=section_axis_2,
    P=prestress_properties_2,
    HS=toggle_6,
    HE=toggle_6,
    HB=toggle_6)  # disabled
visopt_2 = VisualizeOptions(
    ScaleCrossSections=1,
    ScaleSupports=1,
    ScaleLoads=number_slider_4,
    ScaleCouplingPoints=1,
    ScaleConnectingPoints=number_slider_3,
    ScaleRefinedControlPoints=1,
    ColourBeam=RGB(211, 211, 211),
    ColourCable=RGB(255, 255, 255),
    ColourSupports=RGB(232, 65, 119),
    ColourLoads=RGB(232, 65, 119),
    ColourConnects=RGB(255, 255, 255),
    ColourRefinedPatches=RGB(139, 0, 0),
    ColourSliding=RGB(135, 16, 55))  # disabled
button = Button()  # disabled
number_slider_5 = Slider(1, range=1..50)  # disabled
number_slider_6 = Slider(0, range=0..10)  # disabled
number_slider_7 = Slider(5, range=0..10)  # disabled
list_13 = ValueList({"N": 1, "M1": 2, "M2": 3, "Mt": 4, "V1": 5, "V2": 6, "N stress": 7, "Shear stress 1": 8, "Shear stress 2": 9, "v Mises stress": 10, "Utilization (v Mises)": 11, "Cross Section": 12}, selected="Utilization (v Mises)")  # disabled

# ---- group: coupling
python_4 = GhPythonScript(cvA=flatten(crv_11), cvB=flatten(crv_10))  # -> out, ptLst, cv1, cv2; inputs cvA: list of Curve, cvB: list of Curve; disabled; same code as python
python_5 = GhPythonScript(cvA=flatten(crv_11), cvB=flatten(crv_12))  # -> out, ptLst, cv1, cv2; inputs cvA: list of Curve, cvB: list of Curve; disabled; same code as python_2
python_6 = GhPythonScript(cvA=flatten(crv_10), cvB=flatten(crv_12))  # -> out, ptLst, cv1, cv2; inputs cvA: list of Curve, cvB: list of Curve; disabled; same code as python_2
srf_cp_6 = SurfaceClosestPoint(Point=python_4.ptLst, Surface=the_surface_2)  # -> Point, UVPoint, Distance; disabled
srf_cp_7 = SurfaceClosestPoint(Point=python_5.ptLst, Surface=the_surface_2)  # -> Point, UVPoint, Distance; disabled
srf_cp_8 = SurfaceClosestPoint(Point=python_6.ptLst, Surface=the_surface_2)  # -> Point, UVPoint, Distance; disabled
evalsrf_6 = EvaluateSurface(Surface=the_surface_2, Point=srf_cp_6.UVPoint)  # -> Point, simplify(Normal), UDirection, VDirection, Frame; disabled
evalsrf_7 = EvaluateSurface(Surface=the_surface_2, Point=srf_cp_7.UVPoint)  # -> Point, simplify(Normal), UDirection, VDirection, Frame; disabled
evalsrf_8 = EvaluateSurface(Surface=the_surface_2, Point=srf_cp_8.UVPoint)  # -> Point, simplify(Normal), UDirection, VDirection, Frame; disabled
cpta_4 = CouplingPointAxis(
    Point=graft(python_6.ptLst),
    Curve1=graft(python_6.cv1),
    Curve2=graft(python_6.cv2),
    Axis=graft(evalsrf_8.Normal),
    CheckProximity=True)  # disabled
cpta_5 = CouplingPointAxis(
    Point=graft(python_5.ptLst),
    Curve1=graft(python_5.cv1),
    Curve2=graft(python_5.cv2),
    Axis=graft(evalsrf_7.Normal),
    CheckProximity=True)  # disabled
cpta_6 = CouplingPointAxis(
    Point=graft(python_4.ptLst),
    Curve1=graft(python_4.cv1),
    Curve2=graft(python_4.cv2),
    Axis=graft(evalsrf_6.Normal),
    CheckProximity=True)  # disabled
relay_2 = Relay([cpta_6, cpta_5, cpta_4])  # disabled

# ---- group: support
end_2 = EndPoints(Curve=crv_smooth_3)  # -> Start, End; disabled
pt_3 = Point(flatten([end_2.Start, end_2.End]))  # disabled
pdecon_2 = Deconstruct(Point=pt_3)  # -> XComponent, YComponent, ZComponent; disabled
panel_22 = Panel("0.02")  # disabled
smaller_2 = SmallerThan(FirstNumber=pdecon_2.ZComponent, SecondNumber=panel_22)  # -> SmallerThan, OrEqualTo; disabled
dispatch_2 = Dispatch(List=pt_3, DispatchPattern=smaller_2.SmallerThan)  # -> ListA, ListB; disabled
pt_4 = Point(dispatch_2.ListA)  # disabled
suppt_2 = SupportPoint(Point=pt_4, DispX=True, DispY=True, DispZ=True, Rotation=False, Torsion=False, TryStrongSupport=True)  # disabled

# ---- group: self load
list_14 = ValueList({"DEAD": 1, "SNOW": 2, "PRES": 3, "PRES_FL": 4, "MOMENT": 5}, selected="DEAD")  # disabled
panel_23 = Panel("0.013")  # disabled
panel_24 = Panel("""Gravity
680kg/m3 * 0.1m * 0.019m * 10N / 1000 = 6.8Kn/m3 * 0.0019m2
= 0.01292 """)  # disabled
crvload_2 = CurveLoad(Crv=merge_3, Loadtype=list_14, Direction=Vector(0, 0, -1), Value=panel_23, LoadCase=1)  # -> flatten(CurveLoad); disabled

# ----
loads_3 = Merge(Data1=flatten(windload), Data2=crvload_2, Data3=flatten(snowload))  # disabled
amodel_3 = AnalysisModel(
    Analysis=lina_2,
    StructuralElements=flatten(beam_2),
    Supports=suppt_2,
    Loads=loads_3,
    Visualizer=visopt_2,
    IntersectionTolerance=0.01,
    IsCarat=True,
    IsKratos=False,
    PenaltyFac=10000000,
    ShowCouplingIDs=False,
    ShowEdgeIDs=False,
    ShowGeo=True,
    ShowPatchIDs=True,
    ShowPrePro=True,
    ShowRef=False,
    mUsedVersion="BETA 0.6.0")  # disabled
run_analysis_2 = IGASolver(AnalysisModel=amodel_3, Run=button, antiFreeze=False, showWindow=True)  # -> ResultModel, ErrorReport; disabled
defmod_2 = DeformedModel(Model=run_analysis_2.ResultModel, LoadCase=number_slider_6, ScaleFactor=number_slider_5, FlyingNodeLimit=100000)  # -> Model, Geo, DeformedStructuralElements; disabled
_1dresview_2 = _1DElementResultView(Model=defmod_2.Model, Type=list_13, ScaleFactor=number_slider_7, ShowColourPlot=True)  # -> Results, ResultList, Mesh, LegendC, LegendT; disabled
legend_2 = Legend(Colour=_1dresview_2.LegendC, Tags=_1dresview_2.LegendT, LegendType=1)  # disabled
panel_25 = Panel(run_analysis_2.ErrorReport)  # disabled

number_slider_8 = Slider(20, range=0..100)  # disabled
number_slider_9 = Slider(0.05, range=0..0.1)  # disabled
crv_13 = Curve(flatten(crv_smooth_3))  # disabled
series_2 = Series(Start=0, Step=number_slider_9, Count=number_slider_8)  # disabled
crv_14 = Curve(defmod_2.Geo)  # disabled
eval_3 = EvaluateCurve(Curve=reparameterize(graft(crv_13)), Parameter=series_2)  # -> Point, Tangent, Angle; disabled
eval_4 = EvaluateCurve(Curve=reparameterize(graft(crv_14)), Parameter=series_2)  # -> Point, Tangent, Angle; disabled
dist_2 = Distance(PointA=eval_3.Point, PointB=eval_4.Point)  # disabled
num_2 = Number(dist_2)  # disabled
extremums_2 = MinMax(Number=flatten(num_2))  # -> Minimum, Maximum; disabled
panel_26 = Panel(num_2)  # disabled
panel_27 = Panel(extremums_2.Maximum)  # disabled
bnd_7 = Bounds(Numbers=num_2)  # disabled
panel_28 = Panel("18")  # disabled
dedomain_7 = DeconstructDomain(Domain=bnd_7)  # -> Start, End; disabled
item_5 = ListItem(List=eval_3.Point, Index=panel_28, Wrap=True)  # disabled
item_6 = ListItem(List=eval_4.Point, Index=panel_28, Wrap=True)  # disabled
index_2 = ItemIndex(List=num_2, Item=dedomain_7.End)  # disabled
number_slider_10 = Slider(30, range=0..30)  # disabled
ln_2 = Line(StartPoint=item_5, EndPoint=item_6)  # disabled
swatch = ColourSwatch(SwatchColor=RGB(245, 54, 54))  # disabled
previewlw_7 = CustomPreviewLineweights(Geometry=ln_2, Shader=swatch, Thickness=number_slider_10, Absolute=False)  # disabled

# ---- group: Karamba
bang_3 = ExplodeTree(Data=crv_9)  # -> Branch0, Branch1, Branch2
toggle_7 = GroupToggle(ToggleActive=True, ToggleVisible=False)  # disabled
crv_15 = Curve(bang_3.Branch2)
panel_29 = Panel("""0
1""")
cull = CullPattern(List=crv_15, CullPattern=invert(panel_29))
cull_2 = CullPattern(List=crv_15, CullPattern=panel_29)
mesh_2 = Mesh(input.TrimmedMesh)
crv_16 = Curve(bang_3.Branch0)
crv_17 = Curve(bang_3.Branch1)

entwine = Entwine(Branch00=crv_16, Branch01=crv_17, Branch02=cull_2, FlattenInputs=True)
explode_5 = Explode(Curve=entwine, Recursive=True)  # -> Segments, Vertices
multiplication_3 = Multiplication(A=input.Thickness, B="100")
multiplication_4 = Multiplication(A=input.Width, B="100")
trim = TrimTree(Tree=explode_5.Segments, Depth=1)
cross_section = CrossSectionKaramba3D(
    FamilyNameOfCrossSection="DefaultCroSec",
    Material=matprops_2,
    Height_cm=multiplication_3,
    UpperFlangeWidth_cm=multiplication_4,
    LowerFlangeWidth_cm=multiplication_4,
    mode="Trapezoid")  # -> flatten(CrossSection)
midpt = CurveMiddle(Curve=trim)
meshcp = MeshClosestPoint(Point=midpt, Mesh=mesh_2)  # -> Point, Index, Parameter
meval = MeshEval(Mesh=mesh_2, Parameter=meshcp.Parameter)  # -> Point, Normal, Colour
panel_30 = Panel("""dir1a
dir2a
dir3a""")
linetobeam = LineToBeamKaramba3D(
    Line=trim,
    Identifier=graft(panel_30),
    CrossSection=cross_section,
    New=True,
    Remove=True,
    LimitDistance_m=0.005,
    ZOrientation=meval.Normal,
    Bending=True,
    SetBucklingLength=True,
    ToPolylineMaxAngle=0.03,
    ToPolylineTolerance=0.01,
    ToPolylineMinEdgeLength=0.25)  # -> Element, Points, Info

number_slider_11 = Slider(13, range=0..40)
multiplication_5 = Multiplication(A=multiplication_3, B="2")  # disabled
explode_6 = Explode(Curve=cull, Recursive=True)  # -> Segments, Vertices
trim_2 = TrimTree(Tree=explode_6.Segments, Depth=1)
cross_section_2 = CrossSectionKaramba3D(
    FamilyNameOfCrossSection="DefaultCroSec",
    Material=matprops_2,
    Height_cm=multiplication_5,
    UpperFlangeWidth_cm=number_slider_11,
    LowerFlangeWidth_cm=number_slider_11,
    mode="Trapezoid")  # -> flatten(CrossSection)
midpt_2 = CurveMiddle(Curve=trim_2)
meshcp_2 = MeshClosestPoint(Point=midpt_2, Mesh=mesh_2)  # -> Point, Index, Parameter
meval_2 = MeshEval(Mesh=mesh_2, Parameter=meshcp_2.Parameter)  # -> Point, Normal, Colour
panel_31 = Panel("""dir1b
dir2b
dir3b""")
linetobeam_2 = LineToBeamKaramba3D(
    Line=trim_2,
    Identifier=graft(panel_31),
    CrossSection=cross_section_2,
    New=True,
    Remove=True,
    LimitDistance_m=0.005,
    ZOrientation=meval_2.Normal,
    Bending=True,
    SetBucklingLength=True,
    ToPolylineMaxAngle=0.03,
    ToPolylineTolerance=0.01,
    ToPolylineMinEdgeLength=0.25)  # -> Element, Points, Info

entwine_2 = Entwine(Branch00=linetobeam.Element, Branch01=linetobeam_2.Element, FlattenInputs=True)

direction = Slider(0, range=0..2)
pi_2 = Pi(Factor=direction)
X_2 = UnitX(Factor=1)
Z_3 = UnitZ(Factor=1)
facen = FaceNormals(Mesh=mesh_2)  # -> Centers, Normals
vrot_2 = Rotate(Vector=X_2, Axis=Z_3, Angle=pi_2)
nv = NakedVertices(Mesh=mesh_2)  # -> ClothedIndex, NakedIndex, ClothedPts, NakedPts
devec = DeconstructVector(Vector=unitize(facen.Normals))  # -> XComponent, YComponent, ZComponent
amp_2 = Amplitude(Vector=vrot_2, Amplitude=Slider(0.53, range=0..1))
pmesh_2 = PlanktonMesh(mesh_2)
mvarea_2 = MeshVertexArea(PlanktonMesh=pmesh_2)  # -> Vertices, VertexNormals
number_slider_12 = Slider(-1.9, range=-2..0)
pt_5 = Point(nv.NakedPts)
multiplication_6 = Multiplication(A=amp_2, B=Slider(0.5, range=0..1))
abs = Absolute(Value=devec.ZComponent)
pdecon_3 = Deconstruct(Point=pt_5)  # -> XComponent, YComponent, ZComponent
mwind_2 = MeshWindLoad(Wind=multiplication_6, VertexNormals=mvarea_2.VertexNormals, Option=Toggle(True))
larger = LargerThan(FirstNumber=pdecon_3.ZComponent, SecondNumber="0.25")  # -> LargerThan, OrEqualTo
multiplication_7 = Multiplication(A=mwind_2, B="0.001")
cull_3 = CullPattern(List=pt_5, CullPattern=invert(larger.LargerThan))
supp = SupportKaramba3D(PosInd=cull_3, menu=[buttons(on, on, on, off, off, off)])  # -> flatten(Support)
multiplication_8 = Multiplication(A=multiplication_7, B=3)
vdisex_3 = VectorDisplayEx(Point=mvarea_2.Vertices, Vector=multiplication_8, Colour=ColourSwatch(SwatchColor=RGB(8, 125, 138)), Width=2)

# ----
abs_2 = Absolute(Value=devec.XComponent)
abs_3 = Absolute(Value=devec.YComponent)
addition = Addition(A=abs_2, B=abs_3)
multiplication_9 = Multiplication(A=number_slider_12, B=Slider(0.7, range=0..1))

# ---- group: Karamba (continued)
larger_2 = LargerThan(FirstNumber=abs, SecondNumber=addition)  # -> LargerThan, OrEqualTo
cullf = CullFaces(Mesh=mesh_2, Pattern=invert(larger_2.LargerThan))
Z_4 = UnitZ(Factor=multiplication_9)
loads_4 = LoadsKaramba3D(Vector=Z_4, Mesh=cullf, LCase="0", mode="MeshLoad -Const.", menu=[buttons(off, off, on), buttons(on, on)])  # -> flatten(Load)

# ---- group: Karamba / Loads (Karamba3D)
loads_5 = LoadsKaramba3D(ForceVector=multiplication_7, Local=False, PosInd=mvarea_2.Vertices, LCase="0", mode="Point")  # -> flatten(Load)

# ---- group: Karamba / Assemble Model (Karamba3D)
assemble = AssembleModelKaramba3D(Elem=flatten(entwine_2), Support=flatten(supp), Load=flatten([loads, loads_4, loads_5]), LimitDistance_m=0.005)  # -> Model, Info, Mass_kg, CenterOfGravity, LoadCaseNames

# ---- group: Karamba (continued)
analyze = AnalyzeKaramba3D(Model=assemble.Model)  # -> CalculatedModel, MaximumDisplacement_cm, ResultingForceOfGravity_kN, ElasticEnergyChange_kNm
num_3 = Number(flatten(assemble.Mass_kg))
panel_32 = Panel(analyze.MaximumDisplacement_cm)
panel_33 = Panel(num_3)
modelview = ModelViewKaramba3D(Model=analyze.CalculatedModel, ResultFactors=1, ResultCase=-1)  # -> Model, DeformedMesh, DeformedAxes, DeformedModel

# ---- group: Karamba / Beam View (Karamba3D)
beamview = BeamViewKaramba3D(Model=modelview.Model)  # -> Model, MeshesOfRenderedBeams, DeformedBeamAxes, LegendColors, LegendTags

# ---- group: Karamba (continued)
legend_3 = Legend(Colour=beamview.LegendColors, Tags=beamview.LegendTags, LegendType=1)

# ---- group: Text
panel_34 = Panel(analyze.MaximumDisplacement_cm)
panel_35 = Panel(beamview.LegendTags)
roundd = RoundToDecimalPlace(NumberX=panel_34, DecimalPlace=1, RoundType=0)  # -> Rounded, Difference
number_slider_13 = Slider(20, range=0..100)
gradient_6 = Gradient(LowerLimit=0, UpperLimit="20", Parameter=panel_34, stops=[0: RGB(0, 128, 0), 0.5: RGB(255, 255, 0), 1: RGB(255, 0, 0)])
lng = ListLength(List=panel_35)
series_3 = Series(Start=Slider(484, range=0..900), Step=Slider(20, range=0..20), Count=lng)
concat = Concatenate(FragmentA=roundd.Rounded, FragmentB=" cm")
vec_3 = VectorXYZ(XComponent=Slider(61, range=0..900), YComponent=Slider(173, range=0..900), ZComponent=0)  # -> Vector, Length
vec_4 = VectorXYZ(XComponent=Slider(51, range=0..900), YComponent=series_3, ZComponent=0)  # -> Vector, Length
vec_5 = VectorXYZ(XComponent=Slider(61, range=0..900), YComponent=Slider(202, range=0..900), ZComponent=0)  # -> Vector, Length
texttoscreen = RenderTextToScreen(
    Text=graft("Max displacement:"),
    Location=graft(vec_3.Vector),
    Size=number_slider_13,
    Color=RGB(0, 0, 0),
    m_scWithvp=False)
texttoscreen_2 = RenderTextToScreen(Text=graft(panel_35), Location=graft(vec_4.Vector), Size=12, Color=RGB(0, 0, 0), m_scWithvp=False)
texttoscreen_3 = RenderTextToScreen(Text=graft(concat), Location=graft(vec_5.Vector), Size=number_slider_13, Color=gradient_6, m_scWithvp=False)

# ----
mesh_3 = Mesh(beamview.MeshesOfRenderedBeams)  # disabled
