# Grasshopper definition 2022_06_10_3waygeodesic_GroundDetails_JW.gh (Grasshopper 1.0.7)
# plug-ins: Kangaroo2 Components, OpenNest, Pufferfish, Heteroptera, MeshEdit Components, EleFront, MetaHopper, Pancake

input = DataInput(
    Destination="Z:\Desktop\MPDA\s2\s2_3ways\s2_3ways\2022_06_01_3wayGeodesics_Formfinding_Data.ghdata",
    RelativePath="Z:\Desktop\MPDA\s2\s2_3ways\s2_3ways\2022_06_01_3wayGeodesics_Formfinding_Data.ghdata|file:\\\Z:\Desktop\MPDA\s2\s2_3ways\s2_3ways\2022_06_01_3wayGeodesics_Formfinding_Data.ghdata",
    UpdateDelay=50000)  # -> UntrimmedMesh, Surface, TrimmedMesh, MeshTrimmedLines, Thickness, Width
crv = Curve(input.MeshTrimmedLines)
nv = NakedVertices(Mesh=input.TrimmedMesh)  # -> ClothedIndex, NakedIndex, ClothedPts, NakedPts
geo = Geometry(nv.NakedPts)
medges = MeshEdges(Mesh=input.TrimmedMesh)  # -> NakedEdges, InteriorEdges, NonManifoldEdges
pdecon = Deconstruct(Point=geo)  # -> XComponent, YComponent, ZComponent
smaller = SmallerThan(FirstNumber=pdecon.ZComponent, SecondNumber=Slider(0.15, range=0..1))  # -> SmallerThan, OrEqualTo
crv_2 = Curve(medges.NakedEdges)
division = Division(A=input.Thickness, B="2")
join = JoinCurves(Curves=crv_2, Preserve=False)
cull = CullPattern(List=geo, CullPattern=smaller.SmallerThan)
subtraction = Subtraction(A="-0.06", B=division)
alongcrv = SortAlongCurve(Points=cull, Curve=join)  # -> Points, Indices
offmsh = OffsetMesh(Mesh=input.TrimmedMesh, Distance=expr("-x", subtraction), BothSides=0, CreateSolid=invert(True))
shift = ShiftList(List=alongcrv.Points, Shift=1, Wrap=True)
xy = XYPlane(Origin=Point(0, 0, 0))
project = Project(Geometry=shift, Plane=xy)  # -> Geometry, Transform
points = PointList(Points=shift)  # disabled
pgroups = PointGroups(Points=project.Geometry, Distance=Slider(3.3, range=0..10))  # -> Groups, Indices
meshcp = MeshClosestPoint(Point=pgroups.Groups, Mesh=offmsh)  # -> Point, Index, Parameter
meval = MeshEval(Mesh=offmsh, Parameter=meshcp.Parameter)  # -> Point, Normal, Colour

# ---- group: make Z value same
pdecon_2 = Deconstruct(Point=meval.Point)  # -> XComponent, YComponent, ZComponent
avr = Average(Input=flatten(pdecon_2.ZComponent))
pt = ConstructPoint(XCoordinate=pdecon_2.XComponent, YCoordinate=pdecon_2.YComponent, ZCoordinate=avr)

# ---- group: membrane end point
num = Number(input.Thickness)
vec = Vector(meval.Normal)
multiplication = Multiplication(A=Slider(9, range=0..10), B=num)
amp = Amplitude(Vector=expr("-x", vec), Amplitude=multiplication)
move = Move(Geometry=pgroups.Groups, Motion=amp)  # -> Geometry, Transform

# ----
pt_2 = Point(pgroups.Groups)
xy_2 = XYPlane(Origin=Point(0, 0, 0))
Y = UnitY(Factor=1)
rectangle = Rectangle(Plane=PlaneXY(0, 0, 0), XSize=Domain(-1, 1), YSize=Domain(-2, 2), Radius=0)  # -> Rectangle, Length
sheets = Sheets()
offset = OffsetCurve(Curve=rectangle.Rectangle, Distance=expr("-x", Slider(0.005, range=0..0.01)), Corners=1)  # -> flatten(Curve)
sort = SortList(Keys=offset, ValuesA=offset)  # -> Keys, ValuesA
panel = Panel("""Cut
0
page
Bending/Folding
Engraving""")
item = ListItem(List=sort.ValuesA, Index=0, Wrap=True)
merge = Merge(Data1=rectangle.Rectangle, Data2=item)
_0 = Relay()
col = Colour([RGB(255, 255, 0), RGB(255, 255, 255), RGB(255, 0, 255), RGB(255, 0, 0), RGB(0, 255, 0)])
txt = Text(panel)
legend = Legend(Colour=col, Tags=txt, LegendType=1)

# ---- group: Edit this fields
panel_2 = Panel("3waygeodesic")

# ----
attributes = DefineObjectAttributes(Layer=graft(txt), Color=graft(col))
pcghfilepath = DefinitionPath(LastSaveLocalization="neutral,N")  # -> Directory, Name, DirectorySeparator
concat = Concatenate(FragmentA=panel_2, FragmentB="_", FragmentD="_")
concat_2 = Concatenate(FragmentA=pcghfilepath.Directory, FragmentB=pcghfilepath.DirectorySeparator, FragmentC=concat)
truebutton = TrueOnlyButton(LastSaveLocalization="neutral,N")
panel_3 = Panel(concat_2)
panel_4 = Panel("bake to rhino")
panel_5 = Panel("export to autocad")

# ---- group: L Plates
addition = Addition(A=input.Width, B=Slider(0.07, range=0..0.1))
domsym = DomainSymmetric(Length=addition, Base=0)

# ----
Z = UnitZ(Factor=1)
xprod = CrossProduct(VectorA=meval.Normal, VectorB=Z, Unitize=False)  # -> Vector, Length
pl = ConstructPlane(Origin=pt, XAxis=meval.Normal, YAxis=xprod.Vector)
deplane = DeconstructPlane(Plane=pl)  # -> Origin, XAxis, YAxis, ZAxis
number_slider = Slider(11, range=0..16)

# ---- group: Plane 1
pl_2 = ConstructPlane(Origin=pt, XAxis=expr("-x", deplane.ZAxis), YAxis=xprod.Vector)

# ---- group: L Plates (continued)
amp_2 = Amplitude(Vector=deplane.ZAxis, Amplitude=Slider(0.1, range=0..1))
rectangle_2 = Rectangle(Plane=pl_2, XSize=Slider(0.25, range=0..1), YSize=domsym, Radius=0)  # -> Rectangle, Length
move_2 = Move(Geometry=rectangle_2.Rectangle, Motion=amp_2)  # -> Geometry, Transform
deplane_2 = DeconstructPlane(Plane=move_2.Geometry)  # -> Origin, XAxis, YAxis, ZAxis
pl_3 = ConstructPlane(Origin=deplane_2.Origin, XAxis=deplane_2.XAxis, YAxis=deplane_2.YAxis)
projecta = ProjectAlong(Geometry=pgroups.Groups, Plane=pl_3, Direction=deplane_2.ZAxis)  # -> Geometry, Transform

# ----
pln = Plane(move_2.Geometry)

deplane_3 = DeconstructPlane(Plane=pl_2)  # -> Origin, XAxis, YAxis, ZAxis
project_2 = Project(Geometry=deplane_3.XAxis, Plane=PlaneXY(0, 0, 0))  # -> Geometry, Transform
rev = Reverse(Vector=project_2.Geometry)

# ---- group: L Plates (continued)
pl_4 = ConstructPlane(Origin=deplane_2.Origin, XAxis=rev, YAxis=xprod.Vector)

# ---- group: get angles
angle = Angle(VectorA=deplane_3.XAxis, VectorB=rev)  # -> Angle, Reflex

# ----
deg = Degrees(Radians=angle.Angle)
subtraction_2 = Subtraction(A=Slider(180, range=0..1000), B=deg)
panel_6 = Panel(deg)
roundd = RoundToDecimalPlace(NumberX=deg, DecimalPlace="2", RoundType=0)  # -> Rounded, Difference

# ---- group: check
item_2 = ListItem(List=flatten(deplane_3.Origin), Index=number_slider, Wrap=True)
item_3 = ListItem(List=flatten(deplane_3.XAxis), Index=number_slider, Wrap=True)
item_4 = ListItem(List=flatten(project_2.Geometry), Index=number_slider, Wrap=True)
vdis = VectorDisplay(Anchor=item_2, Vector=[item_3, item_4])

# ----
vec_2 = Vector(deplane_3.XAxis)
amp_3 = Amplitude(Vector=expr("-x", vec_2), Amplitude=Slider(0.242, range=0..0.5))
move_3 = Move(Geometry=move.Geometry, Motion=amp_3)  # -> Geometry, Transform

# ---- group: L Plates
dom = ConstructDomain(DomainStart=expr("-x", Slider(0.099, range=0..0.1)), DomainEnd="0")
number_slider_2 = Slider(0.005, range=0..0.1)
rectangle_3 = Rectangle(Plane=pl_4, XSize=Slider(0.13, range=0..1), YSize=domsym, Radius=0)  # -> Rectangle, Length
pt_orignal_membrane_connection_plane = PtOrignalMembraneConnectionPlane(C=rectangle_3.Rectangle)
pln_2 = Plane(pl)
pl_origin = PlaneOrigin(Base=pln_2, Origin=pt_orignal_membrane_connection_plane)
membrane_connection = Rectangle(Plane=pl_origin, XSize=dom, YSize=domsym, Radius=0)  # -> Rectangle, Length
circle = CircleCNR(Center=projecta.Geometry, Normal=deplane_2.ZAxis, Radius=number_slider_2)
merge_2 = Merge(Data1=simplify(move_2.Geometry), Data2=simplify(rectangle_3.Rectangle))
boundary = BoundarySurfaces(Edges=[circle, move_2.Geometry])
edges = BrepEdges(Brep=boundary)  # -> Naked, Interior, NonManifold
geo_2 = Geometry(edges.Naked)
item_5 = ListItem(List=geo_2, Index=Slider(3, range=0..4), Wrap=True)
join_2 = BrepJoin(Breps=merge_2)  # -> Breps, Closed
smesh = SimpleMesh(Brep=join_2.Breps)
offmsh_2 = OffsetMesh(Mesh=smesh, Distance=Slider(0.005, range=0..0.01), BothSides=0, CreateSolid=True)

# ---- group: L Plates / rec_screw
offset_2 = OffsetCurve(Curve=rectangle_3.Rectangle, Distance=expr("-x", Slider(0.03, range=0..0.1)), Corners=1)
explode = Explode(Curve=offset_2, Recursive=True)  # -> Segments, Vertices
pshift = ShiftPaths(Data=explode.Vertices, Offset=-1)

# ---- group: Ground beam
item_6 = ListItem(List=pt, Index=0, Wrap=True)  # -> Item1, Item, Item1_2
arc = Arc3Pt(PointA=item_6.Item, PointB=item_6.Item1_2, PointC=item_6.Item1)  # -> Arc, Plane, Radius
item_7 = ListItem(List=flatten(pl_4), Index=0, Wrap=True)
project_3 = Project(Geometry=arc.Arc, Plane=item_7)  # -> Geometry, Transform
number_slider_3 = Slider(0.35, range=0..1)
offset_3 = OffsetCurve(Curve=project_3.Geometry, Distance=Slider(0.05, range=0..0.1), Corners=1)
xy_3 = XYPlane(Origin=Point(0, 0, 0))
ext = ExtendCurve(Curve=offset_3, Type=1, Start=number_slider_3, End=number_slider_3)
neg = Negative(Value=Slider(0.35, range=0..1))
offset_4 = OffsetCurve(Curve=ext, Distance=neg, Plane=xy_3, Corners=1)
merge_3 = Merge(Data1=simplify(ext), Data2=simplify(offset_4))
partition = PartitionList(List=flatten(merge_3), Size="2")
loft = Loft(Curves=merge_3, Options={Adjust=False, Closed=False, LoftEnds=0, LoftSimp=0, LoftType=0, Rebuild=10, Refit=0.01})
edges_2 = BrepEdges(Brep=loft)  # -> Naked, Interior, NonManifold
cir = Circle(Plane=pshift, Radius=number_slider_2)
merge_4 = Merge(Data1=simplify(cir), Data2=simplify(edges_2.Naked))

# ----
rec = Rectangle(simplify(graft(rectangle_3.Rectangle)))
cir_2 = Circle(Plane=pshift, Radius=number_slider_2)  # -> simplify(Circle)

# ---- group: Ground beam
thickness_of_ground_beams = Slider(0.06, range=0..1)
boundary_2 = BoundarySurfaces(Edges=merge_4)
Z_2 = UnitZ(Factor=thickness_of_ground_beams)
extr = Extrude(Base=boundary_2, Direction=expr("-x", Z_2))

# ----
midpt = CurveMiddle(Curve=item_5)

crv_3 = Curve(simplify(offset_4))
area = MeshArea(Mesh=input.TrimmedMesh)  # -> Area, Centroid
midpt_2 = CurveMiddle(Curve=crv_3)
xy_4 = XYPlane(Origin=Point(0, 0, 0))
project_4 = Project(Geometry=area.Centroid, Plane=xy_4)  # -> Geometry, Transform
project_5 = Project(Geometry=midpt_2, Plane=xy_4)  # -> Geometry, Transform
end = EndPoints(Curve=crv_3)  # -> Start, End
ln = Line(StartPoint=project_4.Geometry, EndPoint=project_5.Geometry)

project_6 = Project(Geometry=[rec, cir_2], Plane=PlaneXY(0, 0, 0))  # -> Geometry, Transform
project_7 = Project(Geometry=rec, Plane=PlaneXY(0, 0, 0))  # -> Geometry, Transform
project_8 = Project(Geometry=cir_2, Plane=PlaneXY(0, 0, 0))  # -> Geometry, Transform

# ---- group: unrolled plates with holes
rot3d = Rotate3D(Geometry=graft(boundary), Angle=graft(degrees(subtraction_2)), Center=midpt, Axis=item_5)  # -> Geometry, Transform
boundary_3 = BoundarySurfaces(Edges=project_6.Geometry)
pshift_2 = ShiftPaths(Data=rot3d.Geometry, Offset=-1)
project_9 = Project(Geometry=pshift_2, Plane=PlaneXY(0, 0, 0))  # -> simplify(graft(Geometry)), Transform
join_3 = BrepJoin(Breps=[project_9.Geometry, boundary_3])  # -> Breps, Closed

# ----
rdiff = RegionDifference(CurvesA=project_7.Geometry, CurvesB=project_8.Geometry)

ln_2 = Line(StartPoint=project_4.Geometry, EndPoint=end.Start)
ln_3 = Line(StartPoint=project_4.Geometry, EndPoint=end.End)
ln_4 = Line(StartPoint=end.Start, EndPoint=end.End)

geo_3 = Geometry(extr)
srf = Surface(flatten(merge_2))
panel_7 = Panel(join_3.Breps)
unroller = Unroller(Strip=smesh, Unroll=1)
join_4 = BrepJoin(Breps=srf)  # -> Breps, Closed
pshift_3 = ShiftPaths(Data=project_9.Geometry, Offset=-1)

panel_8 = Panel("Template Millimeter Large")  # disabled
toggle = GroupToggle(ToggleActive=True, ToggleVisible=False)  # disabled
number_slider_4 = Slider(0.5, range=0..1)  # disabled
panel_9 = Panel("2")  # disabled
shift_2 = ShiftList(List=end.End, Shift=panel_9, Wrap=True)  # disabled
neg_2 = Negative(Value=number_slider_4)  # disabled
lineardim = DefineLinearDimension(Point1=project_4.Geometry, Point2=end.End, Offset=number_slider_4, DimensionStyle=panel_8)  # disabled
lineardim_2 = DefineLinearDimension(Point1=project_4.Geometry, Point2=end.Start, Offset=number_slider_4, DimensionStyle=panel_8)  # disabled
lineardim_3 = DefineLinearDimension(Point1=end.Start, Point2=shift_2, Offset=neg_2, DimensionStyle=panel_8)  # disabled
lineardim_4 = DefineLinearDimension(Point1=end.Start, Point2=end.End, Offset=neg_2, DimensionStyle=panel_8)  # disabled

transform = Transform(rot3d.Transform)
unroll = Unroll(MeshOrBrep=join_4.Breps)  # -> Brep, Curves, Points, TextDotsLocation, TextDots
panel_10 = Panel(smesh)
pshift_4 = ShiftPaths(Data=join_3.Breps, Offset=-1)
transform_2 = Transform(Geometry=graft(pln), Transform=transform)
transform_3 = Transform(project_9.Transform)
pshift_5 = ShiftPaths(Data=transform_2, Offset=-1)
transform_4 = Transform(Geometry=pshift_5, Transform=transform_3)

number_slider_5 = Slider(0.9, range=0..1)  # disabled
panel_11 = Panel("2")  # disabled
shift_3 = ShiftList(List=end.End, Shift=panel_11, Wrap=True)  # disabled
angulardim = DefineAngularDimension(Origin=project_4.Geometry, Point1=shift_3, Point2=end.Start, Offset=number_slider_5, DimensionStyle=panel_8)  # disabled
angulardim_2 = DefineAngularDimension(Origin=project_4.Geometry, Point1=end.Start, Point2=end.End, Offset=number_slider_5, DimensionStyle=panel_8)  # disabled

flippln = FlipPlane(Plane=transform_4, FlipX=False, FlipY=False, FlipZ=True)  # -> Flipped, R
pack = PackObjects(Geo=flatten(unroll.Brep), Plane=xy_2, X=1, Y=1, Tolerabce=0)  # -> Geo, Transformation
opennest = OpenNest(Geo=unroll.Brep, Spacing=1, Placement=1, Tolerance=0.1, Rotations=4, Iterations=1, Seed=1, Reset=True, Run=False)  # -> Sheets, Geo, ID, Transform, IDS
panel_12 = Panel(pack.Transformation)
deplane_4 = DeconstructPlane(Plane=flippln.Flipped)  # -> Origin, XAxis, YAxis, ZAxis
angle_2 = Angle(VectorA=Y, VectorB=deplane_4.XAxis)  # -> simplify(graft(Angle)), Reflex

# ---- group: sub surface 01
panel_13 = Panel("""3
2
2""")
div = DivideDomain(Domain=Domain(0, 1), Count=graft(panel_13))
dedomain = DeconstructDomain(Domain=div)  # -> Start, End
cluster = Cluster(L=dedomain.Start)
dom² = ConstructDomain²(DomainU=Domain(0, 1), DomainV=div)
consec = ConsecutiveDomains(Numbers=cluster, Additive=False)
dom²_2 = ConstructDomain²(DomainU=Domain(0, 1), DomainV=consec)
subsrf = Isotrim(Surface=reparameterize(loft), Domain=dom²)
subsrf_2 = Isotrim(Surface=reparameterize(loft), Domain=dom²_2)

# ----
center = Center(Geometric=join_3.Breps)  # -> Center, Dimension
vec_3 = Vector(simplify(graft(deplane_4.YAxis)))
brep = Brep(join_3.Breps)
rotate = RotateDirection(Geometry=join_3.Breps, Center=center.Center, From=vec_3, To=Vector(0, 1, 0))  # -> Geometry, Transform
area_2 = Area(Geometry=subsrf)  # -> Area, Centroid
geo_4 = Geometry(flatten(subsrf))
opennest_2 = OpenNest(
    Sheets=rectangle.Rectangle,
    Geo=flatten(rotate.Geometry),
    Spacing=Slider(0.02, range=0..0.1),
    Placement=1,
    Tolerance=0.01,
    Rotations=1,
    Iterations=Slider(12, range=0..100),
    Seed=1,
    Reset=Button(),
    Run=Toggle(False))  # -> Sheets, Geo, ID, Transform, IDS
text = Text(Location=area_2.Centroid, Size=1)
project_10 = Project(Geometry=geo_4, Plane=PlaneXY(0, 0, 0))  # -> Geometry, Transform
edges_3 = BrepEdges(Brep=project_10.Geometry)  # -> Naked, Interior, NonManifold
unflatten = UnflattenTree(Tree=opennest_2.Transform, Guide=rotate.Geometry)
edges_4 = BrepEdges(Brep=opennest_2.Geo)  # -> Naked, Interior, NonManifold
join_5 = JoinCurves(Curves=edges_3.Naked, Preserve=False)
explode_2 = Explode(Curve=join_5, Recursive=True)  # -> Segments, Vertices
crv_4 = Curve(edges_4.Interior)
crv_5 = Curve(edges_4.Naked)
pline = PolyLine(Vertices=explode_2.Vertices, Closed=True)  # -> flatten(Polyline)
crv_6 = Curve(flatten(join_5))
opennest_3 = OpenNest(
    Sheets=sheets,
    Geo=flatten(join_5),
    Spacing=Slider(0.01, range=0..0.01),
    Placement=Slider(1, range=0..2),
    Tolerance=0.001,
    Rotations=Slider(72, range=0..1000),
    Iterations=Slider(0, range=0..1000),
    Seed=1,
    Reset=Button(),
    Run=Toggle(False))  # -> Sheets, Geo, ID, Transform, IDS

# ---- group: names
md_slider = MDSlider(
    SliderMode=0,
    slider_value=Point(0.9143676758, 0.7452278137, 0.5),
    x_domain=Domain(-1, 1),
    y_domain=Domain(-1, 1),
    z_domain=Domain(0, 1))
md_slider_2 = MDSlider(
    SliderMode=0,
    slider_value=Point(0.5602416992, 0.6207771301, 0.5),
    x_domain=Domain(-1, 1),
    y_domain=Domain(-1, 1),
    z_domain=Domain(0, 1))
lng = ListLength(List=pt)
number_slider_6 = Slider(0.02, range=0..1)
series = Series(Start=0, Step=1, Count=simplify(lng))
panel_14 = Panel("""C
B
A""")
concat_3 = Concatenate(FragmentA=series, FragmentB=graft(panel_14))
evalsrf = EvaluateSurface(Surface=reparameterize(pshift_3), Point=md_slider)  # -> Point, Normal, UDirection, VDirection, Frame
evalsrf_2 = EvaluateSurface(Surface=reparameterize(pshift_3), Point=md_slider_2)  # -> Point, Normal, UDirection, VDirection, Frame

# ----
pl_origin_2 = PlaneOrigin(Base=flippln.Flipped, Origin=evalsrf_2.Point)
pl_origin_3 = PlaneOrigin(Base=flippln.Flipped, Origin=evalsrf.Point)

# ---- group: names (continued)
text_2 = Text(Location=simplify(pl_origin_3), Text=concat_3, Size=number_slider_6)  # -> simplify(Curves)
text_3 = Text(Location=simplify(pl_origin_2), Text=roundd.Rounded, Size=number_slider_6)  # -> simplify(Curves)

# ----
relay = Relay([text_2, text_3, join_3.Breps])
group = Group(Objects=relay)  # -> flatten(Group)
geo_5 = Geometry(text_3)
geo_6 = Geometry(text_2)
transform_5 = Transform(Geometry=geo_5, Transform=rotate.Transform)
transform_6 = Transform(Geometry=geo_6, Transform=rotate.Transform)
transform_7 = Transform(Geometry=transform_5, Transform=unflatten)
transform_8 = Transform(Geometry=transform_6, Transform=unflatten)

# ---- group: geometry goes here
engraving = Relay([transform_8, transform_7])

# ----
entwine = Entwine(
    Branch00=flatten(crv_5),
    Branch01=flatten(_0),
    Branch02=flatten(merge),
    Branch03=flatten(crv_4),
    Branch04=flatten(engraving),
    FlattenInputs=True)
tstat = TreeStatistics(Tree=entwine)  # -> Paths, Length, Count
repeat = RepeatData(Data=attributes, Length=graft(tstat.Length))
pcexportas = ExportAs(
    Geometry=flatten(entwine),
    ObjectAttributes=flatten(repeat),
    FileLocation=concat_2,
    Overwrite=Toggle(True),
    Export=truebutton,
    CompMode=False,
    LastSaveLocalization="neutral,N")  # -> OK, ExportCommand
bake = BakeObjects(Geometry=entwine, Attributes=attributes, BakeName="bake2d", Bake=False)

# ==== cluster Cluster
L = ClusterInput()
ins = InsertItems(List=L, Item="1", Indices=-1, Wrap=True)  # -> simplify(List)
shift = ShiftList(List=ins, Shift=1, Wrap=False)  # -> simplify(List)
num = Number(graft(ins))
ins_2 = InsertItems(List=shift, Item="1", Indices=-1, Wrap=True)  # -> simplify(graft(List))
addition = Addition(A=num, B=ins_2)
num_2 = Number(expr("x/2", addition))
pshift = ShiftPaths(Data=num_2, Offset=-1)
stagged_t = InsertItems(List=pshift, Item="0", Indices=0, Wrap=True)
L_2 = ClusterOutput(stagged_t)

# ==== cluster Sheets

# ---- group: sheets
series = Series(Start="1.51", Step="1.51", Count=10)
X = UnitX(Factor=series)
rectangle = Rectangle(Plane=PlaneXY(0, 0, 0), XSize="1.51", YSize="3.03", Radius=0)  # -> Rectangle, Length
move = Move(Geometry=rectangle.Rectangle, Motion=X)  # -> Geometry, Transform

# ----
G = ClusterOutput(move.Geometry)

# ==== cluster PtOrignalMembraneConnectionPlane
C = ClusterInput()
explode = Explode(Curve=C, Recursive=True)  # -> Segments, Vertices
item = ListItem(List=explode.Segments, Index=Slider(1, range=0..3), Wrap=True)
midpt = CurveMiddle(Curve=item)  # -> simplify(Midpoint)
pshift = ShiftPaths(Data=midpt, Offset=-1)
D = ClusterOutput(pshift)
