# Grasshopper definition 2022_06_10_3waygeodesic_GroundDetails_JW_3.gh (Grasshopper 1.0.7)
# plug-ins: Kangaroo2 Components, OpenNest, Pufferfish, Heteroptera, MeshEdit Components, EleFront, MetaHopper, Pancake

input = DataInput(
    Destination="\\Mac\Home\Desktop\MPDA\s2\s2_3ways\s2_3ways\2022_06_10_3wayGeodesics_NewForm_Data.ghdata",
    RelativePath="\\Mac\Home\Desktop\MPDA\s2\s2_3ways\s2_3ways\2022_06_10_3wayGeodesics_NewForm_Data.ghdata|2022_06_10_3wayGeodesics_NewForm_Data.ghdata",
    UpdateDelay=5)  # -> UntrimmedMesh, Surface, TrimmedMesh, MeshTrimmedLines, Thickness, Width
nv = NakedVertices(Mesh=input.TrimmedMesh)  # -> ClothedIndex, NakedIndex, ClothedPts, NakedPts
geo = Geometry(nv.NakedPts)
medges = MeshEdges(Mesh=input.TrimmedMesh)  # -> NakedEdges, InteriorEdges, NonManifoldEdges
pdecon = Deconstruct(Point=geo)  # -> XComponent, YComponent, ZComponent
multiplication = Multiplication(A=Slider(0.0155, range=0..0.1), B=Slider(9, range=0..10))
smaller = SmallerThan(FirstNumber=pdecon.ZComponent, SecondNumber=Slider(0.15, range=0..1))  # -> SmallerThan, OrEqualTo
crv = Curve(medges.NakedEdges)
division = Division(A=input.Thickness, B="2")
offmsh = OffsetMesh(Mesh=input.TrimmedMesh, Distance=expr("-x", multiplication), BothSides=0, CreateSolid=invert(True))
join = JoinCurves(Curves=crv, Preserve=False)
cull = CullPattern(List=geo, CullPattern=smaller.SmallerThan)
subtraction = Subtraction(A="-0.06", B=division)
alongcrv = SortAlongCurve(Points=cull, Curve=join)  # -> Points, Indices
offmsh_2 = OffsetMesh(Mesh=input.TrimmedMesh, Distance=expr("-x", subtraction), BothSides=0, CreateSolid=invert(True))
shift = ShiftList(List=alongcrv.Points, Shift=1, Wrap=True)
xy = XYPlane(Origin=Point(0, 0, 0))
project = Project(Geometry=shift, Plane=xy)  # -> Geometry, Transform
points = PointList(Points=shift)  # disabled
pgroups = PointGroups(Points=project.Geometry, Distance=Slider(3.3, range=0..10))  # -> Groups, Indices
meshcp = MeshClosestPoint(Point=pgroups.Groups, Mesh=offmsh_2)  # -> Point, Index, Parameter
meval = MeshEval(Mesh=offmsh_2, Parameter=meshcp.Parameter)  # -> Point, Normal, Colour
panel = Panel(input.Width)

# ---- group: make Z value same
pdecon_2 = Deconstruct(Point=meval.Point)  # -> XComponent, YComponent, ZComponent
avr = Average(Input=flatten(pdecon_2.ZComponent))
pt = ConstructPoint(XCoordinate=pdecon_2.XComponent, YCoordinate=pdecon_2.YComponent, ZCoordinate=avr)

# ---- group: membrane end point
num = Number(input.Thickness)
vec = Vector(meval.Normal)
multiplication_2 = Multiplication(A=Slider(9, range=0..10), B=num)
amp = Amplitude(Vector=expr("-x", vec), Amplitude=multiplication_2)
move = Move(Geometry=pgroups.Groups, Motion=amp)  # -> Geometry, Transform

# ----
pt_2 = Point(pgroups.Groups)
eval = EvaluateCurve()  # -> Point, Tangent, Angle

# ---- group: stagged t value
cluster = Cluster()  # disabled
consec = ConsecutiveDomains(Numbers=cluster, Additive=False)  # disabled

# ----
Z = UnitZ(Factor=1)
expression = Expression(x=Z, Expression="-x/2")
panel_2 = Panel("""C
B
A""")
txt = Text(graft(panel_2))
panel_3 = Panel("""-UP
-MID
-LOW""")
debrep = DeconstructBrep()  # -> Faces, Edges, Vertices
txt_2 = Text(graft(panel_3))
path_mapper = PathMapper(txt_2, source="{A;B}", target="{B;A}")
panel_4 = Panel("""exterior Cut
0
page
interior cut
Engraving""")
_0 = Relay()
col = Colour([RGB(255, 255, 0), RGB(255, 255, 255), RGB(255, 0, 255), RGB(255, 0, 0), RGB(0, 255, 0)])
txt_3 = Text(panel_4)
legend = Legend(Colour=col, Tags=txt_3, LegendType=1)

# ---- group: Edit this fields
panel_5 = Panel("3waygeodesic_L plate")

# ----
pt_3 = Point(Point(1, 0, 0))
attributes = DefineObjectAttributes(Layer=graft(txt_3), Color=graft(col))
pcghfilepath = DefinitionPath(LastSaveLocalization="neutral,N")  # -> Directory, Name, DirectorySeparator
concat = Concatenate(FragmentA=panel_5, FragmentB="_", FragmentD="_")
concat_2 = Concatenate(FragmentA=pcghfilepath.Directory, FragmentB=pcghfilepath.DirectorySeparator, FragmentC=concat)
sheets = Sheets()
truebutton = TrueOnlyButton(LastSaveLocalization="neutral,N")
panel_6 = Panel("export to autocad")
panel_7 = Panel(concat_2)
panel_8 = Panel("bake to rhino")
panel_9 = Panel("""exterior Cut
0
page
interior cut
Engraving""")
_0_2 = Relay()
col_2 = Colour([RGB(255, 255, 0), RGB(255, 255, 255), RGB(255, 0, 255), RGB(255, 0, 0), RGB(0, 255, 0)])
txt_4 = Text(panel_9)
legend_2 = Legend(Colour=col_2, Tags=txt_4, LegendType=1)

# ---- group: Edit this fields
panel_10 = Panel("3waygeodesic_L plate")

# ----
attributes_2 = DefineObjectAttributes(Layer=graft(txt_4), Color=graft(col_2))
pcghfilepath_2 = DefinitionPath(LastSaveLocalization="neutral,N")  # -> Directory, Name, DirectorySeparator
concat_3 = Concatenate(FragmentA=panel_10, FragmentB="_", FragmentD="_")
concat_4 = Concatenate(FragmentA=pcghfilepath_2.Directory, FragmentB=pcghfilepath_2.DirectorySeparator, FragmentC=concat_3)
truebutton_2 = TrueOnlyButton(LastSaveLocalization="neutral,N")
panel_12 = Panel(concat_4)

# ---- group: L Plates
addition = Addition(A=input.Width, B=Slider(0.02, range=0..0.1))
domsym = DomainSymmetric(Length=addition, Base=0)

# ----
Z_2 = UnitZ(Factor=1)
xprod = CrossProduct(VectorA=meval.Normal, VectorB=Z_2, Unitize=False)  # -> Vector, Length
pl = ConstructPlane(Origin=pt, XAxis=meval.Normal, YAxis=xprod.Vector)
deplane = DeconstructPlane(Plane=pl)  # -> Origin, XAxis, YAxis, ZAxis
number_slider = Slider(11, range=0..16)

# ---- group: Plane 1
pl_2 = ConstructPlane(Origin=pt, XAxis=expr("-x", deplane.ZAxis), YAxis=xprod.Vector)

# ---- group: L Plates (continued)
amp_2 = Amplitude(Vector=deplane.ZAxis, Amplitude=Slider(0.15, range=0..1))
rectangle = Rectangle(Plane=pl_2, XSize=Slider(0.23, range=0..1), YSize=domsym, Radius=0)  # -> Rectangle, Length
move_2 = Move(Geometry=rectangle.Rectangle, Motion=amp_2)  # -> Geometry, Transform
deplane_2 = DeconstructPlane(Plane=move_2.Geometry)  # -> Origin, XAxis, YAxis, ZAxis
pl_3 = ConstructPlane(Origin=deplane_2.Origin, XAxis=deplane_2.XAxis, YAxis=deplane_2.YAxis)
projecta = ProjectAlong(Geometry=pgroups.Groups, Plane=pl_3, Direction=deplane_2.ZAxis)  # -> Geometry, Transform

# ----
pln = Plane(move_2.Geometry)

deplane_3 = DeconstructPlane(Plane=pl_2)  # -> Origin, XAxis, YAxis, ZAxis
project_2 = Project(Geometry=deplane_3.XAxis, Plane=PlaneXY(0, 0, 0))  # -> Geometry, Transform
rev = Reverse(Vector=project_2.Geometry)

# ---- group: L Plates (continued)
pl_4 = ConstructPlane(Origin=deplane_2.Origin, XAxis=rev, YAxis=xprod.Vector)

# ---- group: get angles
angle = Angle(VectorA=deplane_3.XAxis, VectorB=rev)  # -> Angle, Reflex

# ----
deg = Degrees(Radians=angle.Angle)
subtraction_2 = Subtraction(A=Slider(180, range=0..1000), B=deg)
panel_14 = Panel(deg)
roundd = RoundToDecimalPlace(NumberX=deg, DecimalPlace="2", RoundType=0)  # -> Rounded, Difference

# ---- group: check
item = ListItem(List=flatten(deplane_3.Origin), Index=number_slider, Wrap=True)
item_2 = ListItem(List=flatten(deplane_3.XAxis), Index=number_slider, Wrap=True)
item_3 = ListItem(List=flatten(project_2.Geometry), Index=number_slider, Wrap=True)
vdis = VectorDisplay(Anchor=item, Vector=[item_2, item_3])

# ----
vec_2 = Vector(deplane_3.XAxis)
amp_3 = Amplitude(Vector=expr("-x", vec_2), Amplitude=Slider(0.242, range=0..0.5))
move_3 = Move(Geometry=move.Geometry, Motion=amp_3)  # -> Geometry, Transform

# ---- group: L Plates
dom = ConstructDomain(DomainStart=expr("-x", Slider(0.099, range=0..0.1)), DomainEnd="0")
number_slider_2 = Slider(0.0055, range=0..0.1)
rectangle_2 = Rectangle(Plane=pl_4, XSize=Slider(0.2, range=0..1), YSize=domsym, Radius=0)  # -> Rectangle, Length
pt_orignal_membrane_connection_plane = PtOrignalMembraneConnectionPlane(C=rectangle_2.Rectangle)
pln_2 = Plane(pl)
pl_origin = PlaneOrigin(Base=pln_2, Origin=pt_orignal_membrane_connection_plane)
membrane_connection = Rectangle(Plane=pl_origin, XSize=dom, YSize=domsym, Radius=0)  # -> Rectangle, Length
circle = CircleCNR(Center=projecta.Geometry, Normal=deplane_2.ZAxis, Radius=number_slider_2)
merge = Merge(Data1=simplify(move_2.Geometry), Data2=simplify(rectangle_2.Rectangle))
boundary = BoundarySurfaces(Edges=[circle, move_2.Geometry])
edges = BrepEdges(Brep=boundary)  # -> Naked, Interior, NonManifold
geo_2 = Geometry(edges.Naked)
item_4 = ListItem(List=geo_2, Index=Slider(3, range=0..4), Wrap=True)
join_2 = BrepJoin(Breps=merge)  # -> Breps, Closed
smesh = SimpleMesh(Brep=join_2.Breps)
offmsh_3 = OffsetMesh(Mesh=smesh, Distance=Slider(0.005, range=0..0.01), BothSides=0, CreateSolid=True)

# ---- group: L Plates / rec_screw
offset = OffsetCurve(Curve=rectangle_2.Rectangle, Distance=expr("-x", Slider(0.04, range=0..0.1)), Corners=1)
explode = Explode(Curve=offset, Recursive=True)  # -> Segments, Vertices
pshift = ShiftPaths(Data=explode.Vertices, Offset=-1)

# ---- group: Ground beam
item_5 = ListItem(List=pt, Index=0, Wrap=True)  # -> Item1, Item, Item1_2
arc = Arc3Pt(PointA=item_5.Item, PointB=item_5.Item1_2, PointC=item_5.Item1)  # -> Arc, Plane, Radius
item_6 = ListItem(List=flatten(pl_4), Index=0, Wrap=True)
project_3 = Project(Geometry=arc.Arc, Plane=item_6)  # -> Geometry, Transform
number_slider_3 = Slider(0.16, range=0..1)
offset_2 = OffsetCurve(Curve=project_3.Geometry, Distance=Slider(0.1, range=0..0.1), Corners=1)
xy_2 = XYPlane(Origin=Point(0, 0, 0))
ext = ExtendCurve(Curve=offset_2, Type=1, Start=number_slider_3, End=number_slider_3)
neg = Negative(Value=Slider(0.37, range=0..1))
offset_3 = OffsetCurve(Curve=ext, Distance=neg, Plane=xy_2, Corners=1)
merge_2 = Merge(Data1=simplify(ext), Data2=simplify(offset_3))
partition = PartitionList(List=flatten(merge_2), Size="2")
loft = Loft(Curves=merge_2, Options={Adjust=False, Closed=False, LoftEnds=0, LoftSimp=0, LoftType=0, Rebuild=10, Refit=0.01})
edges_2 = BrepEdges(Brep=loft)  # -> Naked, Interior, NonManifold
cir = Circle(Plane=pshift, Radius=number_slider_2)
merge_3 = Merge(Data2=simplify(edges_2.Naked))

# ----
crv_2 = Curve(simplify(offset_3))
area = MeshArea(Mesh=input.TrimmedMesh)  # -> Area, Centroid
midpt = CurveMiddle(Curve=crv_2)
xy_3 = XYPlane(Origin=Point(0, 0, 0))
project_4 = Project(Geometry=area.Centroid, Plane=xy_3)  # -> Geometry, Transform
project_5 = Project(Geometry=midpt, Plane=xy_3)  # -> Geometry, Transform
end = EndPoints(Curve=crv_2)  # -> Start, End
ln = Line(StartPoint=project_4.Geometry, EndPoint=project_5.Geometry)

rec = Rectangle(simplify(graft(rectangle_2.Rectangle)))

# ---- group: holes
cir_2 = Circle(Plane=pshift, Radius=number_slider_2)  # -> simplify(Circle)

# ---- group: Ground beam
thickness_of_ground_beams = Slider(0.06, range=0..1)
boundary_2 = BoundarySurfaces(Edges=merge_3)
Z_3 = UnitZ(Factor=thickness_of_ground_beams)
extr = Extrude(Base=boundary_2, Direction=expr("-x", Z_3))

# ----
ln_2 = Line(StartPoint=project_4.Geometry, EndPoint=end.Start)
ln_3 = Line(StartPoint=project_4.Geometry, EndPoint=end.End)
ln_4 = Line(StartPoint=end.Start, EndPoint=end.End)

midpt_2 = CurveMiddle(Curve=item_4)
project_6 = Project(Geometry=[rec, cir_2], Plane=PlaneXY(0, 0, 0))  # -> Geometry, Transform

# ---- group: unrolled plates with holes
rot3d = Rotate3D(Geometry=graft(boundary), Angle=graft(degrees(subtraction_2)), Center=midpt_2, Axis=item_4)  # -> Geometry, Transform
boundary_3 = BoundarySurfaces(Edges=project_6.Geometry)
pshift_2 = ShiftPaths(Data=rot3d.Geometry, Offset=-1)
project_7 = Project(Geometry=pshift_2, Plane=PlaneXY(0, 0, 0))  # -> simplify(graft(Geometry)), Transform
join_3 = BrepJoin(Breps=[project_7.Geometry, boundary_3])  # -> Breps, Closed

# ----
panel_15 = Panel("Template Millimeter Large")  # disabled
toggle = GroupToggle(ToggleActive=True, ToggleVisible=False)  # disabled
number_slider_4 = Slider(0.5, range=0..1)  # disabled
panel_16 = Panel("2")  # disabled
shift_2 = ShiftList(List=end.End, Shift=panel_16, Wrap=True)  # disabled
neg_2 = Negative(Value=number_slider_4)  # disabled
lineardim = DefineLinearDimension(Point1=project_4.Geometry, Point2=end.End, Offset=number_slider_4, DimensionStyle=panel_15)  # disabled
lineardim_2 = DefineLinearDimension(Point1=project_4.Geometry, Point2=end.Start, Offset=number_slider_4, DimensionStyle=panel_15)  # disabled
lineardim_3 = DefineLinearDimension(Point1=end.Start, Point2=shift_2, Offset=neg_2, DimensionStyle=panel_15)  # disabled
lineardim_4 = DefineLinearDimension(Point1=end.Start, Point2=end.End, Offset=neg_2, DimensionStyle=panel_15)  # disabled

geo_3 = Geometry(extr)
pshift_3 = ShiftPaths(Data=project_7.Geometry, Offset=-1)

number_slider_5 = Slider(0.9, range=0..1)  # disabled
panel_17 = Panel("2")  # disabled
shift_3 = ShiftList(List=end.End, Shift=panel_17, Wrap=True)  # disabled
angulardim = DefineAngularDimension(Origin=project_4.Geometry, Point1=shift_3, Point2=end.Start, Offset=number_slider_5, DimensionStyle=panel_15)  # disabled
angulardim_2 = DefineAngularDimension(Origin=project_4.Geometry, Point1=end.Start, Point2=end.End, Offset=number_slider_5, DimensionStyle=panel_15)  # disabled

transform = Transform(rot3d.Transform)
transform_2 = Transform(Geometry=graft(pln), Transform=transform)
transform_3 = Transform(project_7.Transform)
pshift_4 = ShiftPaths(Data=transform_2, Offset=-1)
transform_4 = Transform(Geometry=pshift_4, Transform=transform_3)
flippln = FlipPlane(Plane=transform_4, FlipX=False, FlipY=False, FlipZ=True)  # -> Flipped, R
edges_3 = BrepEdges(Brep=loft)  # -> Naked, Interior, NonManifold
crv_3 = Curve(edges_3.Naked)
len = Length(Curve=edges_3.Naked)
sort = SortList(Keys=len, ValuesA=crv_3)  # -> Keys, reverse(ValuesA)
item_7 = ListItem(List=sort.ValuesA, Index=0, Wrap=True)  # -> Item, Item1
crv_4 = Curve(item_7.Item1)

# ---- group: reaction intersection
input_2 = DataInput(
    Destination="\\Mac\Home\Desktop\MPDA\s2\s2_3ways\s2_3ways\2022_06_10_3wayGeodesics_NewForm_Membrane_Reactions.ghdata",
    RelativePath="\\Mac\Home\Desktop\MPDA\s2\s2_3ways\s2_3ways\2022_06_10_3wayGeodesics_NewForm_Membrane_Reactions.ghdata|2022_06_10_3wayGeodesics_NewForm_Membrane_Reactions.ghdata",
    UpdateDelay=5)
slx = SurfaceLine(Surface=loft, Line=input_2, LimitToFirst=False)  # -> Curves, Points, UVPoints, Normal
clean = CleanTree(RemoveNulls=True, RemoveInvalid=True, RemoveEmpty=True, Tree=slx.Points)
pshift_5 = ShiftPaths(Data=clean, Offset=-1)  # -> simplify(Data)
pt_4 = Point(flatten(pshift_5))

# ----
circle_2 = Circle(cir)
extr_2 = Extrude(Base=circle_2, Direction=Z)
move_4 = Move(Geometry=extr_2, Motion=expression)  # -> Geometry, Transform
cap = CapHoles(Brep=move_4.Geometry)  # -> flatten(Brep)

# ---- group: names
md_slider = MDSlider(
    SliderMode=0,
    slider_value=Point(0.9143676758, 0.7452278137, 0.5),
    x_domain=Domain(-1, 1),
    y_domain=Domain(-1, 1),
    z_domain=Domain(0, 1))
md_slider_2 = MDSlider(
    SliderMode=0,
    slider_value=Point(0.5602416992, 0.6207771301, 0.5),
    x_domain=Domain(-1, 1),
    y_domain=Domain(-1, 1),
    z_domain=Domain(0, 1))
lng = ListLength(List=pt)
number_slider_6 = Slider(0.02, range=0..1)
series = Series(Start=0, Step=1, Count=simplify(lng))
panel_18 = Panel("""C
B
A""")
concat_5 = Concatenate(FragmentA=series, FragmentB=graft(panel_18))
evalsrf = EvaluateSurface(Surface=reparameterize(pshift_3), Point=md_slider)  # -> Point, Normal, UDirection, VDirection, Frame
evalsrf_2 = EvaluateSurface(Surface=reparameterize(pshift_3), Point=md_slider_2)  # -> Point, Normal, UDirection, VDirection, Frame

# ----
pl_origin_2 = PlaneOrigin(Base=flippln.Flipped, Origin=evalsrf.Point)
pl_origin_3 = PlaneOrigin(Base=flippln.Flipped, Origin=evalsrf_2.Point)

# ---- group: names / L naming
text = Text(Location=simplify(pl_origin_2), Text=concat_5, Size=number_slider_6)  # -> simplify(Curves)

# ---- group: names (continued)
text_2 = Text(Location=simplify(pl_origin_3), Text=roundd.Rounded, Size=number_slider_6)  # -> simplify(Curves)

# ---- group: nesting L plate
deplane_4 = DeconstructPlane(Plane=flippln.Flipped)  # -> Origin, XAxis, YAxis, ZAxis
center = Center(Geometric=join_3.Breps)  # -> Center, Dimension
vec_3 = Vector(simplify(graft(deplane_4.YAxis)))
rotate = RotateDirection(Geometry=join_3.Breps, Center=center.Center, From=vec_3, To=Vector(0, 1, 0))  # -> Geometry, Transform
rectangle_3 = Rectangle(Plane=PlaneXY(0, 0, 0), XSize=Domain(-1, 1), YSize="-1 to 1", Radius=0)  # -> Rectangle, Length
geo_4 = Geometry(text_2)
geo_5 = Geometry(text)
transform_5 = Transform(Geometry=geo_4, Transform=rotate.Transform)
transform_6 = Transform(Geometry=geo_5, Transform=rotate.Transform)
opennest = OpenNest(
    Sheets=rectangle_3.Rectangle,
    Geo=flatten(rotate.Geometry),
    Spacing=Slider(0.02, range=0..0.1),
    Placement=0,
    Tolerance=0.01,
    Rotations=1,
    Iterations=Slider(12, range=0..100),
    Seed=1,
    Reset=Button(),
    Run=Toggle(False))  # -> Sheets, Geo, ID, Transform, IDS

# ----
panel_19 = Panel(rotate.Geometry)
unflatten = UnflattenTree(Tree=opennest.Transform, Guide=rotate.Geometry)
edges_4 = BrepEdges(Brep=opennest.Geo)  # -> Naked, Interior, NonManifold
crv_5 = Curve(edges_4.Interior)
crv_6 = Curve(edges_4.Naked)
join_4 = JoinCurves(Curves=crv_6, Preserve=False)
len_2 = Length(Curve=join_4)
sort_2 = SortList(Keys=len_2, ValuesA=join_4)  # -> Keys, ValuesA
cull_i = CullIndex(List=sort_2.ValuesA, Indices="-1", Wrap=True)
item_8 = ListItem(List=sort_2.ValuesA, Index="-1", Wrap=True)
offset_4 = OffsetCurve(Curve=rectangle_3.Rectangle, Distance=expr("-x", Slider(0.005, range=0..0.01)), Corners=1)  # -> flatten(Curve)
fillet = Fillet(Curve=item_8, Radius=Slider(0.01, range=0..0.1))
transform_7 = Transform(Geometry=transform_5, Transform=unflatten)
transform_8 = Transform(Geometry=transform_6, Transform=unflatten)
sort_3 = SortList(Keys=offset_4, ValuesA=offset_4)  # -> Keys, ValuesA
item_9 = ListItem(List=sort_3.ValuesA, Index=0, Wrap=True)

# ---- group: geometry goes here
engraving = Relay([transform_8, transform_7, crv_5])

# ----
entwine = Entwine(
    Branch00=flatten(fillet),
    Branch01=flatten(_0),
    Branch02=flatten(rectangle_3.Rectangle),
    Branch03=flatten(cull_i),
    Branch04=flatten(engraving),
    FlattenInputs=True)
tstat = TreeStatistics(Tree=entwine)  # -> Paths, Length, Count
repeat = RepeatData(Data=attributes, Length=graft(tstat.Length))
bake = BakeObjects(Geometry=entwine, Attributes=attributes, BakeName="bake2d", Bake=False)
pcexportas = ExportAs(
    Geometry=flatten(entwine),
    ObjectAttributes=flatten(repeat),
    FileLocation=concat_2,
    Overwrite=Toggle(True),
    Export=truebutton,
    CompMode=False,
    LastSaveLocalization="neutral,N")  # -> OK, ExportCommand

# ---- group: sub surface 01
panel_20 = Panel("""2
2
2""")
div = DivideDomain(Domain=Domain(0, 1), Count=graft(panel_20))
dedomain = DeconstructDomain(Domain=div)  # -> Start, End
cull_i_2 = CullIndex(List=dedomain.Start, Indices=0, Wrap=True)  # -> simplify(List)
number_slider_7 = Slider(0.025, range=0..0.05)

# ----
bang = ExplodeTree(Data=cull_i_2)  # -> Branch0, Branch1, Branch2
addition_2 = Addition(A=[bang.Branch1, bang.Branch2], B=Slider(0.1, range=0..1))
merge_4 = Merge(Data1=bang.Branch0, Data2=addition_2)
merge_5 = Merge(Data1=number_slider_7, Data2=number_slider_7, Data3=number_slider_7)  # -> simplify(graft(Result))

# ---- group: sub surface 01 (continued)
subtraction_3 = Subtraction(A=merge_4, B=merge_5)
addition_3 = Addition(A=merge_4, B=merge_5)
ins = InsertItems(List=addition_3, Item=[0, 1], Indices=[0, -1], Wrap=True)
ins_2 = InsertItems(List=subtraction_3, Item=[0, 1], Indices=[0, -1], Wrap=True)
consec_2 = ConsecutiveDomains(Numbers=ins, Additive=False)
consec_3 = ConsecutiveDomains(Numbers=ins_2, Additive=False)
dom² = ConstructDomain²(DomainU=Domain(0, 1), DomainV=consec_2)
dom²_2 = ConstructDomain²(DomainU=Domain(0, 1), DomainV=consec_3)
subsrf = Isotrim(Surface=reparameterize(loft), Domain=dom²)  # -> simplify(Surface)
subsrf_2 = Isotrim(Surface=reparameterize(loft), Domain=dom²_2)  # -> simplify(Surface)
crv_7 = Curve(subsrf)

# ----
path_mapper_2 = PathMapper(subsrf, source="{A}", target="{0;A}")
path_mapper_3 = PathMapper(crv_7, source="{A}", target="{2;A}")
path_mapper_4 = PathMapper(subsrf_2, source="{A}", target="{1;A}")
area_2 = Area(Geometry=subsrf)  # -> Area, Centroid
merge_6 = Merge(Data1=path_mapper_2, Data2=path_mapper_4, Data3=path_mapper_3)
panel_21 = Panel(merge_6)
geo_6 = Geometry(flatten([subsrf, subsrf_2, crv_7]))
lng_2 = ListLength(List=subsrf)
edges_5 = BrepEdges(Brep=geo_6)  # -> Naked, Interior, NonManifold
split = SplitTree(Data=merge_6, Masks=flatten("{*;1}"))  # -> flatten(Positive), Negative
split_2 = SplitTree(Data=merge_6, Masks=flatten("{*;0}"))  # -> flatten(Positive), Negative
split_3 = SplitTree(Data=merge_6, Masks=flatten("{*;2}"))  # -> flatten(Positive), Negative
item_10 = ListItem(List=geo_6, Index=0, Wrap=True)
series_2 = Series(Start=1, Step=1, Count=lng_2)
bbx = BrepBrep(BrepA=graft(geo_6), BrepB=cap)  # -> simplify(Curves), Points
panel_22 = Panel(split_2.Positive)

# ---- group: sort tension pts
edges_6 = BrepEdges(Brep=geo_6)  # -> Naked, Interior, NonManifold
join_5 = JoinCurves(Curves=edges_6.Naked, Preserve=False)  # -> simplify(Curves)
incurve = PointInCurve(Point=pt_4, Curve=join_5)  # -> Relationship, Point
equals = Equality(FirstNumber=incurve.Relationship, SecondNumber=2)  # -> Equality, Inequality
cull_2 = CullPattern(List=pt_4, CullPattern=equals.Equality)
cir_3 = Circle(Plane=cull_2, Radius=Slider(0.005, range=0..0.3))
group = Group(Objects=cir_3)

# ----
dup = DuplicateData(Data=txt, Number=lng_2, Order=True)  # -> flatten(Data)
sorted_surface = Merge(Data1=split_2.Positive, Data2=split.Positive, Data3=split_3.Positive)

# ---- group: align beams
project_8 = Project(Geometry=geo_6, Plane=PlaneXY(0, 0, 0))  # -> Geometry, Transform
edges_7 = BrepEdges(Brep=project_8.Geometry)  # -> Naked, Interior, NonManifold
join_6 = JoinCurves(Curves=edges_7.Naked, Preserve=False)
item_11 = ListItem(List=edges_7.Naked, Index=1, Wrap=True)
end_2 = EndPoints(Curve=item_11)  # -> Start, End
ln_5 = Line(StartPoint=end_2.Start, EndPoint=end_2.End)
midpt_3 = CurveMiddle(Curve=ln_5)
rotate_2 = RotateDirection(Geometry=join_6, Center=midpt_3, From=ln_5, To=pt_3)  # -> Geometry, simplify(Transform)

# ---- group: foudantion pt
pshift_6 = ShiftPaths(Data=bbx.Curves, Offset=-1)

# ----
edges_8 = BrepEdges(Brep=sorted_surface)  # -> Naked, Interior, NonManifold
pshift_7 = ShiftPaths(Data=merge_6, Offset=-1)
join_7 = JoinCurves(Curves=edges_8.Naked, Preserve=False)
center_2 = Center(Geometric=pshift_6)  # -> Center, Dimension
concat_6 = Concatenate(FragmentA=txt, FragmentC=series_2)  # -> flatten(Result)
center_3 = Center(Geometric=rotate_2.Geometry, referenceAll=2)  # -> Center, Dimension
panel_23 = Panel(sorted_surface)
panel_24 = Panel(concat_6)
lng_3 = ListLength(List=dup)
long = LongestList(ListA=pshift_7, ListB=path_mapper, PaddingMode=2)  # -> ListA, ListB
len_3 = Length(Curve=ln_5)
long_2 = LongestList(ListA=txt, ListB=pshift_7, PaddingMode=2)  # -> ListA, ListB
panel_25 = Panel(len_3)
repeat_2 = RepeatData(Data=concat_6, Length=expr("x * 3", lng_3))
partition_2 = PartitionList(List=repeat_2, Size=7)  # -> simplify(Chunks)
concat_7 = Concatenate(FragmentA=partition_2, FragmentB=txt_2)
flippln_2 = FlipPlane(Plane=center_3.Center, FlipX=False, FlipY=False, FlipZ=True)  # -> flatten(Flipped), R
item_12 = ListItem(List=flippln_2.Flipped, Index=Slider(20, range=0..20), Wrap=True)
partition_3 = PartitionList(List=concat_7, Size=[3, 2, 2])  # -> simplify(Chunks)
branch = TreeBranch(Tree=merge_6, Path="{0;0}", MaintainPaths=True)
flatten = FlattenTree(Tree=rotate_2.Geometry, Path="{0}")
crv_8 = Curve(simplify(rotate_2.Geometry))
opennest_2 = OpenNest(
    Sheets=sheets,
    Geo=flatten(rotate_2.Geometry),
    Spacing=Slider(0.02, range=0..0.02),
    Placement=Slider(1, range=0..2),
    Tolerance=0.001,
    Rotations=Slider(4, range=1..20),
    Iterations=Slider(0, range=0..10),
    Seed=1,
    Reset=Button(),
    Run=Toggle(False))  # -> Sheets, Geo, ID, Transform, IDS
panel_26 = Panel(flatten)
split_4 = SplitTree(Data=partition_3, Masks=flatten("{*;0}"))  # -> flatten(Positive), Negative
group_2 = Group(Objects=pshift_6)
split_5 = SplitTree(Data=partition_3, Masks=flatten("{*;1}"))  # -> flatten(Positive), Negative
split_6 = SplitTree(Data=crv_8, Masks=flatten("{0 to 6}"))  # -> Positive, Negative
split_7 = SplitTree(Data=partition_3, Masks=flatten("{*;2}"))  # -> flatten(Positive), Negative
merge_7 = Merge(Data1=split_4.Positive, Data2=split_5.Positive, Data3=split_7.Positive)
text_3 = Text(Location=flatten(center_3.Center), Text=merge_7, Size=Slider(0.05, range=0..0.1))
geo_7 = Geometry(simplify(text_3))
group_3 = Group(Objects=geo_7)
split_8 = SplitTree(Data=geo_7, Masks=flatten("{0 to 6}"))  # -> Positive, Negative
panel_27 = Panel(split_4.Positive)
transform_9 = Transform(simplify(graft(opennest_2.Transform)))
panel_28 = Panel(group_3)
comp = Compound(Transforms=[rotate_2.Transform, transform_9])
panel_29 = Panel(merge_7)
panel_30 = Panel(path_mapper_2)
tagging_txt = Transform(Geometry=group_3, Transform=transform_9)
membrane_anchor_pt = Transform(Geometry=group, Transform=comp)
fixed_l_plate = Transform(Geometry=group_2, Transform=comp)
panel_31 = Panel(transform_9)
panel_32 = Panel(flippln_2.Flipped)
panel_33 = Panel(split_8.Positive)

# ---- group: geometry goes here
interior_cut = Relay([membrane_anchor_pt, fixed_l_plate])

# ----
entwine_2 = Entwine(
    Branch00=flatten(opennest_2.Geo),
    Branch01=flatten(_0_2),
    Branch02=flatten(opennest_2.Sheets),
    Branch03=flatten(interior_cut),
    Branch04=flatten(tagging_txt),
    FlattenInputs=True)
tstat_2 = TreeStatistics(Tree=entwine_2)  # -> Paths, Length, Count
repeat_3 = RepeatData(Data=attributes_2, Length=graft(tstat_2.Length))
bake_2 = BakeObjects(Geometry=entwine_2, Attributes=attributes_2, BakeName="bake2d", Bake=False)
pcexportas_2 = ExportAs(
    Geometry=flatten(entwine_2),
    ObjectAttributes=flatten(repeat_3),
    FileLocation=concat_4,
    Overwrite=Toggle(True),
    Export=truebutton_2,
    CompMode=False,
    LastSaveLocalization="neutral,N")  # -> OK, ExportCommand

# ==== cluster Cluster
L = ClusterInput()
ins = InsertItems(List=L, Item="1", Indices=-1, Wrap=True)  # -> simplify(List)
shift = ShiftList(List=ins, Shift=1, Wrap=False)  # -> simplify(List)
num = Number(graft(ins))
ins_2 = InsertItems(List=shift, Item="1", Indices=-1, Wrap=True)  # -> simplify(graft(List))
addition = Addition(A=num, B=ins_2)
num_2 = Number(expr("x/2", addition))
pshift = ShiftPaths(Data=num_2, Offset=-1)
stagged_t = InsertItems(List=pshift, Item="0", Indices=0, Wrap=True)
L_2 = ClusterOutput(stagged_t)

# ==== cluster Sheets

# ---- group: sheets
series = Series(Start="1.51", Step="1.51", Count=10)
X = UnitX(Factor=series)
rectangle = Rectangle(Plane=PlaneXY(0, 0, 0), XSize="1.51", YSize="3.03", Radius=0)  # -> Rectangle, Length
move = Move(Geometry=rectangle.Rectangle, Motion=X)  # -> Geometry, Transform

# ----
G = ClusterOutput(move.Geometry)

# ==== cluster PtOrignalMembraneConnectionPlane
C = ClusterInput()
explode = Explode(Curve=C, Recursive=True)  # -> Segments, Vertices
item = ListItem(List=explode.Segments, Index=Slider(1, range=0..3), Wrap=True)
midpt = CurveMiddle(Curve=item)  # -> simplify(Midpoint)
pshift = ShiftPaths(Data=midpt, Offset=-1)
D = ClusterOutput(pshift)
