# Grasshopper definition 220602_3waygeodesic_15mmThickness_EG.gh (Grasshopper 1.0.7)
# plug-ins: Bowerbird2, NGon, Weaverbird, Human, Kangaroo2 Components, Heteroptera, MeshEdit Components, Kiwi3d, MetaHopper, K2Engineering, PlanktonGh, Pufferfish, Karamba3D, OpenNest, Pancake, EleFront, Ivy

polygon = Polygon(Plane=PlaneXY(0, 0, 0), Radius=Slider(9, range=0..10), Segments=6, FilletRadius=0)  # -> Polygon, Length
number_slider = Slider(11, range=0..14)
fromp = FromPolylines(Curves=polygon.Polygon, Min_Triangulation=True)
clear = Clear(Mesh=fromp)
wbtriangles = WeaverbirdsSplitTrianglesSubdivision(MeshCurves=clear, Level=number_slider)
wbmidedge = WeaverbirdsMidedgeSubdivision(MeshCurves=polygon.Polygon, Level=1, SmoothNakedEdges=0)
wbedges = WeaverbirdsMeshEdges(MeshOrPolylines=wbtriangles)
len = Length(Curve=wbmidedge)
sort = SortList(Keys=len, ValuesA=wbmidedge)  # -> Keys, ValuesA
Z = UnitZ(Factor=1)
item = ListItem(List=sort.ValuesA, Index=expr("-1", 0), Wrap=True)
multiplication = Multiplication(A=Z, B=2)
neg = Negative(Value=Z)
move = Move(Geometry=item, Motion=neg)  # -> Geometry, Transform

explode = Explode(Curve=polygon.Polygon, Recursive=True)  # -> Segments, Vertices
reparamcrv = ReparameterizeCurve(Curve=explode.Segments)  # -> Reparameterized, Original
division = Division(A=Slider(8, range=0..11), B=number_slider)
dispatch = Dispatch(List=reparamcrv.Reparameterized, DispatchPattern=[True, False])  # -> ListA, ListB
eval = EvaluateCurve(Curve=dispatch.ListA, Parameter=division)  # -> Point, Tangent, Angle
subtraction = Subtraction(A="1", B=division)
eval_2 = EvaluateCurve(Curve=dispatch.ListB, Parameter=subtraction)  # -> Point, Tangent, Angle
weave = Weave(Pattern=[0, 1], Stream0=eval.Point, Stream1=eval_2.Point, NullGaps=False)
pline = PolyLine(Vertices=weave, Closed=True)

extr = Extrude(Base=pline, Direction=multiplication)
cap = CapHoles(Brep=extr)
trim = TrimWithBrep(Curve=wbedges, Brep=cap)  # -> Inside, Outside
crv = Curve(flatten(trim.Inside))
end = EndPoints(Curve=crv)  # -> Start, End
duppt = RemoveDuplicatePts(Points=[end.Start, end.End], Tolerance=0.01)
del = DelaunayMesh(Points=duppt, Plane=PlaneXY(0, 0, 0))
mesh = Mesh(del)
area = MeshArea(Mesh=mesh)  # -> Area, Centroid

X = UnitX(Factor=1)
neg_2 = Negative(Value=X)
line = LineSDL(Start=area.Centroid, Direction=[X, neg_2], Length=Slider(7, range=0..10))
join = JoinCurves(Curves=line, Preserve=False)
demesh = DeconstructMesh(Mesh=mesh)  # -> Vertices, Faces, Colours, Normals
offset = PolylineOffset(Curve=join, Distance=Slider(0.08, range=0..0.1), Divisions=0)  # -> C, H
incurve = PointInCurve(Point=demesh.Vertices, Curve=offset.C)  # -> Relationship, Point
equals = Equality(FirstNumber=incurve.Relationship, SecondNumber=2)  # -> Equality, Inequality
cull = CullPattern(List=demesh.Vertices, CullPattern=equals.Equality)

nv = NakedVertices(Mesh=mesh)  # -> ClothedIndex, NakedIndex, ClothedPts, NakedPts
geodésicas_imposición_angulos_opuestos_i = Slider(0.666, range=0..15)  # "Geodésicas: imposición angulos opuestos iguales"
vn = VertexNeighbours(Mesh=mesh, VertexNumber=nv.ClothedIndex)  # -> Vertex, Neighbours, Normal
ln = Line(StartPoint=simplify(graft(vn.Vertex)), EndPoint=simplify(vn.Neighbours))
item_2 = ListItem(List=ln, Index=0, Wrap=True)  # -> Item, Item1, Item2, Item3, Item4, Item5
_10º = PowerOf10(Value=geodésicas_imposición_angulos_opuestos_i)
ea = EqualAngle(LineA=[item_2.Item, item_2.Item3], LineB=[item_2.Item1, item_2.Item4], Strength=_10º)  # disabled
ea_2 = EqualAngle(LineA=[item_2.Item1, item_2.Item4], LineB=[item_2.Item2, item_2.Item5], Strength=_10º)  # disabled
ea_3 = EqualAngle(LineA=[item_2.Item2, item_2.Item5], LineB=[item_2.Item3, item_2.Item], Strength=_10º)  # disabled

merge = Merge(Data1=Slider(4.5, range=1..10), Data2=Slider(4.5, range=1..10), Data3=Slider(7.9, range=1..10))

# ---- group: 3 way direction uncut
medges = MeshEdges(Mesh=mesh)  # -> NakedEdges, InteriorEdges, NonManifoldEdges
X_2 = UnitX(Factor=1)
angle = Angle(VectorA=medges.InteriorEdges, VectorB=X_2)  # -> Angle, Reflex
pi = Pi(Factor=0.5)
subtraction_2 = Subtraction(A=angle.Angle, B=pi)
pi_2 = Pi(Factor=Slider(0.19, range=0..2))
abs = Absolute(Value=subtraction_2)
smaller = SmallerThan(FirstNumber=abs, SecondNumber=pi_2)  # -> SmallerThan, OrEqualTo
dispatch_2 = Dispatch(List=medges.InteriorEdges, DispatchPattern=smaller.SmallerThan)  # -> ListA, ListB
pt = Point(Point(1.5, 1, 0))
geo = Geometry(dispatch_2.ListA)
vec = Vector(pt)
angle_2 = Angle(VectorA=geo, VectorB=vec)  # -> Angle, Reflex
pi_3 = Pi(Factor=0.5)
subtraction_3 = Subtraction(A=angle_2.Angle, B=pi_3)
pi_4 = Pi(Factor=Slider(0.2, range=0..2))
abs_2 = Absolute(Value=subtraction_3)
larger = LargerThan(FirstNumber=abs_2, SecondNumber=pi_4)  # -> LargerThan, OrEqualTo
dispatch_3 = Dispatch(List=geo, DispatchPattern=larger.LargerThan)  # -> ListA, ListB
line_2 = Line(dispatch_3.ListA)
line_3 = Line(dispatch_3.ListB)
line_4 = Line(dispatch_2.ListB)
entwine = Entwine(Branch00=line_2, Branch01=line_3, Branch02=line_4, FlattenInputs=True)

# ----
crv_2 = Curve([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])
number_slider_2 = Slider(173, range=0..300)
xy = XYPlane(Origin=Point(0, 0, 0))

# ---- group: material for geometry
sigma = Slider(40, range=0..100)
safety_factor = Slider(0.7, range=0..1)
width = Slider(0.13, range=0..0.2)
height = Slider(0.015, range=0..0.03)
expression = Expression(E=Slider(9148, range=0..100000), s=sigma, f=safety_factor, Expression="E/(2*s*f)")
kn = Expression(t=height, F=expression, Expression="t*F")
kg = Expression(t=width, F=expression, Expression="t*F")
one_over_x = OneOverX(Value=kg)
one_over_x_2 = OneOverX(Value=kn)
panel = Panel(one_over_x)
panel_2 = Panel(one_over_x_2)

# ----
range = Range(Domain=Domain(0, 1), Steps="50")
shift = ShiftList(List=range, Shift=1, Wrap=invert(True))
short = ShortestList(ListA=range, ListB=shift, TrimMode=2)  # -> ListA, ListB
merge_2 = Merge(Data1=simplify(graft(short.ListA)), Data2=simplify(graft(short.ListB)))
avr = Average(Input=merge_2)  # -> flatten(ArithmeticMean)

geo_2 = Geometry()
panel_3 = Panel("""0
1""")

height_2 = Number(height)
width_2 = Number(width)

number_slider_3 = Slider(1, range=0..1)
wbsplitpolygons = WeaverbirdsSplitPolygonsSubdivision(Level=1, SmoothNakedEdges=1)

list = ValueList({"Displacements": 1, "Stresses": 2, "SupportForces": 3}, selected=["Displacements", "Stresses", "SupportForces"])
ldc = LoadDisplCurve(TimeStepList=[0, 10], ValueList=[0, 1])
nonlina = NonLinearAnalysis(
    Name="s2sa_test33",
    Iterations="10",
    EquilibriumAccurancy=0.001,
    OutputSetting=list,
    GlobalLDCurve=ldc,
    AdaptiveForceControl=0,
    OutputFrequency=1)

# ---- group: Plywood material
list_2 = ValueList({"LIN_ELAST_ISOTROPIC": 1}, selected="LIN_ELAST_ISOTROPIC")
mat = Material(Name="Plywood", Type=list_2, YoungsModulus="10050000", AlphaT=0, Nue=0, Density="0.68", Strength="40000")

# ----
list_3 = ValueList({"Displacements": 1, "Stresses": 2, "SupportForces": 3}, selected=["Displacements", "Stresses", "SupportForces"])
lina = LinearAnalysis(Name="s2sa_test2", OutputSetting=list_3)

panel_4 = Panel("""0
1""")
panel_5 = Panel("""0
1""")
division_2 = Division(A=height_2, B="2")
xy_2 = XYPlane(Origin=Point(0, 0, 0))

# ---- group: Material
list_4 = ValueList({"LIN_ELAST_ISOTROPIC": 1}, selected="LIN_ELAST_ISOTROPIC")
mat_2 = Material(Name="Kerto S", Type=list_4, YoungsModulus="11600000", AlphaT=0, Nue=0, Density="0.48", Strength="35000")

list_5 = ValueList({"LIN_ELAST_ISOTROPIC": 1}, selected="LIN_ELAST_ISOTROPIC")
mat_3 = Material(Name="Kerto S", Type=list_5, YoungsModulus="11600000", AlphaT=0, Nue=0, Density="0.48", Strength="35000")

# ----
path = FilePath("\\Mac\Home\Desktop\MPDA\s2\screenshot\")
capture = Capture(Path=path, Filename="pd_analysis")

symdom = SymmetricalDomain(Length=width_2, Base=0)
symdom_2 = SymmetricalDomain(Length=height_2, Base=0)
addition = Addition(A=width_2, B=Slider(0.07, range=0..0.1))
domsym = DomainSymmetric(Length=addition, Base=0)
md_slider = MDSlider(SliderMode=0, slider_value=Point(0.5, 0.5, 0.5), x_domain=Domain(0, 1), y_domain=Domain(0, 1), z_domain=Domain(0, 1))
number_slider_4 = Slider(0.25, range=0..1)
swatch = ColourSwatch(SwatchColor=RGB(224, 184, 141))
swatch_2 = ColourSwatch(SwatchColor=RGB(227, 204, 154))
swatch_3 = ColourSwatch(SwatchColor=RGB(227, 165, 136))
entwine_2 = Entwine(
    Branch00=swatch,
    Branch01=swatch_2,
    Branch02=swatch_3,
    Branch03=swatch,
    Branch04=swatch_2,
    Branch05=swatch_3,
    FlattenInputs=True)
number_slider_5 = Slider(0.005, range=0..0.1)
neg_3 = Negative(Value=number_slider_4)
swatch_4 = ColourSwatch(SwatchColor=RGB(135, 135, 135))  # disabled

# ---- group: Plywood material
list_6 = ValueList({"LIN_ELAST_ISOTROPIC": 1}, selected="LIN_ELAST_ISOTROPIC")  # disabled
panel_6 = Panel("10050000")  # disabled
panel_7 = Panel("Plywood")  # disabled
panel_8 = Panel("0.68")  # disabled
panel_9 = Panel("40000")  # disabled
mat_4 = Material(Name=panel_7, Type=list_6, YoungsModulus=panel_6, AlphaT=0, Nue=0, Density=panel_8, Strength=panel_9)  # disabled

# ---- group: Karamba
matprops = MaterialPropertiesKaramba3D(
    FamilyOfMaterial="Plywood",
    Name="plywood18",
    YoungsModulusKNCm2Dir1="914.8",
    YoungsModulusKNCm2Dir2="835.2",
    InPlaneShearModulus_kN_cm2="20.6",
    InPlaneLateralContractionCoefficient="0.3",
    TransverseShearModulusKNCm2Dir1="62",
    TransverseShearModulusKNCm2Dir2="62",
    SpecificWeight_kN_m3="6.8",
    CoefficientOfThermalExpansion1CDir1=1.2e-05,
    CoefficientOfThermalExpansion1CDir2=1.2e-05,
    TensileStrengthKNCm2Dir1="3.92",
    TensileStrengthKNCm2Dir2="3.58",
    CompressiveStrengthKNCm2Dir1="-2.72",
    CompressiveStrengthKNCm2Dir2="-2.48",
    ShearStrengthKNCm2Dir12="0.95",
    TsaiWuIntCoeff=0,
    StrengthHypothesis="MISES",
    mode="Orthotropic")

matprops_2 = MaterialPropertiesKaramba3D(
    FamilyOfMaterial="Plywood",
    Name="plywood15",
    YoungsModulusKNCm2Dir1="922.3",
    YoungsModulusKNCm2Dir2="827.7",
    InPlaneShearModulus_kN_cm2="20.7",
    InPlaneLateralContractionCoefficient="0.3",
    TransverseShearModulusKNCm2Dir1="62",
    TransverseShearModulusKNCm2Dir2="62",
    SpecificWeight_kN_m3="6.8",
    CoefficientOfThermalExpansion1CDir1=1.2e-05,
    CoefficientOfThermalExpansion1CDir2=1.2e-05,
    TensileStrengthKNCm2Dir1="3.95",
    TensileStrengthKNCm2Dir2="3.55",
    CompressiveStrengthKNCm2Dir1="-2.74",
    CompressiveStrengthKNCm2Dir2="-2.46",
    ShearStrengthKNCm2Dir12="0.95",
    TsaiWuIntCoeff=0,
    StrengthHypothesis="MISES",
    mode="Orthotropic")

# ----
number_slider_6 = Slider(0.06, range=0..1)

list_7 = ValueList({"Displacements": 1, "Stresses": 2, "SupportForces": 3}, selected=["Displacements", "Stresses", "SupportForces"])  # disabled
ldc_2 = LoadDisplCurve(TimeStepList=[0, 10], ValueList=[0, 1])  # disabled
panel_10 = Panel("s2sa_test33")  # disabled
panel_11 = Panel("10")  # disabled
nonlina_2 = NonLinearAnalysis(
    Name=panel_10,
    Iterations=panel_11,
    EquilibriumAccurancy=0.001,
    OutputSetting=list_7,
    GlobalLDCurve=ldc_2,
    AdaptiveForceControl=0,
    OutputFrequency=1)  # disabled

number_slider_7 = Slider(2.5, range=0..10)

list_8 = ValueList({"Displacements": 1, "Stresses": 2, "SupportForces": 3}, selected=["Displacements", "Stresses", "SupportForces"])  # disabled
panel_12 = Panel("s2sa_test2")  # disabled
lina_2 = LinearAnalysis(Name=panel_12, OutputSetting=list_8)  # disabled

number_slider_8 = Slider(2.6, range=0..10)

# ---- group: Karamba / Loads (Karamba3D)
loads = LoadsKaramba3D(Vector=Vector(0, 0, -1), LCase="0", mode="Gravity")  # -> flatten(Load)

# ----
panel_13 = Panel("hole size?")  # disabled
panel_14 = Panel("2")  # disabled
multiplication_2 = Multiplication(A=width_2, B=panel_14)  # disabled
dom = ConstructDomain(DomainStart=expr("-x/2", width_2), DomainEnd=expr("x/2", width_2))  # disabled
dom_2 = ConstructDomain(DomainStart=expr("-x/2", multiplication_2), DomainEnd=expr("x/2", multiplication_2))  # disabled
number_slider_9 = Slider(0.13, range=0..1)  # disabled
panel_15 = Panel("2")  # disabled
multiplication_3 = Multiplication(A=number_slider_9, B=panel_15)  # disabled
number_slider_10 = Slider(0.25, range=0..1)  # disabled
division_3 = Division(A=multiplication_3, B=panel_15)  # disabled
number_slider_11 = Slider(0.13, range=0..1)
neg_4 = Negative(Value=number_slider_11)
panel_16 = Panel("0")  # disabled
panel_17 = Panel("2")  # disabled
panel_18 = Panel("0")  # disabled
panel_19 = Panel("2")  # disabled
number_slider_12 = Slider(0.1, range=0..0.1)  # disabled
xy_3 = XYPlane(Origin=Point(0, 0, 0))
_0 = Relay()

# ---- group: Size of Plywood Sheets [m]
number_slider_13 = Slider(0.96, range=0..1)
number_slider_14 = Slider(0.46, range=0..1)

# ---- group: laserCut / Edit this fields
panel_20 = Panel("phoneNumber")
panel_21 = Panel("Surname")
panel_22 = Panel("Name")

# ----
number_slider_15 = Slider(0.013, range=0..0.1)
dom_3 = ConstructDomain(DomainStart=expr("-x/2", number_slider_14), DomainEnd=expr("x/2", number_slider_14))
dom_4 = ConstructDomain(DomainStart=expr("-x/2", number_slider_13), DomainEnd=expr("x/2", number_slider_13))
neg_5 = Negative(Value=number_slider_15)
panel_23 = Panel("""A
B
C""")
number_slider_16 = Slider(0.06, range=0..1)
number_slider_17 = Slider(0.3, range=0..1)
number_slider_18 = Slider(1, range=0..100)
interior_cut = Relay()
_0_2 = Relay()
neg_6 = Negative(Value=Slider(450, range=0..1000))
X_3 = UnitX(Factor=neg_6)

# ---- group: int_pure mesh
wbnaked = WeaverbirdsNakedBoundary(MeshClosedPolylines=mesh)
demesh_2 = DeconstructMesh(Mesh=mesh)  # -> Vertices, Faces, Colours, Normals

# ----
splitatcorners = SplitAtCorners(Poly=wbnaked, Angle=1)  # -> Corners, Parts
item_3 = ListItem(List=splitatcorners.Corners, Index=Slider(5, range=0..5), Wrap=True)
seam2crvcorn = SeamToCurveCorner(Curve=wbnaked, Guide=item_3)  # -> Adjusted, Point, R

# ---- group: int_pure mesh (continued)
splitatcorners_2 = SplitAtCorners(Poly=seam2crvcorn.Adjusted, Angle=1)  # -> Corners, Parts
dispatch_4 = Dispatch(List=splitatcorners_2.Parts, DispatchPattern=[True, False])  # -> ListA, ListB
crv_3 = Curve(dispatch_4.ListB)
midpt = CurveMiddle(Curve=crv_3)
vec2pt = Vector2Pt(PointA=area.Centroid, PointB=midpt, Unitize=False)  # -> Vector, Length
amp = Amplitude(Vector=vec2pt.Vector, Amplitude=Slider(10, range=0.5..10))
move_2 = Move(Geometry=area.Centroid, Motion=amp)  # -> Geometry, Transform
polygon_2 = Polygon(Plane=move_2.Geometry, Radius=merge, Segments=6, FilletRadius=0)  # -> Polygon, Length
incurves = PointInCurves(Point=demesh_2.Vertices, Curves=polygon_2.Polygon)  # -> Relationship, Index, Point
equals_2 = Equality(FirstNumber=incurves.Relationship, SecondNumber=2)  # -> Equality, Inequality
cullv = CullVertices(Mesh=mesh, Pattern=equals_2.Equality, Shrink=True)

# ---- group: support Pt
offset_2 = OffsetCurve(Curve=seam2crvcorn.Adjusted, Distance="-0.3", Corners=1)
incurve_2 = PointInCurve(Point=nv.NakedPts, Curve=offset_2)  # -> Relationship, Point
equals_3 = Equality(FirstNumber=incurve_2.Relationship, SecondNumber="0")  # -> Equality, Inequality
cull_2 = CullPattern(List=nv.NakedPts, CullPattern=equals_3.Equality)
crv_4 = Curve(dispatch_4.ListA)
offset_3 = PolylineOffset(Curve=crv_4, Distance="0.05", Divisions=0)  # -> C, H
incurve_3 = PointInCurve(Point=cull_2, Curve=graft(offset_3.C))  # -> Relationship, Point
equals_4 = Equality(FirstNumber=incurve_3.Relationship, SecondNumber="2")  # -> Equality, Inequality
cull_3 = CullPattern(List=cull_2, CullPattern=equals_4.Equality)
pt_2 = Point(flatten(cull_3))

# ---- group: net grid
mesh_2 = Mesh(cullv)
medges_2 = MeshEdges(Mesh=mesh_2)  # -> NakedEdges, InteriorEdges, NonManifoldEdges
end_2 = EndPoints(Curve=graft(medges_2.NakedEdges))  # -> Start, End
relay = Relay([end_2.Start, end_2.End])
incurves_2 = PointInCurves(Point=relay, Curves=offset_3.C)  # -> Relationship, Index, Point
ma = MassAddition(Input=incurves_2.Relationship)  # -> Result, PartialResults
equals_5 = Equality(FirstNumber=ma.Result, SecondNumber=4)  # -> flatten(Equality), flatten(Inequality)
cull_4 = CullPattern(List=medges_2.NakedEdges, CullPattern=equals_5.Inequality)
merge_3 = Merge(Data1=cull_4, Data2=medges_2.InteriorEdges)
wbweave = WeaverbirdsMeshFromLinesWeaveBack(Lines=merge_3, MaximumValence=4)

# ---- group: 3 way direction final shape
wbedges_2 = WeaverbirdsMeshEdges(MeshOrPolylines=wbweave)
X_4 = UnitX(Factor=1)
angle_3 = Angle(VectorA=wbedges_2, VectorB=X_4)  # -> Angle, Reflex
pi_5 = Pi(Factor=0.5)
subtraction_4 = Subtraction(A=angle_3.Angle, B=pi_5)
pi_6 = Pi(Factor=Slider(0.19, range=0..2))
abs_3 = Absolute(Value=subtraction_4)
smaller_2 = SmallerThan(FirstNumber=abs_3, SecondNumber=pi_6)  # -> SmallerThan, OrEqualTo
dispatch_5 = Dispatch(List=wbedges_2, DispatchPattern=smaller_2.SmallerThan)  # -> ListA, ListB
pt_3 = Point(Point(1.5, 1, 0))
vec_2 = Vector(pt_3)
geo_3 = Geometry(dispatch_5.ListA)
angle_4 = Angle(VectorA=geo_3, VectorB=vec_2)  # -> Angle, Reflex
pi_7 = Pi(Factor=0.5)
subtraction_5 = Subtraction(A=angle_4.Angle, B=pi_7)
pi_8 = Pi(Factor=Slider(0.2, range=0..2))
abs_4 = Absolute(Value=subtraction_5)
larger_2 = LargerThan(FirstNumber=abs_4, SecondNumber=pi_8)  # -> LargerThan, OrEqualTo
dispatch_6 = Dispatch(List=geo_3, DispatchPattern=larger_2.LargerThan)  # -> ListA, ListB
line_5 = Line(dispatch_6.ListA)
line_6 = Line(dispatch_6.ListB)
line_7 = Line(dispatch_5.ListB)
entwine_3 = Entwine(Branch00=line_5, Branch01=line_6, Branch02=line_7, FlattenInputs=True)

# ----
number_slider_19 = Slider(-1, range=-10..10)
crv_5 = Curve(crv_4)
midpt_2 = CurveMiddle(Curve=crv_4)
ext = ExtendCurve(Curve=crv_5, Type=0, Start=number_slider_19, End=number_slider_19)
vec2pt_2 = Vector2Pt(PointA=area.Centroid, PointB=midpt_2, Unitize=True)  # -> Vector, Length

end_3 = EndPoints(Curve=ext)  # -> Start, End
merge_4 = Merge(Data1=graft(end_3.Start), Data2=graft(end_3.End))
amp_2 = Amplitude(Vector=vec2pt_2.Vector, Amplitude=Slider(-2.72, range=-5..10))
move_3 = Move(Geometry=merge_4, Motion=graft(amp_2))  # -> Geometry, Transform

midpt_3 = CurveMiddle(Curve=ext)  # -> graft(Midpoint)
amp_3 = Amplitude(Vector=vec2pt_2.Vector, Amplitude=Slider(0.08, range=-5..10))
move_4 = Move(Geometry=midpt_3, Motion=graft(amp_3))  # -> Geometry, Transform

item_4 = ListItem(List=move_3.Geometry, Index=0, Wrap=True)  # -> Item, Item1
ins = InsertItems(List=move_3.Geometry, Item=move_4.Geometry, Indices=1, Wrap=False)
intcrv = Interpolate(Vertices=ins, Degree=3, Periodic=False, KnotStyle=1)  # -> simplify(flatten(Curve)), Length, Domain
arc = Arc3Pt(PointA=item_4.Item, PointB=move_4.Geometry, PointC=item_4.Item1)  # -> simplify(flatten(Arc)), Plane, Radius

number_slider_20 = Slider(12.7, range=1..100)
join_2 = JoinCurves(Curves=entwine, Preserve=False)
crv_6 = Curve(splitatcorners_2.Parts)
xz = XZPlane(Origin=Point(0, 0, 0))
Z_2 = UnitZ(Factor=Slider(0, range=0..2))
pt_4 = Point([nv.ClothedPts, nv.NakedPts])
rod = Rod(Polyline=crv_6, LengthFactor=1, AngleFactor=1, AxialStrength=Slider(0.62, range=0..5), BendStrength=number_slider_20)
rod_2 = Rod(Polyline=join_2, LengthFactor=1, AngleFactor=1, AxialStrength=Slider(55, range=0..100), BendStrength=number_slider_20)
oncurve = OnCurve(Points=cull_3, Curve=graft(arc.Arc), Strength=Slider(150, range=1..200))
anchorxyz = AnchorXYZ(Point=pt_2, X=False, Y=False, Z=Toggle(True), Strength=10000)
onplane = OnPlane(Points=cull, Plane=xz, Strength=Slider(20, range=0..100))
smooth = Smooth(M=mesh, Strength=1)
pressure = Pressure(M=mesh, Strength=Slider(0.45, range=0..1.5))
load = Load(Point=pt_4, ForceVector=Z_2, Weighting=1)
show = Show(G=wbweave)
show_2 = Show(G=entwine_3)
show_3 = Show(G=mesh)
show_4 = Show(G=entwine)
relay_2 = Relay([ea, ea_3, ea_2])

previewlw = CustomPreviewLineweights(Geometry=arc.Arc, Shader=ColourSwatch(SwatchColor=RGB(196, 14, 14)), Thickness=Slider(10, range=0..10), Absolute=False)
entwine_4 = Entwine(
    Branch00=show_4,
    Branch01=show_3,
    Branch02=[rod_2, load, anchorxyz, oncurve, rod, pressure, smooth, onplane],
    Branch03=relay_2,
    Branch04=show_2,
    Branch05=show,
    FlattenInputs=True)
zombiesolver = ZombieSolver(GoalObjects=entwine_4, Threshold=1e-10, Tolerance=0.0001, MaxIterations=50000)  # -> I, V, O
unflatten = UnflattenTree(Tree=zombiesolver.O, Guide=entwine_4)

mesh_3 = TreeBranch(Tree=unflatten, Path="{0;1}", MaintainPaths=True)

_3way_nets = TreeBranch(Tree=unflatten, Path="{0;0}", MaintainPaths=True)

crv_7 = Curve(_3way_nets)
unflatten_2 = UnflattenTree(Tree=crv_7, Guide=entwine)
mesh_4 = Mesh(mesh_3)

geodésicas_imposición_angulos_opuestos_i_2 = Slider(3.709, range=0..15)  # "Geodésicas: imposición angulos opuestos iguales"
vn_2 = VertexNeighbours(Mesh=mesh_4, VertexNumber=nv.ClothedIndex)  # -> Vertex, Neighbours, Normal
ln_2 = Line(StartPoint=simplify(graft(vn_2.Vertex)), EndPoint=simplify(vn_2.Neighbours))
item_5 = ListItem(List=ln_2, Index=0, Wrap=True)  # -> Item, Item1, Item2, Item3, Item4, Item5
_10º_2 = PowerOf10(Value=geodésicas_imposición_angulos_opuestos_i_2)

nv_2 = NakedVertices(Mesh=mesh_4)  # -> ClothedIndex, NakedIndex, ClothedPts, NakedPts
demesh_3 = DeconstructMesh(Mesh=mesh_4)  # -> Vertices, Faces, Colours, Normals
index = ItemIndex(List=nv.NakedPts, Item=pt_2)
patch = Patch(Points=demesh_3.Vertices, Spans=Slider(60, range=0..100), Flexibility=1, Trim=True)
item_6 = ListItem(List=nv_2.NakedPts, Index=index, Wrap=True)
srf = Surface(patch)
mesh_5 = Mesh(srf)
relay_3 = Relay([nv_2.NakedPts, nv_2.ClothedPts])

branch = TreeBranch(Tree=unflatten, Path="{0;5}", MaintainPaths=True)

join_3 = JoinCurves(Curves=unflatten_2, Preserve=False)
explode_2 = Explode(Curve=join_3, Recursive=True)  # -> Segments, Vertices
lng = ListLength(List=explode_2.Segments)
cull_i = CullIndex(List=explode_2.Segments, Indices=expr("x-1", lng), Wrap=True)
shift_2 = ShiftList(List=explode_2.Segments, Shift=1, Wrap=False)

wbnaked_2 = WeaverbirdsNakedBoundary(MeshClosedPolylines=mesh_4)
splitatcorners_3 = SplitAtCorners(Poly=wbnaked_2, Angle=1)  # -> Corners, Parts
explode_3 = Explode(Curve=splitatcorners_3.Parts, Recursive=True)  # -> Segments, Vertices
shift_3 = ShiftList(List=explode_3.Segments, Shift=1, Wrap=True)

# ---- group: area & entrance check
wbnaked_3 = WeaverbirdsNakedBoundary(MeshClosedPolylines=branch)
splitatcorners_4 = SplitAtCorners(Poly=wbnaked_3, Angle=Slider(0.6, range=0..1))  # -> flatten(Corners), Parts
demesh_4 = DeconstructMesh(Mesh=branch)  # -> Vertices, Faces, Colours, Normals
pdecon = Deconstruct(Point=flatten(demesh_4.Vertices))  # -> XComponent, YComponent, ZComponent
project = Project(Geometry=branch, Plane=PlaneXY(0, 0, 0))  # -> Geometry, Transform
pdecon_2 = Deconstruct(Point=splitatcorners_4.Corners)  # -> XComponent, YComponent, ZComponent
extremums = MinMax(Number=pdecon_2.ZComponent)  # -> Minimum, Maximum
extremums_2 = MinMax(Number=pdecon.ZComponent)  # -> Minimum, Maximum
area_2 = Area(Geometry=project.Geometry)  # -> Area, Centroid
pavillion_area = Panel(area_2.Area)
entrance_height = Panel(extremums.Maximum)
top_height = Panel(extremums_2.Maximum)

# ----
index_2 = ItemIndex(List=demesh.Vertices, Item=cull)
xz_2 = XZPlane(Origin=Point(0, 0, 0))
item_7 = ListItem(List=demesh_3.Vertices, Index=index_2, Wrap=True)

crv_8 = Curve(arc.Arc)

culled_networks = TreeBranch(Tree=unflatten, Path="{0;4}", MaintainPaths=True)

culled_mesh = TreeBranch(Tree=unflatten, Path="{0;5}", MaintainPaths=True)

mesh_uv = MeshSurface(Surface=srf, UCount=number_slider_2, VCount=number_slider_2, Overhang=True, Equalize=False)
mesh_6 = Mesh(project.Geometry)

length_line = LengthLine(Line=flatten([explode_2.Segments, explode_3.Segments]), Strength=Slider(0.06, range=0.06..20))
angle_5 = Angle(LineA=cull_i, LineB=shift_2, Strength=Slider(19.32, range=0..20))
angle_6 = Angle(LineA=explode_3.Segments, LineB=shift_3, Strength=Slider(1.049, range=0..20))
ea_4 = EqualAngle(LineA=[item_5.Item, item_5.Item3], LineB=[item_5.Item1, item_5.Item4], Strength=_10º_2)
ea_5 = EqualAngle(LineA=[item_5.Item1, item_5.Item4], LineB=[item_5.Item2, item_5.Item5], Strength=_10º_2)
ea_6 = EqualAngle(LineA=[item_5.Item2, item_5.Item5], LineB=[item_5.Item3, item_5.Item], Strength=_10º_2)
anchorxyz_2 = AnchorXYZ(Point=item_6, X=False, Y=False, Z=True, Strength=Slider(10000, range=0..10000))  # disabled
onplane_2 = OnPlane(Points=item_7, Plane=xz_2, Strength=Slider(4, range=0..100))
oncurve_2 = OnCurve(Points=item_6, Curve=crv_8, Strength=Slider(1, range=0..10))  # disabled
onmesh = OnMesh(Points=relay_3, Mesh=mesh_uv, Strength=Slider(1000, range=0..1000))
mesh_7 = Show(G=mesh_4)
_3way_nets_2 = Show(G=unflatten_2)
show_5 = Show(G=ln_2)
show_6 = Show(G=culled_networks)
show_7 = Show(G=culled_mesh)
clean = CleanTree(RemoveNulls=True, RemoveInvalid=True, RemoveEmpty=False, Tree=angle_5)

onplane_3 = OnPlane(Points=item_6, Plane=xy, Strength=Slider(5000, range=0..10000))
entwine_5 = Entwine(
    Branch00=mesh_7,
    Branch01=_3way_nets_2,
    Branch02=[onmesh, anchorxyz_2, oncurve_2],
    Branch03=[length_line, clean, angle_6, onplane_2, onplane_3],
    Branch04=[ea_4, ea_5, ea_6],
    Branch05=show_6,
    Branch06=show_7,
    Branch07=show_5,
    FlattenInputs=True)
zombiesolver_2 = ZombieSolver(GoalObjects=entwine_5, Threshold=1e-10, Tolerance=0.0001, MaxIterations="2500")  # -> I, V, O
unflatten_3 = UnflattenTree(Tree=zombiesolver_2.O, Guide=entwine_5)
bang = ExplodeTree(Data=unflatten_3)  # -> Branch0, Branch1, Branch2, Branch3, Branch4, Branch5, Branch6, Branch7
mesh_final = Mesh(flatten(bang.Branch6))
unflatten_4 = UnflattenTree(Tree=bang.Branch5, Guide=entwine_3)
line_8 = Line(unflatten_4)

join_4 = JoinCurves(Curves=line_8, Preserve=False)  # disabled
bang_2 = ExplodeTree(Data=line_8)  # -> Branch0, Branch1, Branch2; disabled
number_slider_21 = Slider(2, range=0..10)  # disabled
end_4 = EndPoints(Curve=join_4)  # -> Start, End; disabled
crv_9 = Curve(bang_2.Branch1)  # disabled
crv_10 = Curve(bang_2.Branch2)  # disabled
crv_11 = Curve(bang_2.Branch0)  # disabled
join_5 = JoinCurves(Curves=crv_10, Preserve=False)  # disabled
join_6 = JoinCurves(Curves=crv_9, Preserve=False)  # disabled
len_2 = Length(Curve=join_4)  # disabled
len_3 = Length(Curve=join_5)  # disabled
len_4 = Length(Curve=join_6)  # disabled
explode_4 = Explode(Curve=join_4, Recursive=True)  # -> Segments, Vertices; disabled
integer_division = IntegerDivision(A=len_2, B=number_slider_21)  # -> expr("x+1", Result); disabled
integer_division_2 = IntegerDivision(A=len_3, B=number_slider_21)  # -> expr("x+1", Result); disabled
integer_division_3 = IntegerDivision(A=len_4, B=number_slider_21)  # -> expr("x+1", Result); disabled
midpt_4 = CurveMiddle(Curve=explode_4.Segments)  # disabled
divide = DivideCurve(Curve=join_5, Count=integer_division_2, Kinks=False)  # -> Points, Tangents, Parameters; disabled
divide_2 = DivideCurve(Curve=join_6, Count=integer_division_3, Kinks=False)  # -> Points, Tangents, Parameters; disabled
divide_3 = DivideCurve(Curve=join_4, Count=integer_division, Kinks=False)  # -> Points, Tangents, Parameters; disabled
cp = ClosestPoint(Point=divide_3.Points, Cloud=midpt_4)  # -> ClosestPoint, CPIndex, Distance; disabled
panel_24 = Panel(divide_3.Points)  # disabled
panel_25 = Panel("""0
-1""")  # disabled
cull_i_2 = CullIndex(List=cp.ClosestPoint, Indices=panel_25, Wrap=True)  # disabled
crv_cp = CurveClosestPoint(Point=cull_i_2, Curve=graft(join_4))  # -> Point, Parameter, Distance; disabled
graft = GraftTree(Tree=join_4, IncludeEmptyLists=True, IncludeNullItems=True)  # disabled
number_slider_22 = Slider(0.07, range=0..0.1)  # disabled
shatter = Shatter(Curve=graft, Parameters=crv_cp.Parameter)  # disabled
panel_26 = Panel(graft)  # disabled
panel_27 = Panel(crv_cp.Parameter)  # disabled
len_5 = Length(Curve=shatter)  # disabled
dots = DotDisplay(Point=[end_4.Start, end_4.End, crv_cp.Point], Colour=RGB(0, 0, 0), Size=number_slider_22)  # disabled
bnd = Bounds(Numbers=flatten(len_5))  # disabled
extremums_3 = MinMax(Number=flatten(len_5))  # -> Minimum, Maximum; disabled
panel_28 = Panel(bnd)  # disabled
gradient = Gradient(
    LowerLimit=extremums_3.Minimum,
    UpperLimit=extremums_3.Maximum,
    Parameter=len_5,
    stops=[0: RGB(243, 57, 0), 0.1: RGB(236, 27, 60), 0.2: RGB(210, 0, 118), 0.3: RGB(103, 0, 120), 0.4: RGB(39, 72, 161), 0.5: RGB(1, 192, 229), 0.6: RGB(18, 178, 90), 0.7: RGB(79, 186, 8), 0.8: RGB(220, 237, 32), 0.9: RGB(247, 159, 20), 1: RGB(243, 57, 0)])  # disabled
index_3 = ItemIndex(List=len_5, Item=extremums_3.Maximum)  # disabled
num = Number(flatten(len_5))  # disabled
panel_29 = Panel(len_5)  # disabled
bar_graph = BarGraph(num, BarColor=RGB(255, 0, 90))  # disabled
number_slider_23 = Slider(5, range=0..10)  # disabled
jitter = Jitter(List=gradient, Jitter=1, Seed=2)  # -> Values, Indices; disabled
previewlw_2 = CustomPreviewLineweights(Geometry=shatter, Shader=jitter.Values, Thickness=number_slider_23, Absolute=False)  # disabled

join_7 = JoinCurves(Curves=line_8, Preserve=False)
len_6 = Length(Curve=join_7)
explode_5 = Explode(Curve=join_7, Recursive=True)  # -> Segments, Vertices
intcrv_2 = Interpolate(Vertices=explode_5.Vertices, Degree=3, Periodic=False, KnotStyle=1)  # -> Curve, Length, Domain
sort_2 = SortList(Keys=len_6)  # -> Keys, ValuesA
pshift = ShiftPaths(Data=intcrv_2.Curve, Offset=-1)
panel_30 = Panel(sort_2.Keys)
crv_12 = Curve(reparameterize(pshift))
item_8 = ListItem(List=join_7, Index=0, Wrap=True)  # -> flatten(Item)
number_slider_24 = Slider(19, range=0..100)
shift_4 = ShiftList(List=item_8, Shift=1, Wrap=True)  # -> graft(List)
project_2 = Project(Geometry=shift_4, Plane=PlaneXY(0, 0, 0))  # -> Geometry, Transform
project_3 = Project(Geometry=crv_12, Plane=PlaneXY(0, 0, 0))  # -> Geometry, Transform
ext_2 = ExtendCurve(Curve=project_2.Geometry, Type=0, Start=number_slider_24, End=number_slider_24)
ext_3 = ExtendCurve(Curve=project_3.Geometry, Type=0, Start=number_slider_24, End=number_slider_24)
ccx = CurveCurve(CurveA=ext_3, CurveB=ext_2)  # -> simplify(Points), ParamsA, ParamsB
pshift_2 = ShiftPaths(Data=ccx.Points, Offset=-1)  # -> simplify(Data)
alongcrv = SortAlongCurve(Points=pshift_2, Curve=ext_2)  # -> Points, Indices
item_9 = ListItem(List=crv_12, Index=alongcrv.Indices, Wrap=True)

# ---- group: area & entrance check
mesh_8 = Mesh(bang.Branch0)
wbnaked_4 = WeaverbirdsNakedBoundary(MeshClosedPolylines=mesh_8)
wbnaked_5 = WeaverbirdsNakedBoundary(MeshClosedPolylines=mesh_final)
splitatcorners_5 = SplitAtCorners(Poly=wbnaked_4, Angle=Slider(0.2, range=0..1))  # -> flatten(Corners), Parts
splitatcorners_6 = SplitAtCorners(Poly=wbnaked_5, Angle=Slider(0.5, range=0..1))  # -> flatten(Corners), Parts
demesh_5 = DeconstructMesh(Mesh=mesh_8)  # -> Vertices, Faces, Colours, Normals
pdecon_3 = Deconstruct(Point=flatten(splitatcorners_5.Corners))  # -> XComponent, YComponent, ZComponent
pdecon_4 = Deconstruct(Point=flatten(demesh_5.Vertices))  # -> XComponent, YComponent, ZComponent
project_4 = Project(Geometry=mesh_final, Plane=PlaneXY(0, 0, 0))  # -> Geometry, Transform
pdecon_5 = Deconstruct(Point=splitatcorners_6.Corners)  # -> XComponent, YComponent, ZComponent
extremums_4 = MinMax(Number=pdecon_3.ZComponent)  # -> Minimum, Maximum
extremums_5 = MinMax(Number=pdecon_4.ZComponent)  # -> Minimum, Maximum
extremums_6 = MinMax(Number=pdecon_5.ZComponent)  # -> Minimum, Maximum
area_3 = Area(Geometry=project_4.Geometry)  # -> Area, Centroid
mesh_9 = Mesh(project_4.Geometry)
pavillion_area_2 = Panel(area_3.Area)
full_mesh_entrance_height = Panel(extremums_4.Maximum)
top_height_2 = Panel(extremums_5.Maximum)
entrance_height_2 = Panel(extremums_6.Maximum)

# ---- group: angle visualization
unflatten_5 = UnflattenTree(Tree=bang.Branch7, Guide=ln_2)  # disabled
number_slider_25 = Slider(0.3, range=0..1)  # disabled
toggle = GroupToggle(ToggleActive=True, ToggleVisible=False)  # disabled
subcrv = SubCurve(BaseCurve=reparameterize(unflatten_5), Domain=number_slider_25)  # disabled
shift_5 = ShiftList(List=subcrv, Shift=1, Wrap=True)  # disabled
angle_7 = Angle(VectorA=subcrv, VectorB=shift_5)  # -> Angle, Reflex; disabled
item_10 = ListItem(List=angle_7.Angle, Index=0, Wrap=True)  # -> Item, Item1, Item2, Item3, Item4, Item5; disabled
subtraction_6 = Subtraction(A=item_10.Item, B=item_10.Item3)  # disabled
subtraction_7 = Subtraction(A=item_10.Item1, B=item_10.Item4)  # disabled
subtraction_8 = Subtraction(A=item_10.Item2, B=item_10.Item5)  # disabled
merge_5 = Merge(Data1=subtraction_6, Data2=subtraction_7, Data3=subtraction_8)  # disabled
merge_6 = Merge(Data1=simplify(graft(subcrv)), Data2=simplify(graft(shift_5)))  # disabled
abs_5 = Absolute(Value=merge_5)  # disabled
ma_2 = MassAddition(Input=abs_5)  # -> Result, PartialResults; disabled
bnd_2 = Bounds(Numbers=flatten(abs_5))  # disabled
avr_2 = Average(Input=flatten(ma_2.Result))  # disabled
dedomain = DeconstructDomain(Domain=bnd_2)  # -> Start, End; disabled
average_of_absolute_angle_difference = Panel(avr_2)  # disabled
gradient_2 = Gradient(
    LowerLimit=dedomain.Start,
    UpperLimit=dedomain.End,
    Parameter=abs_5,
    stops=[0: RGB(243, 57, 0), 0.1: RGB(236, 27, 60), 0.2: RGB(210, 0, 118), 0.3: RGB(103, 0, 120), 0.4: RGB(39, 72, 161), 0.5: RGB(1, 192, 229), 0.6: RGB(18, 178, 90), 0.7: RGB(79, 186, 8), 0.8: RGB(220, 237, 32), 0.9: RGB(247, 159, 20), 1: RGB(243, 57, 0)])  # disabled
loft = Loft(Curves=merge_6, Options={Adjust=False, Closed=False, LoftEnds=0, LoftSimp=0, LoftType=0, Rebuild=10, Refit=0.01})  # disabled
pshift_3 = ShiftPaths(Data=loft, Offset=-1)  # disabled
jitter_2 = Jitter(List=gradient_2, Jitter=1, Seed=89)  # -> Values, Indices; disabled
item_11 = ListItem(List=pshift_3, Index=0, Wrap=True)  # -> Item, Item1, Item2, Item3, Item4, Item5; disabled
item_12 = ListItem(List=jitter_2.Values, Index=0, Wrap=True)  # -> Item, Item1, Item2, Item3, Item4, Item5; disabled
previewmat = CustomPreviewMaterials(Geometry=[item_11.Item, item_11.Item3], DiffuseColor=[item_12.Item, item_12.Item3])  # disabled
previewmat_2 = CustomPreviewMaterials(Geometry=[item_11.Item1, item_11.Item4], DiffuseColor=[item_12.Item1, item_12.Item4])  # disabled
previewmat_3 = CustomPreviewMaterials(Geometry=[item_11.Item2, item_11.Item5], DiffuseColor=[item_12.Item2, item_12.Item5])  # disabled

# ----
bang_3 = ExplodeTree(Data=item_9)  # -> Branch0, Branch1, Branch2
entwine_6 = Entwine(Branch00=bang_3.Branch1, Branch01=bang_3.Branch0, Branch02=bang_3.Branch2, FlattenInputs=True)
bang_4 = ExplodeTree(Data=entwine_6)  # -> Branch0, Branch1, Branch2
crv_13 = Curve(bang_4.Branch0)

len_7 = Length(Curve=item_9)
tstat = TreeStatistics(Tree=len_7)  # -> Paths, Length, Count
series = Series(Start=0, Step=Slider(0.18, range=0..1), Count=tstat.Length)
series_2 = Series(Start=0, Step=Slider(13, range=0..100), Count=tstat.Count)
pt_5 = ConstructPoint(XCoordinate=series, YCoordinate=graft(series_2), ZCoordinate=0)
Y = UnitY(Factor=1)
line_9 = LineSDL(Start=pt_5, Direction=Y, Length=len_7)  # -> simplify(graft(Line))

crv_14 = Curve(bang_4.Branch0)
crv_15 = Curve(bang_4.Branch1)
crv_16 = Curve(bang_4.Branch2)
ccx_2 = CurveCurve(CurveA=graft(crv_14), CurveB=crv_15)  # -> Points, ParamsA, ParamsB
ccx_3 = CurveCurve(CurveA=graft(crv_15), CurveB=crv_16)  # -> Points, ParamsA, ParamsB
ccx_4 = CurveCurve(CurveA=graft(crv_16), CurveB=crv_14)  # -> Points, ParamsA, ParamsB
pshift_4 = ShiftPaths(Data=ccx_2.ParamsA, Offset=-1)
pshift_5 = ShiftPaths(Data=ccx_3.ParamsA, Offset=-1)
pshift_6 = ShiftPaths(Data=ccx_4.ParamsA, Offset=-1)
abs_6 = Absolute(Value=pshift_4)
abs_7 = Absolute(Value=pshift_5)
abs_8 = Absolute(Value=pshift_6)
merge_7 = Merge(Data1=abs_6, Data2=abs_7, Data3=abs_8)  # -> simplify(Result)

cull_5 = CullPattern(List=crv_16, CullPattern=panel_3)
shift_6 = ShiftList(List=cull_5, Shift=1, Wrap=True)
partition = PartitionList(List=shift_6, Size="2")
lng_2 = ListLength(List=flatten(partition))  # -> expr("X-1", Length)
partition_2 = PartitionList(List=cull_5, Size="2")
crv_17 = Curve(bang_4.Branch0)
crv_18 = Curve(bang_4.Branch1)
crv_19 = Curve(bang_4.Branch2)
loft_2 = Loft(Curves=partition_2, Options={Adjust=False, Closed=False, LoftEnds=0, LoftSimp=0, LoftType=3, Rebuild=10, Refit=0.01})
loft_3 = Loft(Curves=partition, Options={Adjust=False, Closed=False, LoftEnds=0, LoftSimp=0, LoftType=3, Rebuild=10, Refit=0.01})
shatter_2 = Shatter(Curve=graft(crv_15), Parameters=pshift_5)
shatter_3 = Shatter(Curve=graft(crv_16), Parameters=pshift_6)
shatter_4 = Shatter(Curve=graft(crv_14), Parameters=pshift_4)
entwine_7 = Entwine(Branch00=crv_17, Branch01=crv_18, Branch02=crv_19, FlattenInputs=True)
cull_i_3 = CullIndex(List=flatten(loft_2), Indices="0", Wrap=True)
cull_i_4 = CullIndex(List=flatten(loft_3), Indices=lng_2, Wrap=True)
end_5 = EndPoints(Curve=shatter_2)  # -> Start, End
end_6 = EndPoints(Curve=shatter_3)  # -> Start, End
end_7 = EndPoints(Curve=shatter_4)  # -> Start, End
mesh_uv_2 = MeshSurface(Surface=cull_i_3, UCount=number_slider_3, VCount=5, Overhang=True, Equalize=False)
mesh_uv_3 = MeshSurface(Surface=cull_i_4, UCount=number_slider_3, VCount=5, Overhang=True, Equalize=False)
ln_3 = Line(StartPoint=end_5.Start, EndPoint=end_5.End)
ln_4 = Line(StartPoint=end_6.Start, EndPoint=end_6.End)
ln_5 = Line(StartPoint=end_7.Start, EndPoint=end_7.End)
tri = Triangulate(Mesh=mesh_uv_2)  # -> Mesh, Count
tri_2 = Triangulate(Mesh=mesh_uv_3)  # -> Mesh, Count
explode_6 = Explode(Curve=entwine_7, Recursive=True)  # -> Segments, Vertices
wbweave_2 = WeaverbirdsMeshFromLinesWeaveBack(Lines=flatten([ln_3, ln_4, ln_5]), MaximumValence=4)
unroller = Unroller(Strip=tri.Mesh, Unroll=1)
unroller_2 = Unroller(Strip=tri_2.Mesh, Unroll=1)
line_10 = Line(explode_6.Segments)
grphmsh = GraphFromMesh(InputMesh=wbweave_2)
wbweave_3 = WeaverbirdsMeshFromLinesWeaveBack(Lines=flatten(explode_6.Segments), MaximumValence=4)
stripper = Stripper(Mesh=wbweave_2)
bang_5 = ExplodeTree(Data=entwine_7)  # -> Branch0, Branch1, Branch2
unroller_3 = Unroller(Strip=stripper, Unroll=1)
mstk = MSTKruskal(MeshGraph=grphmsh)
unflatten_6 = UnflattenTree(Tree=line_9, Guide=item_9)
eval_3 = EvaluateCurve(Curve=line_9, Parameter=merge_7)  # -> Point, Tangent, Angle

division_4 = Division(A=width_2, B="2")
neg_7 = Negative(Value=division_4)
offset_4 = OffsetCurve(Curve=unflatten_6, Distance=neg_7, Corners=1)
offset_5 = OffsetCurve(Curve=unflatten_6, Distance=division_4, Corners=1)
ext_4 = ExtendCurve(Curve=offset_4, Type=0, Start=division_4, End=division_4)
ext_5 = ExtendCurve(Curve=offset_5, Type=0, Start=division_4, End=division_4)
end_8 = EndPoints(Curve=ext_4)  # -> Start, End
end_9 = EndPoints(Curve=ext_5)  # -> Start, End
ln_6 = Line(StartPoint=end_8.Start, EndPoint=end_9.Start)
ln_7 = Line(StartPoint=end_8.End, EndPoint=end_9.End)
join_8 = JoinCurves(Curves=[ext_4, ln_6, ext_5, ln_7], Preserve=False)

crv_20 = Curve(bang_5.Branch2)
crv_21 = Curve(bang_5.Branch0)
crv_22 = Curve(bang_5.Branch1)
item_13 = ListItem(List=crv_20, Index=Slider(0, range=0..16), Wrap=True)
len_8 = Length(Curve=crv_21)
panel_31 = Panel(len_8)
relay_4 = Relay([crv_21, crv_22, crv_20])
patch_2 = Patch(Curves=flatten(relay_4), Spans=Slider(40, range=0..100), Flexibility=Slider(1.47, range=0..2), Trim=True)
mesh_10 = Mesh(bang.Branch6)
nv_3 = NakedVertices(Mesh=mesh_10)  # -> ClothedIndex, NakedIndex, ClothedPts, NakedPts

panel_32 = Panel("""0
1""")
cull_6 = CullPattern(List=crv_21, CullPattern=panel_32)
len_9 = Length(Curve=cull_6)
multiplication_4 = Multiplication(A=len_9, B=Slider(3.4, range=0..10))
divide_4 = DivideCurve(Curve=cull_6, Count=multiplication_4, Kinks=False)  # -> Points, Tangents, Parameters
srf_cp = SurfaceClosestPoint(Point=divide_4.Points, Surface=reparameterize(patch_2))  # -> Point, UVPoint, flatten(Distance)
evalsrf = EvaluateSurface(Surface=reparameterize(patch_2), Point=srf_cp.UVPoint)  # -> Point, Normal, UDirection, VDirection, Frame
multiplication_5 = Multiplication(A=height_2, B="2")
amp_4 = Amplitude(Vector=evalsrf.Normal, Amplitude=multiplication_5)
move_5 = Move(Geometry=divide_4.Points, Motion=amp_4)  # -> Geometry, Transform
xprod = CrossProduct(VectorA=divide_4.Tangents, VectorB=evalsrf.Normal, Unitize=False)  # -> Vector, Length
pl = ConstructPlane(Origin=simplify(move_5.Geometry), XAxis=evalsrf.Normal, YAxis=xprod.Vector)

geo_4 = Geometry(nv_3.NakedPts)

len_10 = Length(Curve=crv_20)
multiplication_6 = Multiplication(A=len_10, B=Slider(3.4, range=0..10))
divide_5 = DivideCurve(Curve=crv_20, Count=multiplication_6, Kinks=False)  # -> Points, Tangents, Parameters
srf_cp_2 = SurfaceClosestPoint(Point=divide_5.Points, Surface=reparameterize(patch_2))  # -> Point, UVPoint, flatten(Distance)
evalsrf_2 = EvaluateSurface(Surface=reparameterize(patch_2), Point=srf_cp_2.UVPoint)  # -> Point, Normal, UDirection, VDirection, Frame
neg_8 = Negative(Value="1")
multiplication_7 = Multiplication(A=height_2, B="1")
amp_5 = Amplitude(Vector=evalsrf_2.Normal, Amplitude=multiplication_7)
move_6 = Move(Geometry=divide_5.Points, Motion=amp_5)  # -> Geometry, Transform
xprod_2 = CrossProduct(VectorA=divide_5.Tangents, VectorB=evalsrf_2.Normal, Unitize=False)  # -> Vector, Length
pl_2 = ConstructPlane(Origin=simplify(move_6.Geometry), XAxis=evalsrf_2.Normal, YAxis=xprod_2.Vector)

len_11 = Length(Curve=crv_22)
multiplication_8 = Multiplication(A=len_11, B=Slider(3.4, range=0..10))
divide_6 = DivideCurve(Curve=crv_22, Count=multiplication_8, Kinks=False)  # -> Points, Tangents, Parameters
srf_cp_3 = SurfaceClosestPoint(Point=divide_6.Points, Surface=reparameterize(patch_2))  # -> Point, UVPoint, flatten(Distance)
evalsrf_3 = EvaluateSurface(Surface=reparameterize(patch_2), Point=srf_cp_3.UVPoint)  # -> Point, Normal, UDirection, VDirection, Frame
neg_9 = Negative(Value="2")
multiplication_9 = Multiplication(A=height_2, B=neg_9)
amp_6 = Amplitude(Vector=evalsrf_3.Normal, Amplitude=multiplication_9)
move_7 = Move(Geometry=divide_6.Points, Motion=amp_6)  # -> Geometry, Transform
xprod_3 = CrossProduct(VectorA=divide_6.Tangents, VectorB=evalsrf_3.Normal, Unitize=False)  # -> Vector, Length
pl_3 = ConstructPlane(Origin=simplify(move_7.Geometry), XAxis=evalsrf_3.Normal, YAxis=xprod_3.Vector)

cull_7 = CullPattern(List=crv_20, CullPattern=panel_4)
cull_8 = CullPattern(List=crv_22, CullPattern=panel_5)

len_12 = Length(Curve=cull_7)
multiplication_10 = Multiplication(A=len_12, B=Slider(3.4, range=0..10))
divide_7 = DivideCurve(Curve=cull_7, Count=multiplication_10, Kinks=False)  # -> Points, Tangents, Parameters
srf_cp_4 = SurfaceClosestPoint(Point=divide_7.Points, Surface=reparameterize(patch_2))  # -> Point, UVPoint, flatten(Distance)
evalsrf_4 = EvaluateSurface(Surface=reparameterize(patch_2), Point=srf_cp_4.UVPoint)  # -> Point, Normal, UDirection, VDirection, Frame
neg_10 = Negative(Value="6")
multiplication_11 = Multiplication(A=height_2, B="6")
amp_7 = Amplitude(Vector=evalsrf_4.Normal, Amplitude=multiplication_11)
move_8 = Move(Geometry=divide_7.Points, Motion=amp_7)  # -> Geometry, Transform
xprod_4 = CrossProduct(VectorA=divide_7.Tangents, VectorB=evalsrf_4.Normal, Unitize=False)  # -> Vector, Length
pl_4 = ConstructPlane(Origin=simplify(move_8.Geometry), XAxis=evalsrf_4.Normal, YAxis=xprod_4.Vector)

pdecon_6 = Deconstruct(Point=geo_4)  # -> XComponent, YComponent, ZComponent

len_13 = Length(Curve=cull_8)
multiplication_12 = Multiplication(A=len_13, B=Slider(3.4, range=0..10))
divide_8 = DivideCurve(Curve=cull_8, Count=multiplication_12, Kinks=False)  # -> Points, Tangents, Parameters
srf_cp_5 = SurfaceClosestPoint(Point=divide_8.Points, Surface=reparameterize(patch_2))  # -> Point, UVPoint, flatten(Distance)
evalsrf_5 = EvaluateSurface(Surface=reparameterize(patch_2), Point=srf_cp_5.UVPoint)  # -> Point, Normal, UDirection, VDirection, Frame
neg_11 = Negative(Value="4")
multiplication_13 = Multiplication(A=height_2, B="4")
amp_8 = Amplitude(Vector=evalsrf_5.Normal, Amplitude=multiplication_13)
move_9 = Move(Geometry=divide_8.Points, Motion=amp_8)  # -> Geometry, Transform
xprod_5 = CrossProduct(VectorA=divide_8.Tangents, VectorB=evalsrf_5.Normal, Unitize=False)  # -> Vector, Length
pl_5 = ConstructPlane(Origin=simplify(move_9.Geometry), XAxis=evalsrf_5.Normal, YAxis=xprod_5.Vector)

medges_3 = MeshEdges(Mesh=mesh_10)  # -> NakedEdges, InteriorEdges, NonManifoldEdges
smaller_3 = SmallerThan(FirstNumber=pdecon_6.ZComponent, SecondNumber=Slider(0.15, range=0..1))  # -> SmallerThan, OrEqualTo
cull_9 = CullPattern(List=geo_4, CullPattern=smaller_3.SmallerThan)
crv_23 = Curve(medges_3.NakedEdges)
join_9 = JoinCurves(Curves=crv_23, Preserve=False)
alongcrv_2 = SortAlongCurve(Points=cull_9, Curve=join_9)  # -> Points, Indices
shift_7 = ShiftList(List=alongcrv_2.Points, Shift=1, Wrap=True)
points = PointList(Points=shift_7)
project_5 = Project(Geometry=shift_7, Plane=xy_2)  # -> Geometry, Transform
pgroups = PointGroups(Points=project_5.Geometry, Distance=Slider(3.3, range=0..10))  # -> Groups, Indices
entwine_8 = Entwine(Branch00=crv_17, Branch01=crv_18, Branch02=crv_19, FlattenInputs=True)
rectangle = Rectangle(Plane=pl_3, XSize=symdom_2, YSize=symdom, Radius=0)  # -> Rectangle, Length
rectangle_2 = Rectangle(Plane=pl_2, XSize=symdom_2, YSize=symdom, Radius=0)  # -> Rectangle, Length
rectangle_3 = Rectangle(Plane=pl, XSize=symdom_2, YSize=symdom, Radius=0)  # -> Rectangle, Length
rectangle_4 = Rectangle(Plane=pl_5, XSize=symdom_2, YSize=symdom, Radius=0)  # -> Rectangle, Length
rectangle_5 = Rectangle(Plane=pl_4, XSize=symdom_2, YSize=symdom, Radius=0)  # -> Rectangle, Length
loft_4 = Loft(
    Curves=rectangle.Rectangle,
    Options={Adjust=False, Closed=False, LoftEnds=0, LoftSimp=0, LoftType=0, Rebuild=10, Refit=0.01})
loft_5 = Loft(
    Curves=rectangle_2.Rectangle,
    Options={Adjust=False, Closed=False, LoftEnds=0, LoftSimp=0, LoftType=0, Rebuild=10, Refit=0.01})
loft_6 = Loft(
    Curves=rectangle_3.Rectangle,
    Options={Adjust=False, Closed=False, LoftEnds=0, LoftSimp=0, LoftType=0, Rebuild=10, Refit=0.01})
loft_7 = Loft(
    Curves=rectangle_4.Rectangle,
    Options={Adjust=False, Closed=False, LoftEnds=0, LoftSimp=0, LoftType=0, Rebuild=10, Refit=0.01})
loft_8 = Loft(
    Curves=rectangle_5.Rectangle,
    Options={Adjust=False, Closed=False, LoftEnds=0, LoftSimp=0, LoftType=0, Rebuild=10, Refit=0.01})
intcrv_3 = Interpolate(Vertices=move_7.Geometry, Degree=3, Periodic=False, KnotStyle=1)  # -> Curve, Length, Domain
intcrv_4 = Interpolate(Vertices=move_6.Geometry, Degree=3, Periodic=False, KnotStyle=1)  # -> Curve, Length, Domain
intcrv_5 = Interpolate(Vertices=move_5.Geometry, Degree=3, Periodic=False, KnotStyle=1)  # -> Curve, Length, Domain
intcrv_6 = Interpolate(Vertices=move_9.Geometry, Degree=3, Periodic=False, KnotStyle=1)  # -> Curve, Length, Domain
intcrv_7 = Interpolate(Vertices=move_8.Geometry, Degree=3, Periodic=False, KnotStyle=1)  # -> Curve, Length, Domain
entwine_9 = Entwine(Branch00=intcrv_5.Curve, Branch01=intcrv_6.Curve, Branch02=intcrv_7.Curve, FlattenInputs=True)
crv_24 = Curve(crv_21)
crv_25 = Curve(crv_22)
crv_26 = Curve(crv_20)
entwine_10 = Entwine(Branch00=loft_6, Branch01=loft_7, Branch02=loft_8, FlattenInputs=True)
ccx_5 = CurveCurve(CurveA=graft(crv_24), CurveB=crv_25)  # -> Points, ParamsA, ParamsB
ccx_6 = CurveCurve(CurveA=graft(crv_25), CurveB=crv_26)  # -> Points, ParamsA, ParamsB
ccx_7 = CurveCurve(CurveA=graft(crv_26), CurveB=crv_24)  # -> Points, ParamsA, ParamsB

# ---- group: unrolling 2nd layer / crvs2ndLayerPattern
crv_27 = Curve(cull_6)
crv_28 = Curve(cull_7)
crv_29 = Curve(cull_8)

# ----
pshift_7 = ShiftPaths(Data=ccx_7.ParamsA, Offset=-1)
pshift_8 = ShiftPaths(Data=ccx_5.ParamsA, Offset=-1)
pshift_9 = ShiftPaths(Data=ccx_6.ParamsA, Offset=-1)
abs_9 = Absolute(Value=pshift_8)
abs_10 = Absolute(Value=pshift_9)
abs_11 = Absolute(Value=pshift_7)
merge_8 = Merge(Data1=abs_9, Data2=abs_10, Data3=abs_11)  # -> simplify(Result)

# ---- group: unrolling 1rst layer / crvsIntersection
entwine_11 = Entwine(Branch00=flatten(ccx_5.Points), Branch01=flatten(ccx_6.Points), Branch02=flatten(ccx_7.Points), FlattenInputs=True)

# ----
midpt_5 = CurveMiddle(Curve=line_9)
lng_3 = ListLength(List=item_9)
series_3 = Series(Start="1", Step=1, Count=lng_3)
concat = Concatenate(FragmentA=series_3, FragmentC=graft(panel_23))
eval_4 = EvaluateCurve(Curve=item_9, Parameter=Slider(0.2, range=0..1))  # -> Point, Tangent, Angle
text = Text(Location=flatten(midpt_5), Text=flatten(concat), Size=number_slider_17)
text_2 = Text(Location=flatten(eval_4.Point), Text=flatten(concat), Size=number_slider_17)

explode_7 = Explode(Curve=item_9, Recursive=True)  # -> Segments, Vertices
intcrv_8 = Interpolate(Vertices=explode_7.Vertices, Degree=3, Periodic=False, KnotStyle=1)  # -> Curve, Length, Domain
pshift_10 = ShiftPaths(Data=item_9, Offset=-1)
srf_2 = Surface(patch_2)
crvonsrf = BBConstructCurveOnSurface(Surface=srf_2, Curve=pshift_10, Space=0)  # -> reparameterize(simplify(graft(CurveOnSurface))), Approximation
panel_34 = Panel(pshift_10)
shatter_5 = Shatter(Curve=reparameterize(pshift_10), Parameters=avr)
number_slider_26 = Slider(2.2, range=0..10)

τg = BBGeodesicTorsionCurveOnSurface(CurveOnSurface=crvonsrf.CurveOnSurface, Parameter=avr)  # -> Point, Torsion
κg = BBGeodesicCurvatureCurveOnSurface(CurveOnSurface=crvonsrf.CurveOnSurface, Parameter=avr)  # -> Point, Curvature, OsculatingCircle
κn = BBNormalCurvatureCurveOnSurface(CurveOnSurface=crvonsrf.CurveOnSurface, Parameter=avr)  # -> Point, Curvature, OsculatingCircle
bnd_3 = Bounds(Numbers=flatten(κn.Curvature))
bnd_4 = Bounds(Numbers=flatten(κg.Curvature))
bnd_5 = Bounds(Numbers=flatten(τg.Torsion))
dedomain_2 = DeconstructDomain(Domain=bnd_3)  # -> Start, End
dedomain_3 = DeconstructDomain(Domain=bnd_5)  # -> Start, End
dedomain_4 = DeconstructDomain(Domain=bnd_4)  # -> Start, End
gradient_3 = Gradient(
    LowerLimit=dedomain_2.Start,
    UpperLimit=one_over_x_2,
    Parameter=κn.Curvature,
    stops=[0: RGB(224, 224, 224), 1: RGB(0, 100, 0)])
gradient_4 = Gradient(
    LowerLimit=dedomain_4.Start,
    UpperLimit=one_over_x,
    Parameter=κg.Curvature,
    stops=[0: RGB(255, 255, 128), 0.298: RGB(0, 128, 128), 1: RGB(38, 7, 163)])
gradient_5 = Gradient(LowerLimit=0, UpperLimit=dedomain_3.End, Parameter=τg.Torsion, stops=[0: RGB(224, 224, 224), 1: RGB(0, 0, 0)])

crv_30 = Curve(reparameterize(graft(pshift_10)))
torsion = Torsion(Curve=crv_30, Parameter=avr)  # -> Point, Torsion
curvature = Curvature(Curve=crv_30, Parameter=avr)  # -> P, K, C
angle_8 = Angle(VectorA=κn.Curvature, VectorB=curvature.K)  # -> Angle, Reflex
bnd_6 = Bounds(Numbers=flatten(angle_8.Angle))
dedomain_5 = DeconstructDomain(Domain=bnd_6)  # -> Start, End
gradient_6 = Gradient(
    LowerLimit=dedomain_5.Start,
    UpperLimit=dedomain_5.End,
    Parameter=angle_8.Angle,
    stops=[0: RGB(224, 224, 224), 0.456: RGB(0, 192, 192)])

panel_35 = Panel(torsion.Torsion)
panel_36 = Panel(bnd_5)
panel_37 = Panel(dedomain_4.End)
panel_38 = Panel(bnd_3)
neg_12 = Negative(Value=curvature.K)
neg_13 = Negative(Value=κn.Curvature)

bnd_7 = Bounds(Numbers=flatten(torsion.Torsion))
dedomain_6 = DeconstructDomain(Domain=bnd_7)  # -> Start, End
panel_39 = Panel(bnd_7)

neg_14 = Negative(Value=dedomain_6.End)

gradient_7 = Gradient(
    LowerLimit=neg_14,
    UpperLimit=dedomain_6.End,
    Parameter=torsion.Torsion,
    stops=[0: RGB(234, 38, 0), 0.25: RGB(234, 126, 0), 0.5: RGB(254, 244, 84), 0.75: RGB(173, 203, 249), 1: RGB(75, 107, 169)])

vdisex = VectorDisplayEx(Point=curvature.P, Vector=neg_13, Colour=ColourSwatch(SwatchColor=RGB(196, 255, 249)), Width=2)
vdisex_2 = VectorDisplayEx(Point=curvature.P, Vector=neg_12, Colour=ColourSwatch(SwatchColor=RGB(52, 84, 112)), Width=2)
previewlw_3 = CustomPreviewLineweights(Geometry=shatter_5, Shader=gradient_3, Thickness=number_slider_26, Absolute=False)
previewlw_4 = CustomPreviewLineweights(Geometry=shatter_5, Shader=gradient_4, Thickness=number_slider_26, Absolute=False)
previewlw_5 = CustomPreviewLineweights(Geometry=shatter_5, Shader=gradient_5, Thickness=number_slider_26, Absolute=False)
previewlw_6 = CustomPreviewLineweights(Geometry=shatter_5, Shader=gradient_6, Thickness=number_slider_26, Absolute=False)
previewlw_7 = CustomPreviewLineweights(Geometry=shatter_5, Shader=gradient_7, Thickness=number_slider_26, Absolute=False)

crv_smooth = Curve(pshift_10)
crv_polyline = Curve(item_9)
toggle_2 = GroupToggle(ToggleActive=True, ToggleVisible=False)  # disabled
mesh_11 = Mesh(mesh_final)

crv_polyline_2 = Curve(crv_polyline)
crv_smooth_2 = Curve(crv_smooth)
explode_8 = Explode(Curve=crv_polyline_2, Recursive=True)  # -> Segments, Vertices
graft_2 = GraftTree(Tree=crv_smooth_2, IncludeEmptyLists=True, IncludeNullItems=True)
crv_cp_2 = CurveClosestPoint(Point=explode_8.Vertices, Curve=reparameterize(graft_2))  # -> Point, Parameter, Distance
the_surface = Surface(srf)
srf_cp_6 = SurfaceClosestPoint(Point=crv_cp_2.Point, Surface=the_surface)  # -> Point, UVPoint, Distance
evalsrf_6 = EvaluateSurface(Surface=the_surface, Point=srf_cp_6.UVPoint)  # -> Point, Normal, UDirection, VDirection, Frame
vec_3 = Vector(simplify(evalsrf_6.Normal))
section_axis = SectionAxis(CurveParameter=crv_cp_2.Parameter, SectionAxis=vec_3)

bang_6 = ExplodeTree(Data=simplify(crv_smooth_2))  # -> Branch0, Branch1, Branch2
crv_31 = Curve(reparameterize(bang_6.Branch1))
crv_32 = Curve(reparameterize(bang_6.Branch0))
crv_33 = Curve(reparameterize(bang_6.Branch2))
merge_9 = Merge(Data1=crv_32, Data2=crv_31, Data3=crv_33)
graft_3 = GraftTree(Tree=merge_9, IncludeEmptyLists=True, IncludeNullItems=True)

# ---- group: Wind load
pmesh = PlanktonMesh(mesh_11)
mvarea = MeshVertexArea(PlanktonMesh=pmesh)  # -> Vertices, VertexNormals
pi_9 = Pi(Factor=Slider(0, range=0..2))
X_5 = UnitX(Factor=1)
Z_3 = UnitZ(Factor=1)
vrot = Rotate(Vector=X_5, Axis=Z_3, Angle=pi_9)
amp_9 = Amplitude(Vector=vrot, Amplitude=Slider(0.53, range=0..2))
mwind = MeshWindLoad(Wind=amp_9, VertexNormals=mvarea.VertexNormals, Option=Toggle(True))
list_9 = ValueList({"DEAD": 1, "SNOW": 2, "PRES": 3, "PRES_FL": 4, "MOMENT": 5}, selected="PRES")
multiplication_14 = Multiplication(A=mwind, B="0.001")
windload = PointLoad(Point=mvarea.Vertices, Loadtype=list_9, Direction=mvarea.VertexNormals, Value=multiplication_14, LoadCase=1)

# ---- group: support
end_10 = EndPoints(Curve=crv_smooth_2)  # -> Start, End
pt_6 = Point(flatten([end_10.Start, end_10.End]))
pdecon_7 = Deconstruct(Point=pt_6)  # -> XComponent, YComponent, ZComponent
smaller_4 = SmallerThan(FirstNumber=pdecon_7.ZComponent, SecondNumber="0.02")  # -> SmallerThan, OrEqualTo
dispatch_7 = Dispatch(List=pt_6, DispatchPattern=smaller_4.SmallerThan)  # -> ListA, ListB
pt_7 = Point(dispatch_7.ListA)
suppt = SupportPoint(Point=pt_7, DispX=True, DispY=True, DispZ=True, Rotation=False, Torsion=False, TryStrongSupport=True)

# ----
toggle_3 = BooleanToggle(True)
prestress_properties = PrestressPropertiesBeam(L=False, AB1=toggle_3, AB2=False, AT=toggle_3, N=0, M1=0, M2=0, T=0)
height_3 = Number(height)
width_3 = Number(0.1)
toggle_4 = BooleanToggle(False)
box = BoxSection(Height=height_3, Width=width_3, Thickness=0)  # -> Section, Area
crvref = CurveRefinement(PDeg=1, ElementRefU="1", IsKnotApproxElementSize=False, IsKnotSubdivision=True)
beam = BeamElement(
    C=reparameterize(graft_3),
    M=mat,
    S=box.Section,
    R=crvref,
    AB=section_axis,
    P=prestress_properties,
    HS=toggle_4,
    HE=toggle_4,
    HB=toggle_4)

# ---- group: coupling
python = GhPythonScript(cvA=flatten(crv_32), cvB=flatten(crv_31))  # -> out, ptLst, cv1, cv2; inputs cvA: list of Curve, cvB: list of Curve
# ---------- python: Python ----------
__author__ = "zenorm"
__version__ = "2022.04.09"

import rhinoscriptsyntax as rs
import Rhino.Geometry as rg

cv1 = []
cv2 = []
ptLst = []
for i in cvA:
    for j in cvB:
        intersect = rs.CurveCurveIntersection(i,j,-1)
        if intersect != None:
            print intersect[0][5]
            if (intersect[0][0] == 1) & (intersect[0][5] != 1.0) & (intersect[0][5] != 0.0) & (intersect[0][7] != 0.0) & (intersect[0][7] != 1.0):
                pt = intersect[0][1]
                ptLst.append(pt)
                cv1.append(i)
                cv2.append(j)
# ---------- end python ----------
python_2 = GhPythonScript(cvA=flatten(crv_32), cvB=flatten(crv_33))  # -> out, ptLst, cv1, cv2; inputs cvA: list of Curve, cvB: list of Curve
# ---------- python_2: Python ----------
__author__ = "zenorm"
__version__ = "2022.04.09"

import rhinoscriptsyntax as rs
import Rhino.Geometry as rg

cv1 = []
cv2 = []
ptLst = []
for i in cvA:
    for j in cvB:
        intersect = rs.CurveCurveIntersection(i,j,-1)
        if intersect != None:
            if (intersect[0][0] == 1) & (intersect[0][5] != 1.0) & (intersect[0][5] != 0.0) & (intersect[0][7] != 0.0) & (intersect[0][7] != 1.0):
                pt = intersect[0][1]
                ptLst.append(pt)
                cv1.append(i)
                cv2.append(j)
# ---------- end python_2 ----------
python_3 = GhPythonScript(cvA=flatten(crv_31), cvB=flatten(crv_33))  # -> out, ptLst, cv1, cv2; inputs cvA: list of Curve, cvB: list of Curve; same code as python_2
srf_cp_7 = SurfaceClosestPoint(Point=python.ptLst, Surface=the_surface)  # -> Point, UVPoint, Distance
srf_cp_8 = SurfaceClosestPoint(Point=python_2.ptLst, Surface=the_surface)  # -> Point, UVPoint, Distance
srf_cp_9 = SurfaceClosestPoint(Point=python_3.ptLst, Surface=the_surface)  # -> Point, UVPoint, Distance
evalsrf_7 = EvaluateSurface(Surface=the_surface, Point=srf_cp_7.UVPoint)  # -> Point, simplify(Normal), UDirection, VDirection, Frame
evalsrf_8 = EvaluateSurface(Surface=the_surface, Point=srf_cp_8.UVPoint)  # -> Point, simplify(Normal), UDirection, VDirection, Frame
evalsrf_9 = EvaluateSurface(Surface=the_surface, Point=srf_cp_9.UVPoint)  # -> Point, simplify(Normal), UDirection, VDirection, Frame
cpta = CouplingPointAxis(
    Point=graft(python_3.ptLst),
    Curve1=graft(python_3.cv1),
    Curve2=graft(python_3.cv2),
    Axis=graft(evalsrf_9.Normal),
    CheckProximity=True)
cpta_2 = CouplingPointAxis(
    Point=graft(python_2.ptLst),
    Curve1=graft(python_2.cv1),
    Curve2=graft(python_2.cv2),
    Axis=graft(evalsrf_8.Normal),
    CheckProximity=True)
cpta_3 = CouplingPointAxis(
    Point=graft(python.ptLst),
    Curve1=graft(python.cv1),
    Curve2=graft(python.cv2),
    Axis=graft(evalsrf_7.Normal),
    CheckProximity=True)
relay_5 = Relay([cpta_3, cpta_2, cpta])

# ---- group: snow load
Z_4 = UnitZ(Factor=Slider(1.9, range=0..10))
msnow = MeshSnowLoad(Snow=Z_4, VertexNormals=mvarea.VertexNormals, Option=False)
list_10 = ValueList({"DEAD": 1, "SNOW": 2, "PRES": 3, "PRES_FL": 4, "MOMENT": 5}, selected="DEAD")
multiplication_15 = Multiplication(A=msnow, B="0.001")
snowload = PointLoad(Point=mvarea.Vertices, Loadtype=list_10, Direction=mvarea.VertexNormals, Value=multiplication_15, LoadCase=1)

# ---- group: self load
panel_40 = Panel("""Gravity
680kg/m3 * 0.1m * 0.019m * 10N / 1000 = 6.8Kn/m3 * 0.0019m2
= 0.01292 """)
list_11 = ValueList({"DEAD": 1, "SNOW": 2, "PRES": 3, "PRES_FL": 4, "MOMENT": 5}, selected="DEAD")
crvload = CurveLoad(Crv=merge_9, Loadtype=list_11, Direction=Vector(0, 0, -1), Value="0.013", LoadCase=1)  # -> flatten(CurveLoad)

# ----
loads_2 = Merge(Data1=flatten(windload), Data2=crvload, Data3=flatten(snowload))
visopt = VisualizeOptions(
    ScaleCrossSections=1,
    ScaleSupports=1,
    ScaleLoads=Slider(0.1, range=0..0.1),
    ScaleCouplingPoints=1,
    ScaleConnectingPoints=Slider(0.71, range=0..1),
    ScaleRefinedControlPoints=1,
    ColourBeam=RGB(211, 211, 211),
    ColourCable=RGB(255, 255, 255),
    ColourSupports=RGB(232, 65, 119),
    ColourLoads=RGB(232, 65, 119),
    ColourConnects=RGB(255, 255, 255),
    ColourRefinedPatches=RGB(139, 0, 0),
    ColourSliding=RGB(135, 16, 55))
amodel = AnalysisModel(
    Analysis=nonlina,
    StructuralElements=flatten(beam),
    Supports=suppt,
    Loads=loads_2,
    Visualizer=visopt,
    IntersectionTolerance=0.01,
    IsCarat=True,
    IsKratos=False,
    PenaltyFac=10000000,
    ShowCouplingIDs=False,
    ShowEdgeIDs=False,
    ShowGeo=True,
    ShowPatchIDs=True,
    ShowPrePro=True,
    ShowRef=False,
    mUsedVersion="BETA 0.6.0")

run_analysis = IGASolver(AnalysisModel=amodel, Run=Button(), antiFreeze=False, showWindow=True)  # -> ResultModel, ErrorReport
panel_41 = Panel(run_analysis.ErrorReport)
defmod = DeformedModel(
    Model=run_analysis.ResultModel,
    LoadCase=Slider(0, range=0..10),
    ScaleFactor=Slider(1, range=1..50),
    FlyingNodeLimit=100000)  # -> Model, Geo, DeformedStructuralElements
amodel_2 = AnalysisModel(
    StructuralElements=defmod.DeformedStructuralElements,
    IntersectionTolerance=0.01,
    IsCarat=True,
    IsKratos=False,
    PenaltyFac=10000000,
    ShowCouplingIDs=False,
    ShowEdgeIDs=False,
    ShowGeo=True,
    ShowPatchIDs=True,
    ShowPrePro=True,
    ShowRef=False,
    mUsedVersion="BETA 0.6.0")
list_12 = ValueList({"N": 1, "M1": 2, "M2": 3, "Mt": 4, "V1": 5, "V2": 6, "N stress": 7, "Shear stress 1": 8, "Shear stress 2": 9, "v Mises stress": 10, "Utilization (v Mises)": 11, "Cross Section": 12}, selected="Utilization (v Mises)")
crv_34 = Curve(defmod.Geo)
_1dresview = _1DElementResultView(Model=defmod.Model, Type=list_12, ScaleFactor=Slider(0.847, range=0..1), ShowColourPlot=True)  # -> Results, ResultList, Mesh, LegendC, LegendT
legend = Legend(Colour=_1dresview.LegendC, Tags=_1dresview.LegendT, LegendType=1)

series_4 = Series(Start=0, Step=Slider(0.05, range=0..0.1), Count=Slider(20, range=0..100))
crv_35 = Curve(flatten(crv_smooth_2))
crv_36 = Curve(defmod.Geo)
eval_5 = EvaluateCurve(Curve=reparameterize(graft(crv_35)), Parameter=series_4)  # -> Point, Tangent, Angle
eval_6 = EvaluateCurve(Curve=reparameterize(graft(crv_36)), Parameter=series_4)  # -> Point, Tangent, Angle
dist = Distance(PointA=eval_5.Point, PointB=eval_6.Point)
num_2 = Number(dist)
bnd_8 = Bounds(Numbers=num_2)
extremums_7 = MinMax(Number=num_2)  # -> Minimum, Maximum
dedomain_7 = DeconstructDomain(Domain=bnd_8)  # -> Start, End

item_14 = ListItem(List=eval_5.Point, Index="18", Wrap=True)
item_15 = ListItem(List=eval_6.Point, Index="18", Wrap=True)
index_4 = ItemIndex(List=num_2, Item=dedomain_7.End)
ln_8 = Line(StartPoint=item_14, EndPoint=item_15)
panel_42 = Panel(num_2)
previewlw_8 = CustomPreviewLineweights(Geometry=ln_8, Shader=ColourSwatch(SwatchColor=RGB(245, 54, 54)), Thickness=Slider(30, range=0..30), Absolute=False)

crv_37 = Curve(crv_polyline)

len_14 = Length(Curve=crv_21)
multiplication_16 = Multiplication(A=len_14, B=Slider(3.4, range=0..10))
divide_9 = DivideCurve(Curve=crv_21, Count=multiplication_16, Kinks=False)  # -> Points, Tangents, Parameters
srf_cp_10 = SurfaceClosestPoint(Point=divide_9.Points, Surface=reparameterize(patch_2))  # -> Point, UVPoint, flatten(Distance)
evalsrf_10 = EvaluateSurface(Surface=reparameterize(patch_2), Point=srf_cp_10.UVPoint)  # -> Point, Normal, UDirection, VDirection, Frame
xprod_6 = CrossProduct(VectorA=divide_9.Tangents, VectorB=evalsrf_10.Normal, Unitize=False)  # -> Vector, Length

neg_15 = Negative(Value="4")

multiplication_17 = Multiplication(A=height_2, B=neg_15)
amp_10 = Amplitude(Vector=evalsrf_10.Normal, Amplitude=multiplication_17)
move_10 = Move(Geometry=divide_9.Points, Motion=amp_10)  # -> Geometry, Transform
pl_6 = ConstructPlane(Origin=simplify(move_10.Geometry), XAxis=evalsrf_10.Normal, YAxis=xprod_6.Vector)

subtraction_9 = Subtraction(A=multiplication_17, B=division_2)
offmsh = OffsetMesh(Mesh=mesh_10, Distance=expr("-x", subtraction_9), BothSides=0, CreateSolid=invert(True))
rectangle_6 = Rectangle(Plane=pl_6, XSize=symdom_2, YSize=symdom, Radius=0)  # -> Rectangle, Length
loft_9 = Loft(
    Curves=rectangle_6.Rectangle,
    Options={Adjust=False, Closed=False, LoftEnds=0, LoftSimp=0, LoftType=0, Rebuild=10, Refit=0.01})
debrep = DeconstructBrep(Brep=loft_9)  # -> Faces, Edges, Vertices
item_16 = ListItem(List=debrep.Faces, Index=0, Wrap=True)
entwine_12 = Entwine(Branch00=loft_9, Branch01=loft_4, Branch02=loft_5, Branch03=loft_6, Branch04=loft_7, Branch05=loft_8, FlattenInputs=True)
iso = IsoCurve(Surface=reparameterize(item_16), UVPoint=md_slider)  # -> UIsocurve, VIsocurve
cap_2 = CapHoles(Brep=entwine_12)
previewmat_4 = CustomPreviewMaterials(Geometry=cap_2, DiffuseColor=entwine_2)
intcrv_9 = Interpolate(Vertices=move_10.Geometry, Degree=3, Periodic=False, KnotStyle=1)  # -> Curve, Length, Domain
entwine_13 = Entwine(Branch00=intcrv_9.Curve, Branch01=intcrv_3.Curve, Branch02=intcrv_4.Curve, FlattenInputs=True)
entwine_14 = Entwine(Branch00=loft_9, Branch01=loft_4, Branch02=loft_5, FlattenInputs=True)

number_slider_27 = Slider(0, range=0..10)  # disabled
debrep_2 = DeconstructBrep(Brep=entwine_12)  # -> Faces, Edges, Vertices; disabled
item_17 = ListItem(List=debrep_2.Faces, Index=number_slider_27, Wrap=True)  # disabled
pshift_11 = ShiftPaths(Data=item_17, Offset=-1)  # disabled
number_slider_28 = Slider(25, range=0..100)  # disabled
number_slider_29 = Slider(1, range=0..100)  # disabled
number_slider_30 = Slider(1, range=0..1)  # disabled
mesh_uv_4 = MeshSurface(Surface=pshift_11, UCount=number_slider_28, VCount=number_slider_29, Overhang=True, Equalize=False)  # disabled
unroller_4 = Unroller(Strip=mesh_uv_4, Unroll=number_slider_30)  # -> flatten(Unrolled); disabled

preview = CustomPreview(Geometry=mesh_uv_4, Material=swatch_4)  # disabled

facen = FaceNormals(Mesh=unroller_4)  # -> Centers, Normals; disabled
demesh_6 = DeconstructMesh(Mesh=unroller_4)  # -> Vertices, Faces, Colours, Normals; disabled
item_18 = ListItem(List=demesh_6.Vertices, Index=0, Wrap=True)  # -> Item1, Item; disabled
avr_3 = Average(Input=facen.Normals)  # disabled
ln_9 = Line(StartPoint=item_18.Item, EndPoint=item_18.Item1)  # disabled
xprod_7 = CrossProduct(VectorA=ln_9, VectorB=avr_3, Unitize=False)  # -> Vector, Length; disabled
item_19 = ListItem(List=demesh_6.Vertices, Index=0, Wrap=True)  # disabled
pl_7 = ConstructPlane(Origin=item_19, XAxis=xprod_7.Vector, YAxis=ln_9)  # disabled
bbox = BoundingBox(Content=graft(unroller_4), Plane=pl_7, UnionBox=True)  # -> Box, Box_2; disabled
debrep_3 = DeconstructBrep(Brep=bbox.Box)  # -> Faces, Edges, Vertices; disabled
number_slider_31 = Slider(0.1143, range=0..1)  # disabled
debox = DeconstructBox(Box=bbox.Box)  # -> Plane, X, Y, Z; disabled
num_3 = Number(debox.X)  # disabled
addition_2 = Addition(A=num_3, B=number_slider_31)  # disabled
ma_3 = MassAddition(Input=flatten(addition_2))  # -> flatten(Result), PartialResults; disabled
number_slider_32 = Slider(0, range=0..100)  # disabled
cull_i_5 = CullIndex(List=reverse(ma_3.PartialResults), Indices=0, Wrap=True)  # -> reverse(List); disabled
merge_10 = Merge(Data1=simplify(number_slider_32), Data2=simplify(flatten(cull_i_5)))  # disabled
pt_8 = ConstructPoint(XCoordinate=graft(merge_10), YCoordinate=0, ZCoordinate=0)  # disabled
item_20 = ListItem(List=debrep_3.Vertices, Index=0, Wrap=True)  # -> simplify(Item); disabled
pl_origin = PlaneOrigin(Base=pl_7, Origin=item_20)  # disabled
xy_4 = XYPlane(Origin=pt_8)  # disabled
orient = Orient(Geometry=graft(unroller_4), Source=pl_origin, Target=xy_4)  # -> Geometry, Transform; disabled
orient_2 = Orient(Geometry=bbox.Box, Source=pl_origin, Target=xy_4)  # -> Geometry, Transform; disabled

# ----
# spruce for shear blocks
# 3.05x1.53
graft_4 = GraftTree(Tree=entwine_13, IncludeEmptyLists=True, IncludeNullItems=True)
graft_5 = GraftTree(Tree=entwine_9, IncludeEmptyLists=True, IncludeNullItems=True)
crv_38 = Curve(graft_4)
crv_39 = Curve(graft_5)
divlength = DivideLength(Curve=crv_38, Length=number_slider_7)  # -> Points, Tangents, Parameters
divlength_2 = DivideLength(Curve=crv_39, Length=number_slider_7)  # -> Points, Tangents, Parameters
shatter_6 = Shatter(Curve=crv_38, Parameters=divlength.Parameters)
shatter_7 = Shatter(Curve=crv_39, Parameters=divlength_2.Parameters)
end_11 = EndPoints(Curve=simplify(shatter_6))  # -> Start, End
end_12 = EndPoints(Curve=simplify(shatter_7))  # -> Start, End

unflatten_7 = UnflattenTree(Tree=orient.Geometry, Guide=entwine_12)  # disabled
bang_7 = ExplodeTree(Data=unflatten_7)  # -> Branch0, Branch1, Branch2, Branch3, Branch4, Branch5; disabled
mesh_12 = Mesh(bang_7.Branch0)  # disabled
mesh_13 = Mesh(bang_7.Branch1)  # disabled
mesh_14 = Mesh(bang_7.Branch2)  # disabled
mesh_15 = Mesh(bang_7.Branch3)  # disabled

# ---- group: L angles
meshcp = MeshClosestPoint(Point=pgroups.Groups, Mesh=offmsh)  # -> Point, Index, Parameter
meval = MeshEval(Mesh=offmsh, Parameter=meshcp.Parameter)  # -> Point, Normal, Colour
Z_5 = UnitZ(Factor=1)
xprod_8 = CrossProduct(VectorA=meval.Normal, VectorB=Z_5, Unitize=False)  # -> Vector, Length
number_slider_33 = Slider(11, range=0..16)

# ---- group: make Z value same
pdecon_8 = Deconstruct(Point=meval.Point)  # -> XComponent, YComponent, ZComponent
sort_3 = SortList(Keys=flatten(pdecon_8.ZComponent))  # -> Keys, ValuesA
item_21 = ListItem(List=sort_3.Keys, Index=0, Wrap=True)
pt_9 = ConstructPoint(XCoordinate=pdecon_8.XComponent, YCoordinate=pdecon_8.YComponent, ZCoordinate=item_21)

# ---- group: L angles (continued)
pl_8 = ConstructPlane(Origin=pt_9, XAxis=meval.Normal, YAxis=xprod_8.Vector)
deplane = DeconstructPlane(Plane=pl_8)  # -> Origin, XAxis, YAxis, ZAxis
pl_9 = ConstructPlane(Origin=pt_9, XAxis=expr("-x", deplane.ZAxis), YAxis=xprod_8.Vector)
deplane_2 = DeconstructPlane(Plane=pl_9)  # -> Origin, XAxis, YAxis, ZAxis
vdis = VectorDisplay(Anchor=pt_9, Vector=deplane_2.XAxis)
project_6 = Project(Geometry=deplane_2.XAxis, Plane=PlaneXY(0, 0, 0))  # -> Geometry, Transform
rev = Reverse(Vector=project_6.Geometry)
angle_9 = Angle(VectorA=deplane_2.XAxis, VectorB=rev)  # -> Angle, Reflex
vdis_2 = VectorDisplay(Anchor=pt_9, Vector=rev)
deg = Degrees(Radians=angle_9.Angle)
subtraction_10 = Subtraction(A=Slider(180, range=0..1000), B=deg)

# ----
rectangle_7 = Rectangle(Plane=pl_9, XSize=number_slider_4, YSize=domsym, Radius=0)  # -> Rectangle, Length
amp_11 = Amplitude(Vector=deplane.ZAxis, Amplitude=Slider(0.1, range=0..1))

# ---- group: L angles / check
item_22 = ListItem(List=flatten(deplane_2.Origin), Index=number_slider_33, Wrap=True)
item_23 = ListItem(List=flatten(deplane_2.XAxis), Index=number_slider_33, Wrap=True)
item_24 = ListItem(List=flatten(project_6.Geometry), Index=number_slider_33, Wrap=True)
vdis_3 = VectorDisplay(Anchor=item_22, Vector=[item_23, item_24])

# ----
panel_43 = Panel(deg)
roundd = RoundToDecimalPlace(NumberX=deg, DecimalPlace=Slider(2, range=0..10), RoundType=0)  # -> Rounded, Difference

# ---- group: groundBeams
pline_2 = PolyLine(Vertices=pt_9, Closed=False)
number_slider_34 = Slider(0.25, range=0..1)
neg_16 = Negative(Value=Slider(0.35, range=0..1))
xy_5 = XYPlane(Origin=Point(0, 0, 0))

# ----
move_11 = Move(Geometry=rectangle_7.Rectangle, Motion=amp_11)  # -> Geometry, Transform

deplane_3 = DeconstructPlane(Plane=move_11.Geometry)  # -> Origin, XAxis, YAxis, ZAxis
deplane_4 = DeconstructPlane(Plane=move_11.Geometry)  # -> Origin, XAxis, YAxis, ZAxis
pl_10 = ConstructPlane(Origin=deplane_3.Origin, XAxis=deplane_3.XAxis, YAxis=deplane_3.YAxis)
pl_11 = ConstructPlane(Origin=deplane_4.Origin, XAxis=rev, YAxis=xprod_8.Vector)
projecta = ProjectAlong(Geometry=pgroups.Groups, Plane=pl_10, Direction=deplane_3.ZAxis)  # -> Geometry, Transform

rectangle_8 = Rectangle(Plane=pl_11, XSize=Slider(0.15, range=0..1), YSize=domsym, Radius=0)  # -> Rectangle, Length

center = Center(Geometric=rectangle_8.Rectangle)  # -> Center, Dimension

# ---- group: groundBeams (continued)
item_25 = ListItem(List=flatten(pl_11), Index=0, Wrap=True)
project_7 = Project(Geometry=pline_2, Plane=item_25)  # -> Geometry, Transform
join_10 = JoinCurves(Curves=flatten(project_7.Geometry), Preserve=False)
crv_cp_3 = CurveClosestPoint(Point=pt_9, Curve=project_7.Geometry)  # -> Point, Parameter, Distance
eval_7 = EvaluateCurve(Curve=project_7.Geometry, Parameter=crv_cp_3.Parameter)  # -> Point, Tangent, Angle
ext_6 = ExtendCurve(Curve=join_10, Type=0, Start=number_slider_34, End=number_slider_34)
vdis_4 = VectorDisplay(Anchor=crv_cp_3.Point, Vector=eval_7.Tangent)
offset_6 = OffsetCurve(Curve=ext_6, Distance=neg_16, Plane=xy_5, Corners=1)
merge_11 = Merge(Data1=graft(ext_6), Data2=offset_6)
partition_3 = PartitionList(List=flatten(merge_11), Size="2")
loft_10 = Loft(Curves=partition_3, Options={Adjust=False, Closed=False, LoftEnds=0, LoftSimp=0, LoftType=0, Rebuild=10, Refit=0.01})
edges = BrepEdges(Brep=loft_10)  # -> Naked, Interior, NonManifold
srf_cp_11 = SurfaceClosestPoint(Point=center.Center, Surface=loft_10)  # -> Point, UVPoint, Distance
cir = Circle(Plane=srf_cp_11.Point, Radius=number_slider_5)
merge_12 = Merge(Data1=simplify(cir), Data2=simplify(edges.Naked))
boundary = BoundarySurfaces(Edges=merge_12)

# ----
area_4 = Area(Geometry=rectangle_8.Rectangle)  # -> Area, Centroid
merge_13 = Merge(Data1=move_11.Geometry, Data2=rectangle_8.Rectangle)
rectangle_9 = Rectangle(Plane=pl_11, XSize=neg_3, YSize=domsym, Radius=0)  # -> Rectangle, Length
circle = CircleCNR(Center=projecta.Geometry, Normal=deplane_3.ZAxis, Radius=number_slider_5)
scale = Scale(Geometry=rectangle_8.Rectangle, Center=area_4.Centroid, Factor=Slider(0.6, range=0..1))  # -> Geometry, Transform
cir_2 = Circle(Plane=center.Center, Radius=Slider(0.025, range=0..1))
boundary_2 = BoundarySurfaces(Edges=[circle, move_11.Geometry])
boundary_3 = BoundarySurfaces(Edges=merge_13)
edges_2 = BrepEdges(Brep=boundary_2)  # -> Naked, Interior, NonManifold
divide_10 = DivideCurve(Curve=cir_2, Count=Slider(3, range=0..10), Kinks=False)  # -> Points, Tangents, Parameters
join_11 = BrepJoin(Breps=boundary_3)  # -> Breps, Closed
geo_5 = Geometry(edges_2.Naked)
explode_9 = Explode(Curve=merge_13, Recursive=True)  # -> Segments, Vertices
cir_3 = Circle(Plane=center.Center, Radius=number_slider_5)
item_26 = ListItem(List=geo_5, Index=Slider(3, range=0..4), Wrap=True)
item_27 = ListItem(List=explode_9.Segments, Index=Slider(2, range=0..3), Wrap=True)
midpt_6 = CurveMiddle(Curve=item_26)
join_12 = JoinCurves(Curves=flatten(item_27), Preserve=False)

# ---- group: unrolled plates with holes
rot3d = Rotate3D(Geometry=graft(boundary_2), Angle=graft(degrees(subtraction_10)), Center=midpt_6, Axis=item_26)  # -> Geometry, Transform
boundary_4 = BoundarySurfaces(Edges=[cir_3, rectangle_8.Rectangle])

# ---- group: names
md_slider_2 = MDSlider(
    SliderMode=0,
    slider_value=Point(0.8243713379, 0.8118591309, 0.5),
    x_domain=Domain(0, 1),
    y_domain=Domain(0, 1),
    z_domain=Domain(0, 1))
md_slider_3 = MDSlider(
    SliderMode=0,
    slider_value=Point(0.2119445801, 0.8092460632, 0.5),
    x_domain=Domain(0, 1),
    y_domain=Domain(0, 1),
    z_domain=Domain(0, 1))
lng_4 = ListLength(List=pt_9)
number_slider_35 = Slider(0.01, range=0..1)
series_5 = Series(Start=0, Step=1, Count=simplify(lng_4))
panel_44 = Panel("""C
B
A""")
concat_2 = Concatenate(FragmentA=series_5, FragmentB=graft(panel_44))
evalsrf_11 = EvaluateSurface(Surface=reparameterize(boundary_4), Point=md_slider_2)  # -> Point, Normal, UDirection, VDirection, Frame
evalsrf_12 = EvaluateSurface(Surface=reparameterize(boundary_4), Point=md_slider_3)  # -> Point, Normal, UDirection, VDirection, Frame
text_3 = Text(Location=simplify(flatten(evalsrf_11.Point)), Text=flatten(concat_2), Size=number_slider_35)
text_4 = Text(Location=simplify(flatten(evalsrf_12.Point)), Text=flatten(roundd.Rounded), Size=number_slider_35)

# ----
offset_7 = OffsetCurve(Curve=join_12, Distance=Slider(0.008, range=0..0.01), Corners=1)  # -> flatten(Curve)

# ---- group: groundBeams
thickness_of_ground_beams = Slider(0.08, range=0..1)
Z_6 = UnitZ(Factor=thickness_of_ground_beams)
extr_2 = Extrude(Base=boundary, Direction=expr("-x", Z_6))

# ----
end_13 = EndPoints(Curve=join_12)  # -> Start, End
end_14 = EndPoints(Curve=offset_7)  # -> Start, End
ln_10 = Line(StartPoint=end_13.Start, EndPoint=end_14.Start)
ln_11 = Line(StartPoint=end_13.End, EndPoint=end_14.End)
join_13 = JoinCurves(Curves=[join_12, offset_7, ln_10, ln_11], Preserve=False)  # -> flatten(Curves)
boundary_5 = BoundarySurfaces(Edges=join_13)
srf_cp_12 = SurfaceClosestPoint(Point=end_14.Start, Surface=boundary_5)  # -> Point, UVPoint, Distance
evalsrf_13 = EvaluateSurface(Surface=boundary_5, Point=srf_cp_12.UVPoint)  # -> Point, Normal, UDirection, VDirection, Frame
amp_12 = Amplitude(Vector=evalsrf_13.Normal, Amplitude=addition)

# ---- group: planes
extr_3 = Extrude(Base=boundary_5, Direction=expr("-x", amp_12))

# ----
crv_smooth_3 = Curve(crv_smooth)  # disabled
crv_polyline_3 = Curve(crv_polyline)  # disabled
the_surface_2 = Surface(srf)  # disabled
toggle_5 = GroupToggle(ToggleActive=True, ToggleVisible=False)  # disabled
explode_10 = Explode(Curve=crv_polyline_3, Recursive=True)  # -> Segments, Vertices; disabled
graft_6 = GraftTree(Tree=crv_smooth_3, IncludeEmptyLists=True, IncludeNullItems=True)  # disabled
crv_cp_4 = CurveClosestPoint(Point=explode_10.Vertices, Curve=reparameterize(graft_6))  # -> Point, Parameter, Distance; disabled
srf_cp_13 = SurfaceClosestPoint(Point=crv_cp_4.Point, Surface=the_surface_2)  # -> Point, UVPoint, Distance; disabled
bang_8 = ExplodeTree(Data=simplify(crv_smooth_3))  # -> Branch0, Branch1, Branch2; disabled
evalsrf_14 = EvaluateSurface(Surface=the_surface_2, Point=srf_cp_13.UVPoint)  # -> Point, Normal, UDirection, VDirection, Frame; disabled
crv_40 = Curve(reparameterize(bang_8.Branch1))  # disabled
crv_41 = Curve(reparameterize(bang_8.Branch0))  # disabled
crv_42 = Curve(reparameterize(bang_8.Branch2))  # disabled
toggle_6 = BooleanToggle(True)  # disabled
width_4 = Number(0.15)  # disabled
height_4 = Number(height)  # disabled
vec_4 = Vector(simplify(evalsrf_14.Normal))  # disabled
panel_45 = Panel("1")  # disabled
prestress_properties_2 = PrestressPropertiesBeam(L=False, AB1=toggle_6, AB2=False, AT=toggle_6, N=0, M1=0, M2=0, T=0)  # disabled
merge_14 = Merge(Data1=crv_41, Data2=crv_40, Data3=crv_42)  # disabled
section_axis_2 = SectionAxis(CurveParameter=crv_cp_4.Parameter, SectionAxis=vec_4)  # disabled
box_2 = BoxSection(Height=height_4, Width=width_4, Thickness=0)  # -> Section, Area; disabled
crvref_2 = CurveRefinement(PDeg=1, ElementRefU=panel_45, IsKnotApproxElementSize=False, IsKnotSubdivision=True)  # disabled
graft_7 = GraftTree(Tree=merge_14, IncludeEmptyLists=True, IncludeNullItems=True)  # disabled
number_slider_36 = Slider(0.71, range=0..1)  # disabled
number_slider_37 = Slider(0.1, range=0..0.1)  # disabled
toggle_7 = BooleanToggle(False)  # disabled
beam_2 = BeamElement(
    C=reparameterize(graft_7),
    M=mat_4,
    S=box_2.Section,
    R=crvref_2,
    AB=section_axis_2,
    P=prestress_properties_2,
    HS=toggle_7,
    HE=toggle_7,
    HB=toggle_7)  # disabled
visopt_2 = VisualizeOptions(
    ScaleCrossSections=1,
    ScaleSupports=1,
    ScaleLoads=number_slider_37,
    ScaleCouplingPoints=1,
    ScaleConnectingPoints=number_slider_36,
    ScaleRefinedControlPoints=1,
    ColourBeam=RGB(211, 211, 211),
    ColourCable=RGB(255, 255, 255),
    ColourSupports=RGB(232, 65, 119),
    ColourLoads=RGB(232, 65, 119),
    ColourConnects=RGB(255, 255, 255),
    ColourRefinedPatches=RGB(139, 0, 0),
    ColourSliding=RGB(135, 16, 55))  # disabled
button = Button()  # disabled
number_slider_38 = Slider(1, range=1..50)  # disabled
number_slider_39 = Slider(0, range=0..10)  # disabled
number_slider_40 = Slider(5, range=0..10)  # disabled
list_13 = ValueList({"N": 1, "M1": 2, "M2": 3, "Mt": 4, "V1": 5, "V2": 6, "N stress": 7, "Shear stress 1": 8, "Shear stress 2": 9, "v Mises stress": 10, "Utilization (v Mises)": 11, "Cross Section": 12}, selected="Utilization (v Mises)")  # disabled

# ---- group: coupling
python_4 = GhPythonScript(cvA=flatten(crv_41), cvB=flatten(crv_40))  # -> out, ptLst, cv1, cv2; inputs cvA: list of Curve, cvB: list of Curve; disabled; same code as python
python_5 = GhPythonScript(cvA=flatten(crv_41), cvB=flatten(crv_42))  # -> out, ptLst, cv1, cv2; inputs cvA: list of Curve, cvB: list of Curve; disabled; same code as python_2
python_6 = GhPythonScript(cvA=flatten(crv_40), cvB=flatten(crv_42))  # -> out, ptLst, cv1, cv2; inputs cvA: list of Curve, cvB: list of Curve; disabled; same code as python_2
srf_cp_14 = SurfaceClosestPoint(Point=python_4.ptLst, Surface=the_surface_2)  # -> Point, UVPoint, Distance; disabled
srf_cp_15 = SurfaceClosestPoint(Point=python_5.ptLst, Surface=the_surface_2)  # -> Point, UVPoint, Distance; disabled
srf_cp_16 = SurfaceClosestPoint(Point=python_6.ptLst, Surface=the_surface_2)  # -> Point, UVPoint, Distance; disabled
evalsrf_15 = EvaluateSurface(Surface=the_surface_2, Point=srf_cp_14.UVPoint)  # -> Point, simplify(Normal), UDirection, VDirection, Frame; disabled
evalsrf_16 = EvaluateSurface(Surface=the_surface_2, Point=srf_cp_15.UVPoint)  # -> Point, simplify(Normal), UDirection, VDirection, Frame; disabled
evalsrf_17 = EvaluateSurface(Surface=the_surface_2, Point=srf_cp_16.UVPoint)  # -> Point, simplify(Normal), UDirection, VDirection, Frame; disabled
cpta_4 = CouplingPointAxis(
    Point=graft(python_6.ptLst),
    Curve1=graft(python_6.cv1),
    Curve2=graft(python_6.cv2),
    Axis=graft(evalsrf_17.Normal),
    CheckProximity=True)  # disabled
cpta_5 = CouplingPointAxis(
    Point=graft(python_5.ptLst),
    Curve1=graft(python_5.cv1),
    Curve2=graft(python_5.cv2),
    Axis=graft(evalsrf_16.Normal),
    CheckProximity=True)  # disabled
cpta_6 = CouplingPointAxis(
    Point=graft(python_4.ptLst),
    Curve1=graft(python_4.cv1),
    Curve2=graft(python_4.cv2),
    Axis=graft(evalsrf_15.Normal),
    CheckProximity=True)  # disabled
relay_6 = Relay([cpta_6, cpta_5, cpta_4])  # disabled

# ---- group: support
end_15 = EndPoints(Curve=crv_smooth_3)  # -> Start, End; disabled
pt_10 = Point(flatten([end_15.Start, end_15.End]))  # disabled
pdecon_9 = Deconstruct(Point=pt_10)  # -> XComponent, YComponent, ZComponent; disabled
panel_46 = Panel("0.02")  # disabled
smaller_5 = SmallerThan(FirstNumber=pdecon_9.ZComponent, SecondNumber=panel_46)  # -> SmallerThan, OrEqualTo; disabled
dispatch_8 = Dispatch(List=pt_10, DispatchPattern=smaller_5.SmallerThan)  # -> ListA, ListB; disabled
pt_11 = Point(dispatch_8.ListA)  # disabled
suppt_2 = SupportPoint(Point=pt_11, DispX=True, DispY=True, DispZ=True, Rotation=False, Torsion=False, TryStrongSupport=True)  # disabled

# ---- group: self load
list_14 = ValueList({"DEAD": 1, "SNOW": 2, "PRES": 3, "PRES_FL": 4, "MOMENT": 5}, selected="DEAD")  # disabled
panel_47 = Panel("0.013")  # disabled
panel_48 = Panel("""Gravity
680kg/m3 * 0.1m * 0.019m * 10N / 1000 = 6.8Kn/m3 * 0.0019m2
= 0.01292 """)  # disabled
crvload_2 = CurveLoad(Crv=merge_14, Loadtype=list_14, Direction=Vector(0, 0, -1), Value=panel_47, LoadCase=1)  # -> flatten(CurveLoad); disabled

# ----
loads_3 = Merge(Data1=flatten(windload), Data2=crvload_2, Data3=flatten(snowload))  # disabled
amodel_3 = AnalysisModel(
    Analysis=lina_2,
    StructuralElements=flatten(beam_2),
    Supports=suppt_2,
    Loads=loads_3,
    Visualizer=visopt_2,
    IntersectionTolerance=0.01,
    IsCarat=True,
    IsKratos=False,
    PenaltyFac=10000000,
    ShowCouplingIDs=False,
    ShowEdgeIDs=False,
    ShowGeo=True,
    ShowPatchIDs=True,
    ShowPrePro=True,
    ShowRef=False,
    mUsedVersion="BETA 0.6.0")  # disabled
run_analysis_2 = IGASolver(AnalysisModel=amodel_3, Run=button, antiFreeze=False, showWindow=True)  # -> ResultModel, ErrorReport; disabled
defmod_2 = DeformedModel(Model=run_analysis_2.ResultModel, LoadCase=number_slider_39, ScaleFactor=number_slider_38, FlyingNodeLimit=100000)  # -> Model, Geo, DeformedStructuralElements; disabled
_1dresview_2 = _1DElementResultView(Model=defmod_2.Model, Type=list_13, ScaleFactor=number_slider_40, ShowColourPlot=True)  # -> Results, ResultList, Mesh, LegendC, LegendT; disabled
legend_2 = Legend(Colour=_1dresview_2.LegendC, Tags=_1dresview_2.LegendT, LegendType=1)  # disabled
panel_49 = Panel(run_analysis_2.ErrorReport)  # disabled

crv_43 = Curve(flatten(crv_smooth_3))
series_6 = Series(Start=0, Step=Slider(0.05, range=0..0.1), Count=Slider(20, range=0..100))
crv_44 = Curve(defmod_2.Geo)
eval_8 = EvaluateCurve(Curve=reparameterize(graft(crv_43)), Parameter=series_6)  # -> Point, Tangent, Angle
eval_9 = EvaluateCurve(Curve=reparameterize(graft(crv_44)), Parameter=series_6)  # -> Point, Tangent, Angle
dist_2 = Distance(PointA=eval_8.Point, PointB=eval_9.Point)
num_4 = Number(dist_2)
extremums_8 = MinMax(Number=flatten(num_4))  # -> Minimum, Maximum
panel_50 = Panel(num_4)
panel_51 = Panel(extremums_8.Maximum)
bnd_9 = Bounds(Numbers=num_4)
dedomain_8 = DeconstructDomain(Domain=bnd_9)  # -> Start, End
item_28 = ListItem(List=eval_8.Point, Index="18", Wrap=True)
item_29 = ListItem(List=eval_9.Point, Index="18", Wrap=True)
index_5 = ItemIndex(List=num_4, Item=dedomain_8.End)
ln_12 = Line(StartPoint=item_28, EndPoint=item_29)
previewlw_9 = CustomPreviewLineweights(Geometry=ln_12, Shader=ColourSwatch(SwatchColor=RGB(245, 54, 54)), Thickness=Slider(30, range=0..30), Absolute=False)

# ---- group: unrolling 1rst layer
debrep_4 = DeconstructBrep(Brep=entwine_14)  # -> Faces, Edges, Vertices
item_30 = ListItem(List=debrep_4.Faces, Index=0, Wrap=True)
md_slider_4 = MDSlider(SliderMode=0, slider_value=Point(0.5, 0.5, 0.5), x_domain=Domain(0, 1), y_domain=Domain(0, 1), z_domain=Domain(0, 1))
iso_2 = IsoCurve(Surface=reparameterize(item_30), UVPoint=md_slider_4)  # -> UIsocurve, VIsocurve
pshift_12 = ShiftPaths(Data=simplify(iso_2.UIsocurve), Offset=-1)
len_15 = Length(Curve=pshift_12)
crv_cp_5 = CurveClosestPoint(Point=entwine_11, Curve=graft(pshift_12))  # -> Point, Parameter, Distance
smaller_6 = SmallerThan(FirstNumber=crv_cp_5.Distance, SecondNumber=Slider(0.09, range=0..1))  # -> SmallerThan, OrEqualTo
cull_10 = CullPattern(List=crv_cp_5.Parameter, CullPattern=smaller_6.SmallerThan)
eval_10 = EvaluateCurve(Curve=graft(pshift_12), Parameter=cull_10)  # -> Point, Tangent, Angle
dot = DotDisplay(Point=eval_10.Point)
line_11 = LineSDL(Start=pt_5, Direction=Y, Length=len_15)  # -> simplify(graft(Line))
eval_11 = EvaluateCurve(Curve=line_11, Parameter=merge_8)  # -> Point, Tangent, Angle

# ----
ext_7 = ExtendCurve(Curve=line_11, Type="2", Start=number_slider_6, End=number_slider_6)

# ---- group: unrolling 1rst layer (continued)
shatter_8 = Shatter(Curve=ext_7, Parameters=merge_8)
end_16 = EndPoints(Curve=shatter_8)  # -> Start, End

# ----
cull_i_6 = CullIndex(List=end_16.Start, Indices="0", Wrap=True)

crv_45 = Curve(ext_7)
number_slider_41 = Slider(0.8, range=0..1)
len_16 = Length(Curve=crv_45)
equalst = EqualityWithinTolerance(FirstNumber=len_16, SecondNumber=number_slider_8, Tolerance=number_slider_41)  # -> Equality, Inequality
dispatch_9 = Dispatch(List=crv_45, DispatchPattern=equalst.Equality)  # -> ListA, ListB
divide_11 = DivideCurve(Curve=dispatch_9.ListA, Count="2", Kinks=False)  # -> Points, Tangents, Parameters
divlength_3 = DivideLength(Curve=dispatch_9.ListB, Length=number_slider_7)  # -> Points, Tangents, Parameters
shatter_9 = Shatter(Curve=dispatch_9.ListB, Parameters=divlength_3.Parameters)
shatter_10 = Shatter(Curve=dispatch_9.ListA, Parameters=divide_11.Parameters)
end_17 = EndPoints(Curve=simplify(shatter_9))  # -> Start, End
end_18 = EndPoints(Curve=simplify(shatter_10))  # -> Start, End

# ---- group: SHATTERED LINES / LAYER 1
line_12 = Line([shatter_9, shatter_10])

# ----
crv_46 = Curve(ext_7)
join_14 = JoinCurves(Curves=line_12, Preserve=False)
pshift_13 = ShiftPaths(Data=simplify(join_14), Offset=-1)
branch_2 = TreeBranch(Tree=pshift_13, Path=Slider(0, range=0..2), MaintainPaths=True)
len_17 = Length(Curve=branch_2)
panel_52 = Panel(len_17)
pshift_14 = ShiftPaths(Data=simplify(crv_46), Offset=-1)
line_13 = Line(simplify([shatter_9, shatter_10]))
branch_3 = TreeBranch(Tree=pshift_14, Path=Slider(0, range=0..2), MaintainPaths=True)

xy_6 = XYPlane(Origin=Point(0, 0, 0))
scale_2 = Scale(Geometry=crv_46, Center=xy_6, Factor=Slider(0.1, range=0..0.1))  # -> Geometry, Transform

crv_47 = Curve([shatter_9, shatter_10])
pshift_15 = ShiftPaths(Data=simplify(crv_47), Offset=-1)
tstat_2 = TreeStatistics(Tree=crv_47)  # -> Paths, graft(Length), Count
unflatten_8 = UnflattenTree(Tree=flatten(line_11), Guide=entwine_14)
series_7 = Series(Start=0, Step=1, Count=tstat_2.Length)
midpt_7 = CurveMiddle(Curve=pshift_15)
end_19 = EndPoints(Curve=unflatten_8)  # -> Start, End
lng_5 = ListLength(List=end_19.Start)
series_8 = Series(Start="1", Step=1, Count=lng_5)
panel_53 = Panel("""A
B
C""")
concat_3 = Concatenate(FragmentA=series_8, FragmentC=graft(panel_53))
concat_4 = Concatenate(FragmentA=graft(concat_3), FragmentB=series_7)

offset_8 = OffsetCurve(Curve=scale_2.Geometry, Distance=expr("x/2", [number_slider_15, neg_5]), Corners=1)
pshift_16 = ShiftPaths(Data=offset_8, Offset=-1)
loft_11 = Loft(Curves=pshift_16, Options={Adjust=False, Closed=False, LoftEnds=0, LoftSimp=0, LoftType=0, Rebuild=10, Refit=0.01})
rec = Rectangle(loft_11)
text_5 = Text(Location=flatten(midpt_7), Text=flatten(concat_4), Size=number_slider_16)

# ---- group: unrolling 2nd layer
debrep_5 = DeconstructBrep(Brep=entwine_10)  # -> Faces, Edges, Vertices
item_31 = ListItem(List=debrep_5.Faces, Index=Slider(2, range=0..3), Wrap=True)
md_slider_5 = MDSlider(SliderMode=0, slider_value=Point(0.5, 0.5, 0.5), x_domain=Domain(0, 1), y_domain=Domain(0, 1), z_domain=Domain(0, 1))
ccx_8 = CurveCurve(CurveA=graft(crv_27), CurveB=crv_29)  # -> Points, ParamsA, ParamsB
ccx_9 = CurveCurve(CurveA=graft(crv_29), CurveB=crv_28)  # -> Points, ParamsA, ParamsB
ccx_10 = CurveCurve(CurveA=graft(crv_28), CurveB=crv_27)  # -> Points, ParamsA, ParamsB
iso_3 = IsoCurve(Surface=reparameterize(item_31), UVPoint=md_slider_5)  # -> UIsocurve, VIsocurve
entwine_15 = Entwine(Branch00=flatten(ccx_8.Points), Branch01=flatten(ccx_9.Points), Branch02=flatten(ccx_10.Points), FlattenInputs=True)
pshift_17 = ShiftPaths(Data=simplify(iso_3.UIsocurve), Offset=-1)
len_18 = Length(Curve=pshift_17)
crv_cp_6 = CurveClosestPoint(Point=entwine_15, Curve=graft(pshift_17))  # -> Point, Parameter, Distance
tstat_3 = TreeStatistics(Tree=len_18)  # -> Paths, Length, Count
series_9 = Series(Start=Slider(4, range=0..10), Step=Slider(0.18, range=0..1), Count=tstat_3.Length)
series_10 = Series(Start=0, Step=Slider(13, range=0..100), Count=tstat_3.Count)
pt_12 = ConstructPoint(XCoordinate=series_9, YCoordinate=graft(series_10), ZCoordinate=0)
line_14 = LineSDL(Start=pt_12, Direction=Y, Length=len_18)  # -> simplify(graft(Line))
number_slider_42 = Slider(0.06, range=0..1)
ext_8 = ExtendCurve(Curve=line_14, Type="2", Start=number_slider_42, End=number_slider_42)

# ----
smaller_7 = SmallerThan(FirstNumber=crv_cp_6.Distance, SecondNumber=Slider(0.22, range=0..1))  # -> SmallerThan, OrEqualTo
cull_11 = CullPattern(List=crv_cp_6.Parameter, CullPattern=smaller_7.SmallerThan)

# ---- group: unrolling 2nd layer (continued)
eval_12 = EvaluateCurve(Curve=graft(pshift_17), Parameter=cull_11)  # -> Point, Tangent, Angle
dot_2 = DotDisplay(Point=eval_12.Point)
eval_13 = EvaluateCurve(Curve=line_14, Parameter=cull_11)  # -> Point, Tangent, Angle
shatter_11 = Shatter(Curve=ext_8, Parameters=cull_11)
end_20 = EndPoints(Curve=shatter_11)  # -> Start, End

# ----
dot_3 = DotDisplay(Point=[eval_11.Point, eval_13.Point])
cull_i_7 = CullIndex(List=end_20.Start, Indices="0", Wrap=True)

crv_48 = Curve(ext_8)
number_slider_43 = Slider(1, range=0..1)
len_19 = Length(Curve=crv_48)
equalst_2 = EqualityWithinTolerance(FirstNumber=len_19, SecondNumber=number_slider_8, Tolerance=number_slider_41)  # -> Equality, Inequality
dispatch_10 = Dispatch(List=crv_48, DispatchPattern=equalst_2.Equality)  # -> ListA, ListB
divide_12 = DivideCurve(Curve=dispatch_10.ListA, Count="2", Kinks=False)  # -> Points, Tangents, Parameters
divlength_4 = DivideLength(Curve=dispatch_10.ListB, Length=number_slider_7)  # -> Points, Tangents, Parameters
shatter_12 = Shatter(Curve=dispatch_10.ListA, Parameters=divide_12.Parameters)
shatter_13 = Shatter(Curve=dispatch_10.ListB, Parameters=divlength_4.Parameters)
end_21 = EndPoints(Curve=simplify(shatter_12))  # -> Start, End
end_22 = EndPoints(Curve=simplify(shatter_13))  # -> Start, End

merge_15 = Merge(Data1=shatter_9, Data2=shatter_10, Data3=shatter_13, Data4=shatter_12)
explode_11 = Explode(Curve=merge_15, Recursive=True)  # -> Segments, Vertices
len_20 = Length(Curve=merge_15)
extremums_9 = MinMax(Number=flatten(len_20))  # -> Minimum, Maximum

# ---- group: SHATTERED LINES / LAYER 2
line_15 = Line([shatter_13, shatter_12])

# ----
crv_49 = Curve(ext_8)
entwine_16 = Entwine(Branch00=crv_46, Branch01=crv_49, FlattenInputs=True)  # -> graft(Result)

# ---- group: intersections
pt_13 = Point(cull_i_6)
pt_14 = Point(cull_i_7)

# ----
number_slider_44 = Slider(0.13, range=0..1)
entwine_17 = Entwine(Branch00=line_12, Branch01=line_15, FlattenInputs=True)  # -> graft(Result)
entwine_18 = Entwine(Branch00=line_12, Branch01=line_15, FlattenInputs=True)
neg_17 = Negative(Value=number_slider_44)
offset_9 = OffsetCurve(Curve=entwine_17, Distance=expr("x/2", [number_slider_44, neg_17]), Corners=1)
pshift_18 = ShiftPaths(Data=offset_9, Offset=-1)
loft_12 = Loft(Curves=pshift_18, Options={Adjust=False, Closed=False, LoftEnds=0, LoftSimp=0, LoftType=0, Rebuild=10, Refit=0.01})
rec_2 = Rectangle(loft_12)
clean_2 = CleanTree(RemoveNulls=True, RemoveInvalid=True, RemoveEmpty=invert(simplify(False)), Tree=rec_2)
explode_12 = Explode(Curve=clean_2, Recursive=True)  # -> Segments, Vertices
pline_3 = PolyLine(Vertices=explode_12.Vertices, Closed=False)
unflatten_9 = UnflattenTree(Tree=pline_3, Guide=entwine_18)
bang_9 = ExplodeTree(Data=unflatten_9)  # -> Branch0, Branch1

entwine_19 = Entwine(Branch00=crv_46, Branch01=crv_49, FlattenInputs=True)
relay_7 = Relay([end_17.Start, end_17.End, end_22.Start, end_22.End, end_18.Start, end_18.End, end_21.Start, end_21.End])

gradient_8 = Gradient(
    LowerLimit=extremums_9.Minimum,
    UpperLimit=extremums_9.Maximum,
    Parameter=len_20,
    stops=[0: RGB(243, 57, 0), 0.1: RGB(236, 27, 60), 0.2: RGB(210, 0, 118), 0.3: RGB(103, 0, 120), 0.4: RGB(39, 72, 161), 0.5: RGB(1, 192, 229), 0.6: RGB(18, 178, 90), 0.7: RGB(79, 186, 8), 0.8: RGB(220, 237, 32), 0.9: RGB(247, 159, 20), 1: RGB(243, 57, 0)])
relay_8 = Relay([divlength_2.Points, divlength.Points])
jitter_3 = Jitter(List=gradient_8, Jitter=1, Seed=2)  # -> Values, Indices
number_slider_45 = Slider(2, range=0..10)
number_slider_46 = Slider(0.06, range=0..0.2)
duppt_2 = RemoveDuplicatePts(Points=relay_7, Tolerance=0.01)
circle_2 = CircleCNR(Center=duppt_2, Normal=Vector(0, 0, 1), Radius=Slider(0.2, range=0..0.2))
previewlw_10 = CustomPreviewLineweights(Geometry=merge_15, Shader=jitter_3.Values, Thickness=number_slider_45, Absolute=False)
previewlw_11 = CustomPreviewLineweights(Geometry=[shatter_6, shatter_7], Shader=jitter_3.Values, Thickness=number_slider_45, Absolute=False)
dots_2 = DotDisplay(Point=relay_8, Colour=RGB(0, 0, 0), Size=number_slider_46)
dots_3 = DotDisplay(Point=circle_2, Colour=RGB(0, 0, 0), Size=number_slider_46)

# ---- group: holes
number_slider_47 = Slider(0.012, range=0..1)  # disabled
panel_54 = Panel("2")  # disabled
division_5 = Division(A=number_slider_47, B=panel_54)  # disabled
cir_4 = Circle(Plane=[pt_13, pt_14], Radius=division_5)  # disabled

# ----
cp_2 = ClosestPoint(Point=duppt_2, Cloud=eval_3.Point)  # -> ClosestPoint, CPIndex, Distance
entwine_20 = Entwine(Branch00=pt_13, Branch01=pt_14, FlattenInputs=True)  # disabled
dot_4 = DotDisplay(Point=cp_2.ClosestPoint)
dots_4 = DotDisplay(Point=eval_3.Point, Colour=ColourSwatch(SwatchColor=RGB(145, 194, 151)), Size=number_slider_46)
rectangle_10 = Rectangle(Plane=entwine_20, XSize=dom, YSize=dom_2, Radius=0)  # -> Rectangle, Length; disabled
cir_5 = Circle(Plane=entwine_20, Radius=division_3)  # disabled
seam = Seam(Curve=reparameterize(cir_5), Seam=number_slider_10)  # disabled
divide_13 = DivideCurve(Curve=seam, Count=panel_15, Kinks=False)  # -> simplify(Points), Tangents, Parameters; disabled
pline_4 = PolyLine(Vertices=divide_13.Points, Closed=False)  # -> simplify(Polyline); disabled
pshift_19 = ShiftPaths(Data=pline_4, Offset=-1)  # disabled
bang_10 = ExplodeTree(Data=cir_5)  # -> Branch0, Branch1; disabled
bang_11 = ExplodeTree(Data=pshift_19)  # -> Branch0, Branch1; disabled
bang_12 = ExplodeTree(Data=rectangle_10.Rectangle)  # -> Branch0, Branch1; disabled
offset_10 = OffsetCurve(Curve=entwine_16, Distance=expr("x/2", [number_slider_11, neg_4]), Corners=1)
pshift_20 = ShiftPaths(Data=offset_10, Offset=-1)
loft_13 = Loft(Curves=pshift_20, Options={Adjust=False, Closed=False, LoftEnds=0, LoftSimp=0, LoftType=0, Rebuild=10, Refit=0.01})
rec_3 = Rectangle(loft_13)
clean_3 = CleanTree(RemoveNulls=True, RemoveInvalid=True, RemoveEmpty=invert(simplify(False)), Tree=rec_3)
explode_13 = Explode(Curve=clean_3, Recursive=True)  # -> Segments, Vertices
pline_5 = PolyLine(Vertices=explode_13.Vertices, Closed=False)
unflatten_10 = UnflattenTree(Tree=pline_5, Guide=entwine_19)
bang_13 = ExplodeTree(Data=unflatten_10)  # -> Branch0, Branch1; disabled
ccx_11 = CurveCurve(CurveA=bang_13.Branch0, CurveB=graft(bang_11.Branch0))  # -> Points, ParamsA, ParamsB; disabled
ccx_12 = CurveCurve(CurveA=bang_13.Branch1, CurveB=graft(bang_11.Branch1))  # -> Points, ParamsA, ParamsB; disabled
incurves_3 = PointInCurves(Point=ccx_11.Points, Curves=bang_10.Branch0)  # -> Relationship, Index, Point; disabled
incurves_4 = PointInCurves(Point=ccx_12.Points, Curves=bang_10.Branch1)  # -> Relationship, Index, Point; disabled
item_32 = ListItem(List=flatten(bang_12.Branch0), Index=flatten(incurves_3.Index), Wrap=True)  # disabled
item_33 = ListItem(List=flatten(bang_12.Branch1), Index=flatten(incurves_4.Index), Wrap=True)  # disabled
rdiff = RegionDifference(CurvesA=item_32, CurvesB=unflatten_10)  # disabled
rdiff_2 = RegionDifference(CurvesA=item_33, CurvesB=unflatten_10)  # disabled
bang_14 = ExplodeTree(Data=simplify(rdiff))  # -> Branch0, Branch1; disabled
bang_15 = ExplodeTree(Data=simplify(rdiff_2))  # -> Branch0, Branch1; disabled
rdiff_3 = RegionDifference(CurvesA=bang_14.Branch1, CurvesB=bang_14.Branch0)  # disabled
rdiff_4 = RegionDifference(CurvesA=bang_15.Branch0, CurvesB=bang_15.Branch1)  # disabled
replace = ReplaceItems(List=bang_12.Branch0, Item=rdiff_3, Indices=flatten(incurves_3.Index), Wrap=False)  # disabled
replace_2 = ReplaceItems(List=bang_12.Branch1, Item=rdiff_4, Indices=flatten(incurves_4.Index), Wrap=False)  # disabled
entwine_21 = Entwine(Branch00=replace, Branch01=replace_2, FlattenInputs=True)  # disabled
pshift_21 = ShiftPaths(Data=simplify(crv_49), Offset=-1)
explode_14 = Explode(Curve=bang_9.Branch0, Recursive=True)  # -> Segments, Vertices; disabled
explode_15 = Explode(Curve=replace, Recursive=True)  # -> Segments, Vertices; disabled

# ---- group: SHATTERED ALL
pshift_22 = ShiftPaths(Data=simplify(line_12), Offset=-1)
pshift_23 = ShiftPaths(Data=simplify(line_15), Offset=-1)
entwine_22 = Entwine(Branch0X=pshift_22, Branch1X=pshift_23, FlattenInputs=False)
tstat_4 = TreeStatistics(Tree=entwine_22)  # -> Paths, Length, Count
flatten = FlattenTree(Tree=entwine_22, Path="{0}")
partition_4 = PartitionList(List=flatten, Size=tstat_4.Length)  # -> simplify(Chunks)

# ----
line_16 = Line(simplify([shatter_13, shatter_12]))
entwine_23 = Entwine(Branch0X=pshift_14, Branch1X=pshift_21, FlattenInputs=False)
tstat_5 = TreeStatistics(Tree=entwine_23)  # -> Paths, Length, Count
entwine_24 = Entwine(Branch0X=line_13, Branch1X=line_16, FlattenInputs=False)
item_34 = ListItem(List=explode_14.Segments, Index=[panel_16, panel_17], Wrap=True)  # disabled
item_35 = ListItem(List=explode_15.Segments, Index=[panel_18, panel_19], Wrap=True)  # disabled
flatten_2 = FlattenTree(Tree=entwine_23, Path="{0}")
tstat_6 = TreeStatistics(Tree=entwine_24)  # -> Paths, Length, Count

# ---- group: shatteredCrvs_modelScale / layerOneShatteredLines
# NESTING
line_17 = Line(entwine_18)

# ---- group: shatteredCrvs_modelScale
xy_7 = XYPlane(Origin=Point(0, 0, 0))
scale_3 = Scale(Geometry=line_17, Center=xy_7, Factor=Slider(0.1, range=0..0.1))  # -> Geometry, Transform

# ----
midpt_8 = CurveMiddle(Curve=item_34)  # disabled
midpt_9 = CurveMiddle(Curve=item_35)  # disabled
partition_5 = PartitionList(List=flatten_2, Size=tstat_5.Length)  # -> simplify(Chunks)
flatten_3 = FlattenTree(Tree=entwine_24, Path="{0}")
crv_cp_7 = CurveClosestPoint(Point=midpt_9, Curve=graft(item_34))  # -> Point, Parameter, Distance; disabled
cps = ClosestPoints(Point=midpt_9, Cloud=midpt_8, Count=3)  # -> ClosestPoint, CPIndex, Distance; disabled

xy_8 = XYPlane(Origin=Point(0, 0, 0))
scale_4 = Scale(Geometry=partition_5, Center=xy_8, Factor=Slider(0.1, range=0..0.1))  # -> Geometry, Transform

partition_6 = PartitionList(List=flatten_3, Size=tstat_6.Length)  # -> simplify(Chunks)
smaller_8 = SmallerThan(FirstNumber=cps.Distance, SecondNumber=number_slider_12)  # -> SmallerThan, OrEqualTo; disabled
graft_8 = GraftTree(Tree=scale_3.Geometry, IncludeEmptyLists=True, IncludeNullItems=True)
dispatch_11 = Dispatch(List=item_34, DispatchPattern=smaller_8.SmallerThan)  # -> ListA, ListB; disabled
geo_6 = Geometry(dispatch_11.ListA)  # disabled
geo_7 = Geometry(dispatch_11.ListB)  # disabled

number_slider_48 = Slider(0.013, range=0..0.1)
neg_18 = Negative(Value=number_slider_48)
offset_11 = OffsetCurve(Curve=graft_8, Distance=expr("x/2", [number_slider_48, neg_18]), Corners=1)
pshift_24 = ShiftPaths(Data=offset_11, Offset=-1)
number_slider_49 = Slider(0.45, range=0..1)
loft_14 = Loft(Curves=pshift_24, Options={Adjust=False, Closed=False, LoftEnds=0, LoftSimp=0, LoftType=0, Rebuild=10, Refit=0.01})
rec_4 = Rectangle(loft_14)
clean_4 = CleanTree(RemoveNulls=True, RemoveInvalid=True, RemoveEmpty=invert(simplify(False)), Tree=rec_4)
rectangle_11 = Rectangle(Plane=PlaneXY(0, 0, 0), XSize=number_slider_49, YSize=Slider(0.95, range=0..1), Radius=0)  # -> Rectangle, Length
explode_16 = Explode(Curve=clean_4, Recursive=True)  # -> Segments, Vertices
pline_6 = PolyLine(Vertices=explode_16.Vertices, Closed=False)  # -> simplify(Polyline)
opennest = OpenNest(
    Sheets=rectangle_11.Rectangle,
    Geo=flatten(pline_6),
    Spacing=Slider(0, range=0..0.01),
    Placement=Slider(3, range=0..10),
    Tolerance=Slider(0.01, range=0..0.01),
    Rotations=Slider(1, range=0..10),
    Iterations=Slider(2, range=0..10),
    Seed=Slider(2, range=0..10),
    Reset=True,
    Run=False)  # -> Sheets, Geo, ID, Transform, IDS
panel_55 = Panel(clean_4)

scale_5 = Scale(Geometry=partition_4, Center=xy_3, Factor=Slider(0.1, range=0..0.1))  # -> Geometry, Transform

tstat_7 = TreeStatistics(Tree=partition_6)  # -> Paths, Length, Count
series_11 = Series(Start=0, Step=1, Count=tstat_7.Length)
end_23 = EndPoints(Curve=scale_4.Geometry)  # -> Start, End
midpt_10 = CurveMiddle(Curve=scale_5.Geometry)
lng_6 = ListLength(List=end_23.Start)
series_12 = Series(Start="1", Step=1, Count=lng_6)
panel_56 = Panel("""A
B
C
D
E
F""")
concat_5 = Concatenate(FragmentA=series_12, FragmentC=graft(panel_56))
concat_6 = Concatenate(FragmentA=graft(concat_5), FragmentB=series_11)

entwine_25 = Entwine(Branch00=pt_13, Branch01=pt_14, FlattenInputs=True)

# ---- group: shatteredCrvs_modelScale
xy_9 = XYPlane(Origin=Point(0, 0, 0))
scale_6 = Scale(Geometry=entwine_25, Center=xy_9, Factor=Slider(0.1, range=0..0.1))  # -> simplify(Geometry), Transform

# ----
pt_15 = Point(simplify(cull_i_6))
pt_16 = Point(cull_i_7)

# ---- group: holes
incurve_4 = PointInCurve(Point=flatten(scale_6.Geometry), Curve=pline_6)  # -> Relationship, Point
cull_12 = CullPattern(List=flatten(scale_6.Geometry), CullPattern=incurve_4.Relationship)
cir_6 = Circle(Plane=cull_12, Radius=Slider(0.0006, range=0..0.001))  # -> simplify(Circle)

# ----
text_6 = Text(Location=flatten(midpt_10), Text=flatten(concat_6), Size=Slider(0.005, range=0..0.01))
entwine_26 = Entwine(Branch00=pline_6, Branch01=text_6, Branch02=cir_6, FlattenInputs=True)
transform = Transform(Geometry=cir_6, Transform=graft(opennest.Transform))

# ---- group: beamNames
transform_2 = Transform(Geometry=text_6, Transform=graft(opennest.Transform))

# ---- group: sheets
geo_8 = Geometry(opennest.Sheets)

# ----
previewlw_12 = CustomPreviewLineweights(
    Geometry=opennest.Geo,
    Shader={diffuse=RGB(255, 105, 180), emission=RGB(76, 32, 54), shine=0.5, specular=RGB(255, 255, 255), transparency=0},
    Absolute=False)
lng_7 = ListLength(List=geo_8)
sheetsquantity = Panel(lng_7)
entwine_27 = Entwine(Branch00=opennest.Geo, Branch01=_0, Branch02=geo_8, Branch03=transform, Branch04=transform_2, FlattenInputs=True)
lng_8 = ListLength(List=opennest.Sheets)

# ---- group: converting to mm
scale_7 = Scale(Geometry=entwine_27, Center=Point(0, 0, 0), Factor=Slider(1000, range=0..1000))  # -> Geometry, Transform

# ----
series_13 = Series(Start=0, Step=expr("x/15", number_slider_49), Count=lng_8)

crv_50 = Curve([shatter_13, shatter_12])
unflatten_11 = UnflattenTree(Tree=flatten(line_14), Guide=entwine_10)
pshift_25 = ShiftPaths(Data=simplify(crv_50), Offset=-1)
tstat_8 = TreeStatistics(Tree=crv_50)  # -> Paths, graft(Length), Count
series_14 = Series(Start=0, Step=1, Count=tstat_8.Length)
midpt_11 = CurveMiddle(Curve=pshift_25)
end_24 = EndPoints(Curve=unflatten_11)  # -> Start, End
lng_9 = ListLength(List=end_24.Start)
series_15 = Series(Start="1", Step=1, Count=lng_9)
panel_57 = Panel("""D
E
F""")
concat_7 = Concatenate(FragmentA=series_15, FragmentC=graft(panel_57))
concat_8 = Concatenate(FragmentA=graft(concat_7), FragmentB=series_14)

X_6 = UnitX(Factor=series_13)
move_12 = Move(Geometry=opennest.Sheets, Motion=X_6)  # -> Geometry, Transform
area_5 = Area(Geometry=move_12.Geometry)  # -> Area, Centroid
rectangle_12 = Rectangle(Plane=area_5.Centroid, XSize=dom_3, YSize=dom_4, Radius=0)  # -> Rectangle, Length
lng_10 = ListLength(List=rectangle_12.Rectangle)
sheetsquantity_2 = Panel(lng_10)
text_7 = Text(Location=flatten(midpt_11), Text=flatten(concat_8), Size=number_slider_16)

# ---- group: Karamba
bang_16 = ExplodeTree(Data=crv_37)  # -> Branch0, Branch1, Branch2
# Karamba
toggle_8 = GroupToggle(ToggleActive=True, ToggleVisible=False)  # disabled
crv_51 = Curve(bang_16.Branch2)
panel_58 = Panel("""0
1""")
cull_13 = CullPattern(List=crv_51, CullPattern=invert(panel_58))
cull_14 = CullPattern(List=crv_51, CullPattern=panel_58)
mesh_16 = Mesh(mesh_final)
crv_52 = Curve(bang_16.Branch0)
crv_53 = Curve(bang_16.Branch1)

entwine_28 = Entwine(Branch00=crv_52, Branch01=crv_53, Branch02=cull_14, FlattenInputs=True)
explode_17 = Explode(Curve=entwine_28, Recursive=True)  # -> Segments, Vertices
multiplication_18 = Multiplication(A=height_2, B="100")
multiplication_19 = Multiplication(A=width_2, B="100")
trim_2 = TrimTree(Tree=explode_17.Segments, Depth=1)
cross_section = CrossSectionKaramba3D(
    FamilyNameOfCrossSection="DefaultCroSec",
    Material=matprops_2,
    Height_cm=multiplication_18,
    UpperFlangeWidth_cm=multiplication_19,
    LowerFlangeWidth_cm=multiplication_19,
    mode="Trapezoid")  # -> flatten(CrossSection)
midpt_12 = CurveMiddle(Curve=trim_2)
meshcp_2 = MeshClosestPoint(Point=midpt_12, Mesh=mesh_16)  # -> Point, Index, Parameter
meval_2 = MeshEval(Mesh=mesh_16, Parameter=meshcp_2.Parameter)  # -> Point, Normal, Colour
panel_59 = Panel("""dir1a
dir2a
dir3a""")
linetobeam = LineToBeamKaramba3D(
    Line=trim_2,
    Identifier=graft(panel_59),
    CrossSection=cross_section,
    New=True,
    Remove=True,
    LimitDistance_m=0.005,
    ZOrientation=meval_2.Normal,
    Bending=True,
    SetBucklingLength=True,
    ToPolylineMaxAngle=0.03,
    ToPolylineTolerance=0.01,
    ToPolylineMinEdgeLength=0.25)  # -> Element, Points, Info

number_slider_50 = Slider(13, range=0..40)
multiplication_20 = Multiplication(A=multiplication_18, B="2")
explode_18 = Explode(Curve=cull_13, Recursive=True)  # -> Segments, Vertices
trim_3 = TrimTree(Tree=explode_18.Segments, Depth=1)
cross_section_2 = CrossSectionKaramba3D(
    FamilyNameOfCrossSection="DefaultCroSec",
    Material=matprops_2,
    Height_cm=multiplication_20,
    UpperFlangeWidth_cm=number_slider_50,
    LowerFlangeWidth_cm=number_slider_50,
    mode="Trapezoid")  # -> flatten(CrossSection)
midpt_13 = CurveMiddle(Curve=trim_3)
meshcp_3 = MeshClosestPoint(Point=midpt_13, Mesh=mesh_16)  # -> Point, Index, Parameter
meval_3 = MeshEval(Mesh=mesh_16, Parameter=meshcp_3.Parameter)  # -> Point, Normal, Colour
panel_60 = Panel("""dir1b
dir2b
dir3b""")
linetobeam_2 = LineToBeamKaramba3D(
    Line=trim_3,
    Identifier=graft(panel_60),
    CrossSection=cross_section_2,
    New=True,
    Remove=True,
    LimitDistance_m=0.005,
    ZOrientation=meval_3.Normal,
    Bending=True,
    SetBucklingLength=True,
    ToPolylineMaxAngle=0.03,
    ToPolylineTolerance=0.01,
    ToPolylineMinEdgeLength=0.25)  # -> Element, Points, Info

entwine_29 = Entwine(Branch00=linetobeam.Element, Branch01=linetobeam_2.Element, FlattenInputs=True)

direction = Slider(0, range=0..2)
pi_10 = Pi(Factor=direction)
X_7 = UnitX(Factor=1)
Z_7 = UnitZ(Factor=1)
facen_2 = FaceNormals(Mesh=mesh_16)  # -> Centers, Normals
vrot_2 = Rotate(Vector=X_7, Axis=Z_7, Angle=pi_10)
nv_4 = NakedVertices(Mesh=mesh_16)  # -> ClothedIndex, NakedIndex, ClothedPts, NakedPts
devec = DeconstructVector(Vector=unitize(facen_2.Normals))  # -> XComponent, YComponent, ZComponent
amp_13 = Amplitude(Vector=vrot_2, Amplitude=Slider(0.53, range=0..1))
pmesh_2 = PlanktonMesh(mesh_16)
mvarea_2 = MeshVertexArea(PlanktonMesh=pmesh_2)  # -> Vertices, VertexNormals
number_slider_51 = Slider(-1.9, range=-2..0)
pt_17 = Point(nv_4.NakedPts)
multiplication_21 = Multiplication(A=amp_13, B=Slider(0.5, range=0..1))
abs_12 = Absolute(Value=devec.ZComponent)
pdecon_10 = Deconstruct(Point=pt_17)  # -> XComponent, YComponent, ZComponent
mwind_2 = MeshWindLoad(Wind=multiplication_21, VertexNormals=mvarea_2.VertexNormals, Option=Toggle(True))
larger_3 = LargerThan(FirstNumber=pdecon_10.ZComponent, SecondNumber="0.25")  # -> LargerThan, OrEqualTo
multiplication_22 = Multiplication(A=mwind_2, B="0.001")
cull_15 = CullPattern(List=pt_17, CullPattern=invert(larger_3.LargerThan))
supp = SupportKaramba3D(PosInd=cull_15, menu=[buttons(on, on, on, off, off, off)])  # -> flatten(Support)
multiplication_23 = Multiplication(A=multiplication_22, B=3)
vdisex_3 = VectorDisplayEx(Point=mvarea_2.Vertices, Vector=multiplication_23, Colour=ColourSwatch(SwatchColor=RGB(8, 125, 138)), Width=2)

# ----
abs_13 = Absolute(Value=devec.YComponent)
abs_14 = Absolute(Value=devec.XComponent)
addition_3 = Addition(A=abs_14, B=abs_13)
multiplication_24 = Multiplication(A=number_slider_51, B=Slider(0.7, range=0..1))

# ---- group: Karamba (continued)
larger_4 = LargerThan(FirstNumber=abs_12, SecondNumber=addition_3)  # -> LargerThan, OrEqualTo
cullf = CullFaces(Mesh=mesh_16, Pattern=invert(larger_4.LargerThan))
Z_8 = UnitZ(Factor=multiplication_24)
loads_4 = LoadsKaramba3D(Vector=Z_8, Mesh=cullf, LCase="0", mode="MeshLoad -Const.", menu=[buttons(off, off, on), buttons(on, on)])  # -> flatten(Load)

# ---- group: Karamba / Loads (Karamba3D)
loads_5 = LoadsKaramba3D(ForceVector=multiplication_22, Local=False, PosInd=mvarea_2.Vertices, LCase="0", mode="Point")  # -> flatten(Load)

# ---- group: Karamba / Assemble Model (Karamba3D)
assemble = AssembleModelKaramba3D(Elem=flatten(entwine_29), Support=flatten(supp), Load=flatten([loads, loads_4, loads_5]), LimitDistance_m=0.005)  # -> Model, Info, Mass_kg, CenterOfGravity, LoadCaseNames

# ---- group: Karamba (continued)
analyze = AnalyzeKaramba3D(Model=assemble.Model)  # -> CalculatedModel, MaximumDisplacement_cm, ResultingForceOfGravity_kN, ElasticEnergyChange_kNm
num_5 = Number(flatten(assemble.Mass_kg))
panel_61 = Panel(analyze.MaximumDisplacement_cm)
panel_62 = Panel(num_5)
modelview = ModelViewKaramba3D(Model=analyze.CalculatedModel, ResultFactors=1, ResultCase=-1)  # -> Model, DeformedMesh, DeformedAxes, DeformedModel

# ---- group: Karamba / Beam View (Karamba3D)
beamview = BeamViewKaramba3D(Model=modelview.Model)  # -> Model, MeshesOfRenderedBeams, DeformedBeamAxes, LegendColors, LegendTags

# ---- group: Karamba (continued)
legend_3 = Legend(Colour=beamview.LegendColors, Tags=beamview.LegendTags, LegendType=1)

# ----
mesh_17 = Mesh(beamview.MeshesOfRenderedBeams)

# ---- group: Text
panel_63 = Panel(analyze.MaximumDisplacement_cm)
roundd_2 = RoundToDecimalPlace(NumberX=panel_63, DecimalPlace=1, RoundType=0)  # -> Rounded, Difference
panel_64 = Panel(beamview.LegendTags)
gradient_9 = Gradient(LowerLimit=0, UpperLimit="20", Parameter=panel_63, stops=[0: RGB(0, 128, 0), 0.5: RGB(255, 255, 0), 1: RGB(255, 0, 0)])
lng_11 = ListLength(List=panel_64)
number_slider_52 = Slider(20, range=0..100)
series_16 = Series(Start=Slider(484, range=0..900), Step=Slider(20, range=0..20), Count=lng_11)
concat_9 = Concatenate(FragmentA=roundd_2.Rounded, FragmentB=" cm")
vec_5 = VectorXYZ(XComponent=Slider(61, range=0..900), YComponent=Slider(173, range=0..900), ZComponent=0)  # -> Vector, Length
vec_6 = VectorXYZ(XComponent=Slider(51, range=0..900), YComponent=series_16, ZComponent=0)  # -> Vector, Length
vec_7 = VectorXYZ(XComponent=Slider(61, range=0..900), YComponent=Slider(202, range=0..900), ZComponent=0)  # -> Vector, Length
texttoscreen = RenderTextToScreen(
    Text=graft("Max displacement:"),
    Location=graft(vec_5.Vector),
    Size=number_slider_52,
    Color=RGB(0, 0, 0),
    m_scWithvp=False)
texttoscreen_2 = RenderTextToScreen(Text=graft(panel_64), Location=graft(vec_6.Vector), Size=12, Color=RGB(0, 0, 0), m_scWithvp=False)
texttoscreen_3 = RenderTextToScreen(Text=graft(concat_9), Location=graft(vec_7.Vector), Size=number_slider_52, Color=gradient_9, m_scWithvp=False)

# ---- group: shear blocks
clean_5 = CleanTree(RemoveNulls=True, RemoveInvalid=True, RemoveEmpty=True, Tree=divlength_3.Parameters)
ins_2 = InsertItems(List=clean_5, Item="1", Indices=-1, Wrap=True)  # -> simplify(List)
clean_6 = CleanTree(RemoveNulls=True, RemoveInvalid=True, RemoveEmpty=True, Tree=divide_11.Parameters)  # -> simplify(Tree)
panel_65 = Panel("""0
-1""")
cir_7 = Circle(Plane=pt_15, Radius=Slider(0.07, range=0..1))
toggle_9 = GroupToggle(ToggleActive=True, ToggleVisible=False)  # disabled

# ---- group: shear blocks / 3.5 division 1st
t_value = Merge(Data1=ins_2, Data2=clean_6)
eval_14 = EvaluateCurve(Curve=crv_45, Parameter=t_value)  # -> Point, Tangent, Angle

# ---- group: shear blocks (continued)
cull_i_8 = CullIndex(List=eval_14.Point, Indices=panel_65, Wrap=True)  # -> simplify(List)
cir_8 = Circle(Plane=cull_i_8, Radius=Slider(0.26, range=0..1))
merge_16 = Merge(Data1=cir_7, Data2=cir_8)
runion = RegionUnion(Curves=merge_16)  # -> graft(Result)
brec = BoundingRectangle(Geometry=runion, Plane=PlaneXY(0, 0, 0), Axis=0, Slide=0, Union=True)  # -> Bounding, DimensionX, DimensionY
num_6 = Number(expr("x/2", brec.DimensionY))
dom_5 = ConstructDomain(DomainStart=expr("-x", num_6), DomainEnd=num_6)
area_6 = Area(Geometry=brec.Bounding)  # -> Area, Centroid
rectangle_13 = Rectangle(Plane=area_6.Centroid, XSize="-0.065 to 0.065", YSize=dom_5, Radius=0)  # -> Rectangle, Length

# ---- group: shatteredCrvs_modelScale
xy_10 = XYPlane(Origin=Point(0, 0, 0))
scale_8 = Scale(Geometry=rectangle_13.Rectangle, Center=xy_10, Factor=Slider(0.1, range=0..0.1))  # -> Geometry, Transform

# ----
explode_19 = Explode(Curve=scale_8.Geometry, Recursive=True)  # -> Segments, Vertices
item_36 = ListItem(List=explode_19.Segments, Index=0, Wrap=True)  # -> Item, Item1
len_21 = Length(Curve=item_36.Item1)
larger_5 = LargerThan(FirstNumber=len_21, SecondNumber=Slider(0.015, range=0..0.1))  # -> LargerThan, OrEqualTo
cull_16 = CullPattern(List=scale_8.Geometry, CullPattern=larger_5.LargerThan)
center_2 = Center(Geometric=cull_16, referenceAll=1)  # -> Center, Dimension

incurve_5 = PointInCurve(Point=flatten(center_2.Center), Curve=rec)  # -> Relationship, Point
cull_17 = CullPattern(List=flatten(center_2.Center), CullPattern=incurve_5.Relationship)

points_2 = PointList(Points=cull_17)
alongcrv_3 = SortAlongCurve(Points=cull_17, Curve=scale_2.Geometry)  # -> Points, Indices

pshift_26 = ShiftPaths(Data=scale_2.Geometry, Offset=-1)
tstat_9 = TreeStatistics(Tree=cull_17)  # -> Paths, Length, Count
series_17 = Series(Start=0, Step=1, Count=tstat_9.Length)
lng_12 = ListLength(List=pshift_26)
series_18 = Series(Start="1", Step=1, Count=lng_12)
panel_66 = Panel("""A
B
C""")
concat_10 = Concatenate(FragmentA=series_18, FragmentC=graft(panel_66))
concat_11 = Concatenate(FragmentA=graft(concat_10), FragmentB=series_17)

text_8 = Text(Location=flatten(cull_17), Text=flatten(concat_10), Size=Slider(0.005, range=0..0.01))
explode_20 = Explode(Curve=cull_16, Recursive=True)  # -> Segments, Vertices
join_15 = JoinCurves(Curves=explode_20.Segments, Preserve=False)
opennest_2 = OpenNest(
    Sheets=rectangle_11.Rectangle,
    Geo=flatten(join_15),
    Spacing=Slider(0, range=0..0.01),
    Placement=Slider(3, range=0..10),
    Tolerance=Slider(0.01, range=0..0.01),
    Rotations=Slider(1, range=0..10),
    Iterations=Slider(2, range=0..10),
    Seed=Slider(2, range=0..10),
    Reset=True,
    Run=False)  # -> Sheets, Geo, ID, Transform, IDS
transform_3 = Transform(Geometry=text_8, Transform=graft(opennest_2.Transform))
entwine_30 = Entwine(
    Branch00=opennest_2.Geo,
    Branch01=_0_2,
    Branch02=opennest_2.Sheets,
    Branch03=interior_cut,
    Branch04=transform_3,
    FlattenInputs=True)

# ---- group: converting to mm
scale_9 = Scale(Geometry=entwine_30, Center=Point(0, 0, 0), Factor=Slider(1000, range=0..1000))  # -> Geometry, Transform

# ----
move_13 = Move(Geometry=scale_9.Geometry, Motion=X_3)  # -> Geometry, Transform
# After baking a bit of human hand is needed:
# 
# - The sheets to be increased by 10mm in both directions(x,y)
# - The geometry inside them to be centered (at least 5mm margins)
relay_9 = Relay([scale_7.Geometry, move_13.Geometry])

# ---- group: laserCut
col = Colour([RGB(255, 255, 0), RGB(255, 255, 255), RGB(255, 0, 255), RGB(255, 0, 0), RGB(0, 255, 0)])
txt = Text(["Tall Exterior", "0", "Pàgina", "Tall Interior", "Gravat"])
legend_4 = Legend(Colour=col, Tags=txt, LegendType=1)
attributes = DefineObjectAttributes(Layer=graft(txt), Color=graft(col))
pcghfilepath = DefinitionPath(LastSaveLocalization="neutral,N")  # -> Directory, Name, DirectorySeparator
concat_12 = Concatenate(FragmentA=panel_22, FragmentB="_", FragmentC=panel_21, FragmentD="_", FragmentE=panel_20, FragmentF=".dwg")
tstat_10 = TreeStatistics(Tree=relay_9)  # -> Paths, Length, Count
repeat = RepeatData(Data=attributes, Length=graft(tstat_10.Length))
concat_13 = Concatenate(FragmentA=pcghfilepath.Directory, FragmentB=pcghfilepath.DirectorySeparator, FragmentC=concat_12)
pcexportas = ExportAs(
    Geometry=flatten(relay_9),
    ObjectAttributes=flatten(repeat),
    FileLocation=concat_13,
    Overwrite=Toggle(True),
    Export=False,
    CompMode=False,
    LastSaveLocalization="neutral,N")  # -> OK, ExportCommand
panel_67 = Panel("export to autocad")
bake = BakeObjects(Geometry=relay_9, Attributes=attributes, BakeName="bake2d", Bake=False)
